# Grasshopper definition Bark beetle - Fab machines output.gh (Grasshopper 0.9.76)
# Copyright: Co-de-iT
# plug-ins: LocalCode, Firefly.X, Kangaroo Components, setFlounderCamera, Weaverbird, Firefly.Core

number_slider = Slider(800, range=0..1000)
projected_image_width_mm = Panel("96")
projector_reolution_width_px = Panel("1920")
division = Division(A=projected_image_width_mm, B=projector_reolution_width_px)
multiplication = Multiplication(A=division, B=Slider(1080, range=0..10000))
multiplication_2 = Multiplication(A=division, B=Slider(800, range=0..1000))
panel = Panel(multiplication)
panel_2 = Panel(multiplication_2)
multiplication_3 = Multiplication(A=division, B="1000")
size_of_pixel_micron = Panel(multiplication_3)
enable_laser_stream = BooleanToggle(True)
overhang_degree_threshold = Slider(70, range=5..90)
support_spacing_distance = Slider(3, range=2..10)
use_end_mill_for_cutout = BooleanToggle(False)
support_diameter = Slider(0.8, range=0.4..2)
sample_reolution = Slider(0.5, range=0..1)
slice_at_full_depth = BooleanToggle(True)
edge_fade_distnce = Slider(4, range=0..100)
cutout_tolerance = Slider(0, range=-0.5..0.5)
layer_height = Slider(0.05, range=0.05..0.2)
# Fix project to cplane or check if flat
# 
# Fix pocket bit offset - make tool diam based?
# 
# Make pocket go full depth per pocket
# 
# Make tabs based on z0?
# Add angled cut functions - input = two curves
# Add basic 3D milling - roughing and finsihing
corner_angle_threshold = Slider(120, range=0..1000)
cutout_to_full_material_depth = BooleanToggle(False)
make_flea_jump_transitions = BooleanToggle(False)
# bugs
# 
# multi cutout  from last object with multiple objects
# 
# mini topp ved kule fres
# 
# bad pocket raster from pocket in pocket. pockets offset overshoot
# 
# bad small fillet finsih paths
cut_depth_line_engrave = Slider(0, range=0..20)
cnc_pocket_curves = Curve()
cnc_cutout_curves = Curve()
cnc_line_engrave_curves = Curve()
tab_breps = Brep()
breps_to_mill = Brep()
pipeline = GeometryPipeline(
    GroupByLayer=False,
    GroupByType=False,
    IncludeHidden=True,
    IncludeLocked=True,
    LayerFilter="CNC line engrave",
    NameFilter="*",
    TypeFilter=4)
# 2D drill
# 2D pocket engrave cut
# 2D tab cut
# 3D roughing
# 3D finishing
# 
# no auto layer, but 3d brep mesh filter
# tab makes bonus cutout paths
# ramp plunge makes tabs cut cutout
pipeline_2 = GeometryPipeline(
    GroupByLayer=False,
    GroupByType=False,
    IncludeHidden=True,
    IncludeLocked=True,
    LayerFilter="CNC 3D",
    NameFilter="*",
    TypeFilter=1073741848)
cnc_drill_curves = Curve()
pipeline_3 = GeometryPipeline(
    GroupByLayer=False,
    GroupByType=False,
    IncludeHidden=True,
    IncludeLocked=True,
    LayerFilter="CNC drill",
    NameFilter="*",
    TypeFilter=4)
pipeline_4 = GeometryPipeline(
    GroupByLayer=False,
    GroupByType=False,
    IncludeHidden=True,
    IncludeLocked=True,
    LayerFilter="CNC pocket",
    NameFilter="*",
    TypeFilter=4)
pipeline_5 = GeometryPipeline(
    GroupByLayer=False,
    GroupByType=False,
    IncludeHidden=True,
    IncludeLocked=True,
    LayerFilter="CNC cut",
    NameFilter="*",
    TypeFilter=4)
connect_toolpaths_levels = BooleanToggle(True)
pipeline_6 = GeometryPipeline(
    GroupByLayer=False,
    GroupByType=False,
    IncludeHidden=True,
    IncludeLocked=True,
    LayerFilter="CNC tabs",
    NameFilter="*",
    TypeFilter=1073741848)
milling_bit_diameter = Slider(6, range=0..10)
cut_depth_cutout = Slider(18.7, range=0.2..45)
pass_depth = Slider(19, range=0.4..20)
cut_depth_pocket = Slider(10, range=0..25)
cutout_tolerance_2 = Slider(0, range=-0.5..0.5)

# ---- group: Obsolete
breps_for_3d_mill = Brep()
pipeline_7 = GeometryPipeline(
    GroupByLayer=False,
    GroupByType=False,
    IncludeHidden=True,
    IncludeLocked=True,
    LayerFilter="CNC 3D",
    NameFilter="*",
    TypeFilter=0)
breps_for_3d_mill_2 = Brep([pipeline_7, breps_for_3d_mill])  # disabled

# ----
pocket_stepover = Slider(0.9, range=0..1)
meshes_for_3d_mill = Mesh()
plunge_rate = Slider(25, range=6..40)
pipeline_8 = GeometryPipeline(
    GroupByLayer=False,
    GroupByType=False,
    IncludeHidden=True,
    IncludeLocked=True,
    LayerFilter="CNC 3D",
    NameFilter="*",
    TypeFilter=32)
deviation_tolerance = Slider(0.01, range=0.01..0.1)
custom_jog_home_x = Slider(1200, range=0..2440)
custom_jog_home_y = Slider(0, range=0..1000)
feed_rate = Slider(25, range=6..150)
number_slider_2 = Slider(10, range=0..10)
ramp_angle = Slider(30, range=0..100)
# Make max depth value
# Make use cutout for last roughing pass boolean
# Fix roughing selection pattern
generate_roughing = BooleanToggle(False)
generate_finishing = BooleanToggle(True)
raster_direction_along_y = BooleanToggle(False)
generate_cutout = BooleanToggle(False)
spindle_speed = Slider(18000, range=6000..18000)
use_climb_direction = BooleanToggle(False)
use_inside_cutting = BooleanToggle(False)
use_custom_jog_home = BooleanToggle(True)
make_dogbones = BooleanToggle(False)
# Developed by Jens Dyvik / Fellesverkstedet
# 
# License: Creative Commons Attribution ShareAllike (cc-by-sa)
safe_z = Slider(6, range=0..20)
ramp_plunges = BooleanToggle(False)
crv = Curve(<curve referenced from the Rhino model>)
camera_height_factor = Slider(2.248, range=1.6..2.3)
use_spindle = BooleanToggle(True)
_3d_view_rotation_z = Slider(57, range=10..170)
_3d_view_rotation = Slider(0, range=0..360)

pt = ConstructPoint(XCoordinate=0, YCoordinate=0, ZCoordinate=0)
pt_2 = ConstructPoint(XCoordinate=0, YCoordinate=0, ZCoordinate="0.01")
ln = Line(StartPoint=pt, EndPoint=pt_2)
short_curve_for_making_empty_layer = Curve(ln)

pipeline_9 = GeometryPipeline(
    GroupByLayer=False,
    GroupByType=False,
    IncludeHidden=True,
    IncludeLocked=True,
    LayerFilter="Laser engrave",
    NameFilter="*",
    TypeFilter=1073741884)
pipeline_10 = GeometryPipeline(
    GroupByLayer=False,
    GroupByType=False,
    IncludeHidden=True,
    IncludeLocked=True,
    LayerFilter="Laser cut",
    NameFilter="*",
    TypeFilter=4)

# ---- group: 3D CNC mill - Advanced slice quality settings
curve_sample_slice_reduction = Panel("2")
reduction_tolerance = Panel("0.02")
inital_sample_slice_spacing = Panel("1")
top_layer_pocket_threshold = Panel("5")
sample_top_value_percentage = Panel("0.25")
top_slice_thickness = Panel("0.01")
vertical_angle_cutoff = Panel("89")
max_angle_limit = Panel("1")
lowes_slice_leftover_thickness = Panel("0.01")

# ---- group: SLA slice settings
camera_distance_79_for_50_micron = Panel("79")
gradient_sample_resolution = Panel(sample_reolution)
layer_height_2 = Panel(layer_height)
edge_fade_count = Panel(edge_fade_distnce)

# ---- group: 3D CNC mill - Cutout settings
cutout_tolerance_3 = Panel(cutout_tolerance)
cutout_to_full_material_depth_2 = Panel(cutout_to_full_material_depth)
material_thickness = Panel("19")
extra_cut_depth = Panel("0.5")

# ---- group: SLA support settings
support_start_height = Panel("5.4")
support_spacing_distance_2 = Panel(support_spacing_distance)
support_diameter_2 = Panel(support_diameter)
overhang_degree_threshold_2 = Panel(overhang_degree_threshold)
foundation_plate_thickness = Panel("0.5")
release_tab_length = Panel("5")
release_tab_angle = Panel("30")

# ---- group: 3D CNC mill settings
roughing_material_leftover = Panel("0.5")
generate_finishing_2 = Panel(generate_finishing)
generate_roughing_2 = Panel(generate_roughing)
generate_cutout_2 = Panel(generate_cutout)
finishing_stepover = Panel("0.3")
roughing_stepover = Panel("0.6")

# ----
connect_toolpath_tolerance_factor = Panel("2")
cycle_view = Button()

# ---- group: 3D CNC mill - Slice quality settings
slice_at_full_depth_2 = Panel(slice_at_full_depth)

# ----
make_flea_jump_transitions_2 = Integer(make_flea_jump_transitions)

# ---- group: SLA 3D print input geometry
# fix - slice objects true triggers camera to be set to 1:1 location
pipeline_11 = GeometryPipeline(
    GroupByLayer=False,
    GroupByType=False,
    IncludeHidden=True,
    IncludeLocked=True,
    LayerFilter="SLA 3D print",
    NameFilter="*",
    TypeFilter=1073741848)
pipeline_12 = GeometryPipeline(
    GroupByLayer=False,
    GroupByType=False,
    IncludeHidden=True,
    IncludeLocked=True,
    LayerFilter="SLA 3D print",
    NameFilter="*",
    TypeFilter=32)

# ----
connect_toolpaths_levels_2 = Integer(connect_toolpaths_levels)
button = Button()  # "2D/3D"

# ---- group: 2D CNC mill settings
milling_bit_diameter_2 = Panel(milling_bit_diameter)
feed_rate_2 = Panel(feed_rate)
plunge_rate_2 = Panel(plunge_rate)
cut_depth_pocket_2 = Panel(cut_depth_pocket)
pass_depth_2 = Panel(pass_depth)
cut_depth = Panel(cut_depth_cutout)
cut_depth_line_engrave_2 = Panel(cut_depth_line_engrave)

# ---- group: 3D CNC mill input geometry
meshes_for_3d_mill_2 = Mesh([pipeline_8, meshes_for_3d_mill])

# ---- group: Advanced 2D CNC mill settings
cutout_tolerance_4 = Panel(cutout_tolerance_2)
corner_angle_threshold_2 = Panel(corner_angle_threshold)
ramp_plunges_2 = Panel(ramp_plunges)
ramp_angle_2 = Panel(ramp_angle)
pocket_stepover_2 = Panel(pocket_stepover)
raster_direction_along_y_2 = Panel(raster_direction_along_y)
make_dogbones_2 = Panel(make_dogbones)
use_inside_cutting_2 = Panel(use_inside_cutting)
use_climb_direction_2 = Panel(use_climb_direction)

# ----
explode = Explode(Curve=crv, Recursive=True)  # -> Segments, Vertices
timer = Timer(TimerInterval=2, Target=[counter_2, counter])  # disabled
explode_2 = Explode(Curve=crv, Recursive=True)  # -> Segments, Vertices
list = ValueList({"One": 1, "Two": 2, "Three": 2² - 1, "Four": Sqrt(16)}, selected="Two")

# ---- group: PostProcessor settings
safe_z_height = Panel(safe_z)
use_spindle_2 = Panel(use_spindle)
spindle_speed_2 = Panel(spindle_speed)
use_custom_jog_home_2 = Panel(use_custom_jog_home)
custom_jog_home_x_2 = Panel(custom_jog_home_x)
custom_jog_home_y_2 = Panel(custom_jog_home_y)
deviation_tolerance_2 = Panel(deviation_tolerance)
job_name = Panel("Bark beetle stream")

# ----
series = Series(Start=0, Step=number_slider_2, Count=Slider(4, range=0..10))
list_2 = ValueList({"One": 1, "Two": 2, "Three": 2² - 1, "Four": Sqrt(16)}, selected="Three")
list_3 = ValueList({"One": 1, "Two": 2, "Three": 2² - 1, "Four": Sqrt(16)}, selected="One")
automill = Automill(breps_to_mill=[pipeline_2, breps_to_mill])  # -> pocket_curves_4, pocket_depths_4, _3d_line_engrave_curves_2, cutout_curves_3, cutout_depths_2
laser_engrave = Geometry(pipeline_9)
laser_cut = Curve(pipeline_10)

laser_and_cnc_bed = Curve(<curve referenced from the Rhino model>)
sla_3d_print_bed = Curve(<curve referenced from the Rhino model>)
fff_3d_print_bed = Curve(<curve referenced from the Rhino model>)
Y = UnitY(Factor=Slider(63, range=50..450))
Y_2 = UnitY(Factor=Slider(11, range=0..450))
Y_3 = UnitY(Factor=Slider(391, range=350..450))
move = Move(Geometry=fff_3d_print_bed, Motion=Y)  # -> Geometry, Transform
move_2 = Move(Geometry=sla_3d_print_bed, Motion=Y_2)  # -> Geometry, Transform
move_3 = Move(Geometry=laser_and_cnc_bed, Motion=Y_3)  # -> Geometry, Transform
area = Area(Geometry=flatten(sla_3d_print_bed))  # -> Area, Centroid
area_2 = Area(Geometry=flatten(move_3.Geometry))  # -> Area, Centroid
dim = Dimensions(Surface=flatten(move_3.Geometry))  # -> UDimension, VDimension
area_3 = Area(Geometry=flatten(move.Geometry))  # -> Area, Centroid
dim_2 = Dimensions(Surface=flatten(move.Geometry))  # -> UDimension, VDimension
area_4 = Area(Geometry=flatten(move_2.Geometry))  # -> Area, Centroid
dim_3 = Dimensions(Surface=flatten(move_2.Geometry))  # -> UDimension, VDimension
center_point_of_sla_bed = Point(area.Centroid)
multiplication_4 = Multiplication(A=dim.VDimension, B=camera_height_factor)
multiplication_5 = Multiplication(A=dim_3.VDimension, B=camera_height_factor)
multiplication_6 = Multiplication(A=dim_2.VDimension, B=camera_height_factor)
Z = UnitZ(Factor=multiplication_4)
Z_2 = UnitZ(Factor=multiplication_5)
Z_3 = UnitZ(Factor=multiplication_6)
move_4 = Move(Geometry=area_2.Centroid, Motion=Z)  # -> Geometry, Transform
move_5 = Move(Geometry=area_4.Centroid, Motion=Z_2)  # -> Geometry, Transform
move_6 = Move(Geometry=area_3.Centroid, Motion=Z_3)  # -> Geometry, Transform

center_point_of_sla_bed_2 = Point(center_point_of_sla_bed)
item = ListItem(List=explode.Segments, Index=0, Wrap=True)
item_2 = ListItem(List=explode.Segments, Index=list, Wrap=True)
item_3 = ListItem(List=explode_2.Segments, Index=list_3, Wrap=True)
item_4 = ListItem(List=explode_2.Segments, Index=list_2, Wrap=True)
smooth = SettingsQuality()
mesh = Mesh(pipeline_12)
divlength = DivideLength(Curve=item, Length=number_slider_2)  # -> Points, Tangents, Parameters
divlength_2 = DivideLength(Curve=item_3, Length=number_slider_2)  # -> Points, Tangents, Parameters
mesh_2 = MeshBrep(Brep=pipeline_11, Settings=smooth)
pass_depth_roughing_and_cutout = Number(pass_depth_2)
milling_bit_diameter_3 = Number(milling_bit_diameter_2)
int = Integer()
int_2 = Integer()
int_3 = Integer()
num = Number()
num_2 = Number()
# E:\Projects\Toolpaths\BarkBeetle\Networked fabrication\Stream testing\Laser test stream\laserstream_engrave.3dm
panel_3 = Panel("C:\Users\Jens\Dropbox (Fellesverkstedet)\Brukere\Bark beetle\Laser stream\laserstream_engrave.3dm")
meshes_for_3d_mill_3 = Mesh(meshes_for_3d_mill_2)
num_3 = Number()
# E:\Projects\Toolpaths\BarkBeetle\Networked fabrication\Stream testing\Laser test stream\laserstream_cut.3dm
panel_4 = Panel("C:\Users\Jens\Dropbox (Fellesverkstedet)\Brukere\Bark beetle\Laser stream\laserstream_cut.3dm")
breps_for_3d_mill_3 = Brep(breps_for_3d_mill_2)
crv_cp = CurveClosestPoint(Point=divlength.Points, Curve=item_2)  # -> Point, Parameter, Distance
crv_cp_2 = CurveClosestPoint(Point=divlength_2.Points, Curve=item_4)  # -> Point, Parameter, Distance
swatch = ColourSwatch(SwatchColor=RGB(117, 117, 117))
swatch_2 = ColourSwatch(SwatchColor=RGB(138, 90, 90))
mjoin = MeshJoin(Meshes=flatten([mesh_2, mesh]))

item_5 = ListItem(List=automill.cutout_curves_3, Index=0, Wrap=True)
null = NullItem(Item=item_5)  # -> NullFlags, InvalidFlags, Description
filter = StreamFilter(Gate=null.NullFlags, Stream0=automill.cutout_curves_3, Stream1=[pipeline_5, cnc_cutout_curves])

item_6 = ListItem(List=automill.pocket_curves_4, Index=0, Wrap=True)
null_2 = NullItem(Item=item_6)  # -> NullFlags, InvalidFlags, Description
filter_2 = StreamFilter(Gate=null_2.NullFlags, Stream0=automill.pocket_curves_4, Stream1=[pipeline_4, cnc_pocket_curves])

ln_2 = Line(StartPoint=divlength.Points, EndPoint=crv_cp.Point)
ln_3 = Line(StartPoint=divlength_2.Points, EndPoint=crv_cp_2.Point)
neg = Negative(Value=Slider(20, range=0..100))
neg_2 = Negative(Value=series)
material = CreateMaterial(Diffuse=swatch_2, Specular=RGB(255, 255, 255), Emission=RGB(0, 0, 0), Transparency=0, Shine=0)
material_2 = CreateMaterial(Diffuse=swatch, Specular=RGB(255, 255, 255), Emission=RGB(0, 0, 0), Transparency=0, Shine=0)
localcodeexport = LocalCodeExport(
    DestinationFilePath=panel_4,
    Export=enable_laser_stream,
    LayerNames="Laser cut stream",
    LayerColors=swatch_2,
    GeometryTree=[laser_cut, short_curve_for_making_empty_layer])
localcodeexport_2 = LocalCodeExport(
    DestinationFilePath=panel_3,
    Export=enable_laser_stream,
    LayerNames="Laser engrave stream",
    LayerColors=swatch,
    GeometryTree=[laser_engrave, short_curve_for_making_empty_layer])
Z_4 = UnitZ(Factor=neg)
crv_2 = Curve([ln_2, ln_3])
Z_5 = UnitZ(Factor=neg_2)
preview = CustomPreview(Geometry=laser_cut, Shader=material)
preview_2 = CustomPreview(Geometry=laser_engrave, Shader=material_2)
panel_5 = Panel(localcodeexport)

# ---- group: 2D CNC mill input geometry
cnc_line_engrave_curves_2 = Curve(reparameterize([pipeline, cnc_line_engrave_curves, automill._3d_line_engrave_curves_2]))
cnc_cutout_curves_2 = Curve(reparameterize(filter))
cnc_pocket_curves_2 = Curve(reparameterize(filter_2))
tab_breps_2 = Brep([pipeline_6, tab_breps])
cnc_drill_curves_2 = Curve(reparameterize([pipeline_3, cnc_drill_curves]))

# ----
panel_6 = Panel(localcodeexport_2)
move_7 = Move(Geometry=crv_2, Motion=graft(Z_5))  # -> Geometry, Transform
move_8 = Move(Geometry=crv_2, Motion=graft(Z_4))  # -> Geometry, Transform

number_slider_3 = Slider(25, range=0..100)
counter = Counter(Reset=button)
dom = ConstructDomain(DomainStart=Slider(0, range=0..100), DomainEnd=number_slider_3)
constrain = Constrain(Number=counter, Domain=dom)
panel_7 = Panel(constrain)
subtraction = Subtraction(A=number_slider_3, B=panel_7)
division_2 = Division(A=subtraction, B=number_slider_3)
graph = GraphMapper(division_2, x0=0, x1=1, y0=0, y1=1, container_name="Bezier", cpx=[0, 0.3626089692, 0.494587332, 1], cpy=[0, 0, 1, 1])

crv_3 = Curve(crv_2)

# ---- group: Add dogbones to pockets
milling_bit_diameter_4 = Panel(milling_bit_diameter_2)
make_dogbones_3 = Panel(make_dogbones_2)
corner_angle_threshold_3 = Panel(corner_angle_threshold_2)
gate = StreamGate(Stream=cnc_pocket_curves_2, Gate=make_dogbones_3)  # -> Target0, Target1
dogboner = Dogboner(
    curves_to_dogbone=gate.Target1,
    milling_bit_diameter=milling_bit_diameter_4,
    corner_angle_threshold=corner_angle_threshold_3,
    flip_cornes_boolean=Toggle(True))
filter_3 = StreamFilter(Gate=make_dogbones_3, Stream0=gate.Target0, Stream1=dogboner)

# ---- group: Add dogbones to cutouts
milling_bit_diameter_5 = Panel(milling_bit_diameter_2)
make_dogbones_4 = Panel(make_dogbones_2)
corner_angle_threshold_4 = Panel(corner_angle_threshold_2)
gate_2 = StreamGate(Stream=cnc_cutout_curves_2, Gate=make_dogbones_4)  # -> Target0, Target1
dogboner_2 = Dogboner(
    curves_to_dogbone=gate_2.Target1,
    milling_bit_diameter=milling_bit_diameter_5,
    corner_angle_threshold=corner_angle_threshold_4,
    flip_cornes_boolean=Toggle(False))
filter_4 = StreamFilter(Gate=make_dogbones_4, Stream0=gate_2.Target0, Stream1=dogboner_2)

# ----
preview_3 = CustomPreview(Geometry=crv_3, Shader=ColourSwatch(SwatchColor=RGB(0, 26, 33)))
number_slider_4 = Slider(2, range=0..10)

number_slider_5 = Slider(25, range=0..100)
counter_2 = Counter(Reset=cycle_view)
dom_2 = ConstructDomain(DomainStart=Slider(0, range=0..100), DomainEnd=number_slider_5)
constrain_2 = Constrain(Number=counter_2, Domain=dom_2)
panel_8 = Panel(constrain_2)
subtraction_2 = Subtraction(A=number_slider_5, B=panel_8)
division_3 = Division(A=subtraction_2, B=number_slider_5)
graph_2 = GraphMapper(division_3, x0=0, x1=1, y0=0, y1=1, container_name="Bezier", cpx=[0, 0.3626089692, 0.494587332, 1], cpy=[0, 0, 1, 1])

pt_3 = Point(flatten([move_4.Geometry, move_6.Geometry, move_5.Geometry]))
pt_4 = Point(flatten([area_2.Centroid, area_3.Centroid, area_4.Centroid]))
pline = PolyLine(Vertices=pt_4, Closed=False)
pline_2 = PolyLine(Vertices=pt_3, Closed=False)
detect = StateDetection(Value=cycle_view, Modulo=3)  # -> CurrentState, Counter
disc = Discontinuity(Curve=pline, Level=2)  # -> Points, Parameters
panel_9 = Panel(detect.Counter)
item_7 = ListItem(List=disc.Parameters, Index=panel_9, Wrap=True)
subtraction_3 = Subtraction(A=item_7, B=graph_2)
smaller = SmallerThan(FirstNumber=subtraction_3, SecondNumber=Slider(0, range=0..100))  # -> SmallerThan, OrEqualTo
lng = ListLength(List=pt_4)
subtraction_4 = Subtraction(A=lng, B=Slider(1, range=0..1))
multiplication_7 = Multiplication(A=subtraction_3, B=subtraction_4)
neg_3 = Negative(Value=multiplication_7)
filter_5 = StreamFilter(Gate=smaller.SmallerThan, Stream0=subtraction_3, Stream1=neg_3)
eval = EvaluateCurve(Curve=pline, Parameter=filter_5)  # -> Point, Tangent, Angle
eval_2 = EvaluateCurve(Curve=pline_2, Parameter=filter_5)  # -> Point, Tangent, Angle
yz = YZPlane(Origin=eval.Point)
xy = XYPlane(Origin=eval.Point)

multiplication_8 = Multiplication(A=milling_bit_diameter_3, B=finishing_stepover)
multiplication_9 = Multiplication(A=milling_bit_diameter_3, B=roughing_stepover)
multiplication_10 = Multiplication(A=milling_bit_diameter_3, B="0.5")
custom_mesh_settings = SettingsCustom(
    StitchSeams=True,
    SimplePlanes=False,
    Refine=True,
    MinCount=16,
    MaxCount=400,
    AspectRatio=20,
    MaxDistance=0,
    MaxAngle=20,
    MinEdge=number_slider_4,
    MaxEdge=number_slider_4)
smooth_2 = SettingsQuality()
jagged = SettingsSpeed()
stepover_distance_roughing = Panel(multiplication_9)
milling_bit_radius = Panel(multiplication_10)
stepover_distance = Panel(multiplication_8)
mesh_3 = MeshBrep(Brep=breps_for_3d_mill_3, Settings=custom_mesh_settings)
# Horizontal slice from bottom.
# Start with tool dimater spacing.
# Evalute max angle of surface between slices.
# Generate additional slices based on inclination
# make guide graph with points position from average inclination of slices
# (average of top 25%)
# 
# cull sampling points colliding with mesh
# 
# rebuild graph with even distance for slice density positions
# 
# pocket last top 0.1mm slice if needed
filter_6 = StreamFilter(Gate=use_end_mill_for_cutout, Stream0=milling_bit_radius)
merge = Merge(Data1=flatten(mesh_3), Data2=flatten(meshes_for_3d_mill_3))
addition = Addition(A=filter_6, B=extra_cut_depth)
flatten = FlattenTree(Tree=merge, Path="{0}")
meshes_for_3d_milling = Mesh(flatten)

pocket_depths_from_automill = Number(automill.pocket_depths_4)
item_8 = ListItem(List=pocket_depths_from_automill, Index=0, Wrap=True)
null_3 = NullItem(Item=item_8)  # -> NullFlags, InvalidFlags, Description
filter_7 = StreamFilter(Gate=null_3.NullFlags, Stream0=pocket_depths_from_automill, Stream1=cut_depth_pocket_2)

cut_depths_from_automill = Number(automill.cutout_depths_2)
item_9 = ListItem(List=cut_depths_from_automill, Index=0, Wrap=True)
null_4 = NullItem(Item=item_9)  # -> NullFlags, InvalidFlags, Description
filter_8 = StreamFilter(Gate=null_4.NullFlags, Stream0=cut_depths_from_automill, Stream1=cut_depth)

panel_10 = Panel(graph)
mjoin_2 = MeshJoin(Meshes=meshes_for_3d_milling)
bbox = BoundingBox(Content=meshes_for_3d_milling, Plane=PlaneXY(0, 0, 0), UnionBox=False)  # -> Box, Box_2
debrep = DeconstructBrep(Brep=bbox.Box)  # -> Faces, Edges, Vertices
bbox_2 = BoundingBox(Content=meshes_for_3d_milling, Plane=PlaneXY(0, 0, 0), UnionBox=False)  # -> Box, Box_2

meshes_without_offset = Mesh(meshes_for_3d_milling)
bbox_3 = BoundingBox(Content=meshes_without_offset, Plane=PlaneXY(0, 0, 0), UnionBox=False)  # -> Box, Box_2
debrep_2 = DeconstructBrep(Brep=bbox_3.Box)  # -> Faces, Edges, Vertices
item_10 = ListItem(List=debrep_2.Vertices, Index="4", Wrap=True)
top_slice_sample_thickness = Panel("0.01")
simplify = SimplifyTree(Tree=item_10, Front=False)
pdecon = Deconstruct(Point=simplify)  # -> XComponent, YComponent, ZComponent
subtraction_5 = Subtraction(A=pdecon.ZComponent, B=top_slice_sample_thickness)
pt_5 = ConstructPoint(XCoordinate=pdecon.XComponent, YCoordinate=pdecon.YComponent, ZCoordinate=subtraction_5)
xy_2 = XYPlane(Origin=pt_5)
sec = MeshPlane(Mesh=graft(meshes_without_offset), Plane=xy_2)
top_layer_slice = Curve(sec)

Y_4 = UnitY(Factor=1)

detect_2 = StateDetection(Value=button, Modulo=2)  # -> CurrentState, Counter
panel_11 = Panel(detect_2.Counter)
larger = LargerThan(FirstNumber=panel_11, SecondNumber=Slider(0, range=0..100))  # -> LargerThan, OrEqualTo
subtraction_6 = Subtraction(A=Slider(1, range=0..1), B=graph)
filter_9 = StreamFilter(Gate=larger.LargerThan, Stream0=graph, Stream1=subtraction_6)
Z_6 = UnitZ(Factor=1)
round = Round(Number=filter_9)  # -> Nearest, Floor, Ceiling
multiplication_11 = Multiplication(A=_3d_view_rotation_z, B=filter_9)
filter_10 = StreamFilter(Gate=round.Ceiling, Stream0=Y_4, Stream1=Z_6)
panel_12 = Panel(multiplication_11)

item_11 = ListItem(List=debrep.Vertices, Index="0", Wrap=True)
item_12 = ListItem(List=debrep.Vertices, Index="4", Wrap=True)
debrep_3 = DeconstructBrep(Brep=bbox_2.Box)  # -> Faces, Edges, Vertices
xy_3 = XYPlane(Origin=item_12)
item_13 = ListItem(List=debrep_3.Vertices, Index="0", Wrap=True)
item_14 = ListItem(List=debrep_3.Vertices, Index="4", Wrap=True)
pshift = ShiftPaths(Data=xy_3, Offset=-1)
dist = Distance(PointA=item_14, PointB=item_13)
mshadow = MeshShadow(Mesh=meshes_for_3d_milling, Light=Vector(0, 0, -1), Plane=pshift)
model_height = Panel(dist)
lng_2 = ListLength(List=mshadow)
Z_7 = UnitZ(Factor=1)
cp = ControlPoints(Curve=mshadow)  # -> Points, Weights, Knots
sort = SortList(Keys=flatten(lng_2))  # -> Keys, ValuesA
rev = Reverse(Vector=Z_7)
simplify_2 = SimplifyTree(Tree=model_height, Front=False)
item_15 = ListItem(List=sort.Keys, Index=0, Wrap=True)

milling_bit_diameter_6 = Panel(milling_bit_diameter_3)
top_layer_pocket_threshold_2 = Panel(top_layer_pocket_threshold)
multiplication_12 = Multiplication(A=milling_bit_diameter_6, B=top_layer_pocket_threshold_2)
top_layer_pocket_threshold_area = Panel(multiplication_12)
join = JoinCurves(Curves=sec, Preserve=False)
item_16 = ListItem(List=join, Index=0, Wrap=True)
lng_3 = ListLength(List=join)
area_5 = Area(Geometry=item_16)  # -> Area, Centroid
larger_2 = LargerThan(FirstNumber=lng_3, SecondNumber="1")  # -> LargerThan, OrEqualTo
larger_3 = LargerThan(FirstNumber=area_5.Area, SecondNumber=top_layer_pocket_threshold_area)  # -> LargerThan, OrEqualTo
xor = GateXor(A=larger_2.LargerThan, B=larger_3.LargerThan)
skip_top_slices_boolean = Integer(xor)

cutout_to_full_material_depth_3 = Panel(cutout_to_full_material_depth_2)
meshray = MeshRay(Mesh=mjoin_2, Point=cp.Points, Direction=rev)  # -> Point, Hit
model_height_2 = Panel(simplify_2)
material_thickness_2 = Panel(material_thickness)
not = GateNot(A=item_15)
measured_projected_size = Slider(263, range=0..1000)
expected_projected_size = Slider(300, range=0..1000)
rotation_correction = Slider(-0.01, range=-0.1..0.1)
pline_3 = PolyLine(Vertices=meshray.Point, Closed=False)
position_correction_x = Slider(14, range=0..100)
position_correction_y = Slider(3, range=-10..10)
rotate = Rotate(Geometry=eval_2.Point, Angle=degrees(panel_12), Plane=yz)  # -> Geometry, Transform
failed_mesh_shadow_boolean = Panel(not)
# make grid?
slice_at_full_depth_boolean = Panel(slice_at_full_depth_2)
num_4 = Number(_3d_view_rotation)
pshift_2 = ShiftPaths(Data=pline_3, Offset=-1)
rotate_2 = Rotate(Geometry=rotate.Geometry, Angle=degrees(num_4), Plane=xy)  # -> Geometry, Transform
cutting_curves = Curve(filter_4)
pocket_curves = Curve(filter_3)
filter_11 = StreamFilter(Gate=cutout_to_full_material_depth_3, Stream0=model_height_2, Stream1=material_thickness_2)
bbox_4 = BoundingBox(Content=pshift_2, Plane=PlaneXY(0, 0, 0), UnionBox=True)  # -> Box, Box_2
top_slice_location_point = Point(item_12)
or = GateOr(A=slice_at_full_depth_boolean, B=failed_mesh_shadow_boolean)
target_position_table_projection = Point(eval.Point)
Y_5 = UnitY(Factor=1)
debrep_4 = DeconstructBrep(Brep=bbox_4.Box)  # -> Faces, Edges, Vertices
cutout_depth = Panel(filter_11)
camera_position_table_projection = Point(rotate_2.Geometry)
top_slice_thickness_2 = Panel(top_slice_thickness)
panel_13 = Panel(or)
up_vector_table_projection = Vector(filter_10)
up_vector_render_sla = Vector(Y_5)
item_17 = ListItem(List=debrep_4.Vertices, Index=0, Wrap=True)
support_diameter_3 = Panel(support_diameter_2)
filter_12 = StreamFilter(Gate=panel_13, Stream0=item_17, Stream1=item_11)
simplify_3 = SimplifyTree(Tree=top_slice_location_point, Front=False)
stepover_distance_2 = Panel(stepover_distance)
lowes_slice_leftover_thickness_2 = Panel(lowes_slice_leftover_thickness)
simplify_4 = SimplifyTree(Tree=filter_12, Front=False)
pdecon_2 = Deconstruct(Point=simplify_3)  # -> XComponent, YComponent, ZComponent
pdecon_3 = Deconstruct(Point=simplify_4)  # -> XComponent, YComponent, ZComponent
subtraction_7 = Subtraction(A=pdecon_2.ZComponent, B=top_slice_thickness_2)
addition_2 = Addition(A=pdecon_3.ZComponent, B=lowes_slice_leftover_thickness_2)
pt_6 = ConstructPoint(XCoordinate=pdecon_2.XComponent, YCoordinate=pdecon_2.YComponent, ZCoordinate=subtraction_7)
pt_7 = ConstructPoint(XCoordinate=pdecon_2.XComponent, YCoordinate=pdecon_2.YComponent, ZCoordinate=addition_2)
use_inside_cutting_3 = Panel(use_inside_cutting_2)
filter_13 = StreamFilter(
    Gate=use_inside_cutting_3,
    Stream0=ColourSwatch(SwatchColor=RGB(181, 253, 255)),
    Stream1=ColourSwatch(SwatchColor=RGB(255, 61, 155)))
lower_boundary_point = Point(pt_7)
inital_sample_slice_spacing_2 = Panel(inital_sample_slice_spacing)
glowing_curves = GlowingCurves(pipe_color=ColourSwatch(SwatchColor=RGB(66, 249, 255)))  # disabled
meshes_for_3d_milling_2 = Mesh(meshes_for_3d_milling)
multiplication_13 = Multiplication(A=inital_sample_slice_spacing_2, B=curve_sample_slice_reduction)
graft = GraftTree(Tree=meshes_for_3d_milling_2, IncludeEmptyLists=True, IncludeNullItems=True)
inital_sample_slice_spacing_3 = Panel(multiplication_13)
Z_8 = UnitZ(Factor="0.1")
Z_9 = UnitZ(Factor=1)
mjoin_3 = MeshJoin(Meshes=meshes_for_3d_milling_2)
Z_10 = UnitZ(Factor=1)
support_diameter_4 = Panel(support_diameter_2)
multiplication_14 = Multiplication(A=support_diameter_4, B="1.5")

# ---- group: Create support tip
pt_8 = ConstructPoint(XCoordinate=0, YCoordinate=0, ZCoordinate=multiplication_14)
pt_9 = ConstructPoint(XCoordinate=0, YCoordinate=0, ZCoordinate=0)
ln_4 = Line(StartPoint=pt_9, EndPoint=pt_8)
multiplication_15 = Multiplication(A=support_diameter_4, B="0.25")
multiplication_16 = Multiplication(A=support_diameter_4, B="0.5")
panel_14 = Panel("""0
1""")
vpipe = PipeVariable(Curve=ln_4, Parameters=panel_14, Radii=[multiplication_15, multiplication_16], Caps="2")
custom_mesh_settings_2 = SettingsCustom(
    StitchSeams=True,
    SimplePlanes=False,
    Refine=True,
    MinCount=16,
    MaxCount=400,
    AspectRatio=20,
    MaxDistance=0,
    MaxAngle=20,
    MinEdge="0.1",
    MaxEdge=0)
mesh_4 = MeshBrep(Brep=vpipe, Settings=custom_mesh_settings_2)
support_tip_mesh = Mesh(mesh_4)

# ----
lng_4 = ListLength(List=meshes_for_3d_milling)
larger_4 = LargerThan(FirstNumber=lng_4, SecondNumber="1")  # -> LargerThan, OrEqualTo
max_angle_limit_2 = Panel(max_angle_limit)
xy_4 = XYPlane(Origin=Point(0, 0, 0))
mesh_for_sla_print = Mesh(mjoin)
stepover = Panel(stepover_distance)
render_distance_from_workspace = Slider(10000, range=0..10000)
number_slider_6 = Slider(0.01, range=0..0.1)
center_point_of_sla_bed_3 = Point(center_point_of_sla_bed_2)
pdecon_4 = Deconstruct(Point=center_point_of_sla_bed_3)  # -> XComponent, YComponent, ZComponent
material_3 = CreateMaterial(
    Diffuse=ColourSwatch(SwatchColor=RGB(33, 108, 112)),
    Specular=RGB(255, 255, 255),
    Emission=RGB(0, 0, 0),
    Transparency=0,
    Shine=Slider(70, range=0..100))
neg_4 = Negative(Value=render_distance_from_workspace)
number_slider_7 = Slider(1000, range=0..1000)
skip_top_slices_boolean_2 = Integer(skip_top_slices_boolean)
Z_11 = UnitZ(Factor=1)
top_layer_slice_2 = Curve(top_layer_slice)
Y_6 = UnitY(Factor=neg_4)
neg_5 = Negative(Value=Z_11)
neg_6 = Negative(Value=number_slider_7)
dom_3 = ConstructDomain(DomainStart=neg_6, DomainEnd=number_slider_7)
crv_4 = Curve(top_layer_slice_2)
p_n_c = PickNChoose(Pattern=skip_top_slices_boolean_2, Stream1=crv_4)
swatch_3 = ColourSwatch(SwatchColor=RGB(0, 0, 0))
Z_12 = UnitZ(Factor=top_slice_sample_thickness)
move_9 = Move(Geometry=p_n_c, Motion=Z_12)  # -> Geometry, Transform
top_slice_section_for_pocket = Curve(move_9.Geometry)
material_4 = CreateMaterial(Diffuse=swatch_3, Specular=swatch_3, Emission=swatch_3, Transparency=0, Shine=0)
meshes_for_3d_milling_3 = Mesh(graft(meshes_for_3d_milling))
meshes_for_3d_milling_4 = Mesh(mjoin_2)
milling_bit_radius_2 = Panel(multiplication_10)
initial_sample_lenght = Panel("0.2")
samples_per_circle = Panel("24")
reduction_tolerance_2 = Panel(reduction_tolerance)
meshes_for_3d_milling_5 = Mesh(meshes_for_3d_milling_4)
milling_bit_radius_3 = Panel(milling_bit_radius_2)
reduction_tolerance_3 = Panel(reduction_tolerance_2)
corner_sample_angle_threshold = Slider(9, range=0..100)
Z_13 = UnitZ(Factor=1)
panel_15 = Panel(corner_sample_angle_threshold)
xy_5 = XYPlane(Origin=Point(0, 0, 0))
rad = Radians(Degrees=panel_15)
samples_per_circle_2 = Panel(samples_per_circle)
cir = Circle(Plane=xy_5, Radius=milling_bit_radius_3)
len = Length(Curve=cir)
division_4 = Division(A=len, B=samples_per_circle_2)
reduction_tolerance_4 = Panel(reduction_tolerance_2)

mesh_5 = Mesh(meshes_for_3d_milling)
bbox_5 = BoundingBox(Content=mesh_5, Plane=PlaneXY(0, 0, 0), UnionBox=False)  # -> Box, Box_2
debrep_5 = DeconstructBrep(Brep=bbox_5.Box)  # -> Faces, Edges, Vertices
item_18 = ListItem(List=debrep_5.Vertices, Index="4", Wrap=True)
xy_6 = XYPlane(Origin=item_18)
pshift_3 = ShiftPaths(Data=xy_6, Offset=-1)
area_cull = Panel("10")
milling_bit_radius_4 = Panel(milling_bit_radius)
mshadow_2 = MeshShadow(Mesh=mesh_5, Light=Vector(0, 0, -1), Plane=pshift_3)
area_6 = Area(Geometry=mshadow_2)  # -> Area, Centroid
multiplication_17 = Multiplication(A=milling_bit_radius_4, B=area_cull)
smaller_2 = SmallerThan(FirstNumber=area_6.Area, SecondNumber=multiplication_17)  # -> SmallerThan, OrEqualTo
# fix: select failed shadow and tringulate for speed
dispatch = Dispatch(List=mshadow_2, DispatchPattern=smaller_2.SmallerThan)  # -> ListA, ListB

xy_7 = XYPlane(Origin=Point(0, 0, 0))
simplify_5 = SimplifyTree(Tree=top_layer_slice_2, Front=False)
project = Project(Geometry=simplify_5, Plane=xy_7)  # -> Geometry, Transform

tri = Triangulate(Mesh=mesh_5)  # -> Mesh, Count; disabled
wbtriangles = WeaverbirdsSplitTrianglesSubdivision(MeshCurves=tri.Mesh, Level=2)
pshift_4 = ShiftPaths(Data=wbtriangles, Offset=-1)

# ----
# do mesh inclusion test?
minc = MeshInclusion(Strict=False)

joined_meshes = Mesh(mjoin_2)

oultine_curve_for_cutout = Curve(dispatch.ListB)
tool_diameter = Panel(milling_bit_diameter_3)
simplify_6 = SimplifyTree(Tree=oultine_curve_for_cutout, Front=False)
tool_diameter_2 = Panel(tool_diameter)
xy_8 = XYPlane(Origin=Point(0, 0, 0))
operation_plane = Plane(xy_8)
multiplication_18 = Multiplication(A=tool_diameter_2, B="0.5")
tool_radius = Panel(multiplication_18)
cutout_tolerance_5 = Panel(cutout_tolerance_3)
addition_3 = Addition(A=tool_radius, B=cutout_tolerance_5)
compensated_tool_radius = Panel(addition_3)

# ---- group: Filter out open curves
curves_for_cutout = Curve(simplify_6)
cls = Closed(Curve=curves_for_cutout)  # -> Closed, Periodic
dispatch_2 = Dispatch(List=curves_for_cutout, DispatchPattern=cls.Closed)  # -> ListA, ListB

# ---- group: Merge overlapping curves
curves_for_merging_overlap = Curve(dispatch_2.ListA)
mcx = MultipleCurves(Curves=curves_for_merging_overlap)  # -> Points, IndexA, IndexB, ParamA, ParamB
dcon = DeleteConsecutive(Set=[mcx.IndexA, mcx.IndexB], Wrap=False)  # -> Set, Count
item_19 = ListItem(List=curves_for_merging_overlap, Index=dcon.Set, Wrap=True)
cull_i = CullIndex(List=curves_for_merging_overlap, Indices=dcon.Set, Wrap=True)
runion = RegionUnion(Curves=item_19, Plane=operation_plane)
merged_overlapping_curves = Curve([runion, cull_i])

# ----
ratio_for_cull = Panel("0.5")
ratio_for_cull_2 = Panel("1")
threshold_for_rebuild = Panel("0.1")
# fix bad corner cull and angle check. use obr test triangle
panel_16 = Panel("2")
use_inside_cutting_4 = Panel("0")
generate_roughing_3 = Panel(generate_roughing_2)
operation_plane_2 = Plane(operation_plane)
neg_7 = Negative(Value=compensated_tool_radius)
finish_stepover = Panel(finishing_stepover)
roughing_stepover_2 = Panel(roughing_stepover)
milling_bit_radius_5 = Panel(milling_bit_radius)
reduction_tolerance_5 = Panel(reduction_tolerance)
multiplication_19 = Multiplication(A=milling_bit_radius_5, B="1")
generate_finishing_3 = Panel(generate_finishing_2)
neg_8 = Negative(Value=milling_bit_radius_5)
Z_14 = UnitZ(Factor=neg_8)
lng_5 = ListLength(List=meshes_for_3d_milling)
smaller_3 = SmallerThan(FirstNumber=lng_5, SecondNumber="2")  # -> SmallerThan, OrEqualTo
crv_5 = Curve(<curve referenced from the Rhino model>)
number_slider_8 = Slider(0, range=0..1)
generate_cutout_3 = Panel(generate_cutout_2)
generate_roughing_4 = Panel(generate_roughing_2)
connect_toolpaths_levels_3 = Integer(connect_toolpaths_levels_2)
stepover_distance_3 = Panel(stepover_distance)
make_flea_jump_transitions_3 = Integer(make_flea_jump_transitions_2)
connect_toolpath_tolerance_factor_2 = Panel(connect_toolpath_tolerance_factor)
multiplication_20 = Multiplication(A=stepover_distance_3, B=connect_toolpath_tolerance_factor_2)
stepover_distance_4 = Panel(stepover_distance_3)
Z_15 = UnitZ(Factor=stepover_distance_4)

# ---- group: SLA export slider
# How to render SLA slices:: -Set Render slice to "True"
# 
# -Rigth click Curent slice slider and choose "Animate..."
# 
# -Make file name extension .png
# 
# -Choose correct viewport name (Default Fellesverkstedet)
# 
# -Fill in correct number of slices in frame count
# 
# -Click OK
current_slice = Slider(0.468132, range=0..1)
generate_suport = BooleanToggle(True)
render_slice = BooleanToggle(False)

# ----
filter_14 = StreamFilter(Gate=generate_suport, Stream1=mjoin)

mesh_for_sla_print_2 = Mesh(filter_14)
bbox_6 = BoundingBox(Content=mesh_for_sla_print_2, Plane=PlaneXY(0, 0, 0), UnionBox=True)  # -> Box, Box_2
debrep_6 = DeconstructBrep(Brep=bbox_6.Box)  # -> Faces, Edges, Vertices
support_start_height_2 = Panel(support_start_height)
support_spacing_distance_3 = Panel(support_spacing_distance_2)
item_20 = ListItem(List=debrep_6.Faces, Index="10", Wrap=True)
neg_9 = Negative(Value=support_start_height_2)
area_7 = Area(Geometry=item_20)  # -> Area, Centroid
xy_9 = XYPlane(Origin=area_7.Centroid)
Z_16 = UnitZ(Factor=neg_9)
move_10 = Move(Geometry=xy_9, Motion=Z_16)  # -> Geometry, Transform
build_platform_plane = Plane(move_10.Geometry)
mshadow_3 = MeshShadow(Mesh=mesh_for_sla_print_2, Light=Vector(0, 0, -1), Plane=build_platform_plane)
divide_curve_even_lenght = DivideCurveEvenLenght(crv=mshadow_3, B=support_spacing_distance_3)
pline_4 = PolyLine(Vertices=divide_curve_even_lenght, Closed=Toggle(True))

# ---- group: Align curve directions
curves_for_aligned_direction = Curve(pline_4)
graft_2 = GraftTree(Tree=curves_for_aligned_direction, IncludeEmptyLists=True, IncludeNullItems=True)
offset = Offset(Curve=graft_2, Distance="0.01", Plane=PlaneXY(0, 0, 0), Corners=2)
end = EndPoints(Curve=offset)  # -> Start, End
pshift_5 = ShiftPaths(Data=end.Start, Offset=-1)
incurve = PointInCurve(Point=pshift_5, Curve=graft_2)  # -> Relationship, Point
multiplication_21 = Multiplication(A=incurve.Relationship, B="0.5")
round_2 = Round(Number=multiplication_21)  # -> Nearest, Floor, Ceiling
crv_6 = Curve(graft_2)
int_4 = Integer(round_2.Nearest)
flip = FlipCurve(Curve=crv_6)  # -> Curve, Flag
weave = Weave(Pattern=int_4, Stream0=flip.Curve, Stream1=crv_6, NullGaps=False)
pshift_6 = ShiftPaths(Data=weave, Offset=-1)
aligned_curves = Curve(pshift_6)

# ----
render_slice_boolean = Boolean(render_slice)

# ---- group: Generate support points on lowes location on model
layer_height_3 = Panel(layer_height_2)
support_start_height_3 = Panel(support_start_height_2)
support_spacing_distance_4 = Panel(support_spacing_distance_3)
build_platform_plane_2 = Plane(build_platform_plane)
mesh_for_sla_print_3 = Mesh(filter_14)
multiplication_22 = Multiplication(A=layer_height_3, B="0.1")
offset_2 = Offset(Curve=aligned_curves, Distance=multiplication_22, Plane=PlaneXY(0, 0, 0), Corners=1)
boundary = BoundarySurfaces(Edges=offset_2)
mesh_6 = MeshBrep(
    Brep=boundary,
    Settings={GridMaxCount=0, GridMinCount=16, JaggedSeams=False, MaxEdgeLength=0, MinEdgeLength=0.0001, MinTolerance=0, Refine=True, RefineAngle=0, RelativeTolerance=0.65, SimplePlanes=True, Tolerance=0})
addition_4 = Addition(A=support_start_height_3, B="0.02")
Z_17 = UnitZ(Factor=addition_4)
move_11 = Move(Geometry=mesh_6, Motion=Z_17)  # -> Geometry, Transform
mmx = MeshMesh(MeshA=move_11.Geometry, MeshB=mesh_for_sla_print_3, UseMeshMeshFast=True)
divdist = DivideDistance(Curve=mmx, Distance=support_spacing_distance_4)  # -> Points, Tangents, Parameters
pt_10 = Point(divdist.Points)
multiplication_23 = Multiplication(A=support_spacing_distance_4, B="0.6")
pshift_7 = ShiftPaths(Data=pt_10, Offset=-1)
cullpt = CullDuplicates(Points=pshift_7, Tolerance=multiplication_23, CullMode=1)  # -> Points, Indices, Valence
simplify_7 = SimplifyTree(Tree=cullpt.Points, Front=False)
project_2 = Project(Geometry=simplify_7, Plane=build_platform_plane_2)  # -> Geometry, Transform
lowest_point_on_model_loactions = Point(project_2.Geometry)

# ---- group: Generate platfrom with release tap
boundary_curves = Curve(pline_4)
release_tab_length_2 = Panel(release_tab_length)
release_tab_angle_2 = Panel(release_tab_angle)
foundation_plate_thickness_2 = Panel(foundation_plate_thickness)
pshift_8 = ShiftPaths(Data=boundary_curves, Offset=-1)
runion_2 = RegionUnion(Curves=pshift_8)
lng_6 = ListLength(List=runion_2)
flatten_2 = FlattenTree(Tree=lng_6, Path="{0}")
sort_2 = SortList(Keys=flatten_2)  # -> Keys, ValuesA
smaller_4 = SmallerThan(FirstNumber=sort_2.Keys, SecondNumber="1")  # -> SmallerThan, OrEqualTo
filter_15 = StreamFilter(Gate=smaller_4.SmallerThan, Stream0=runion_2, Stream1=pshift_8)
crv_7 = Curve(filter_15)
explode_3 = Explode(Curve=crv_7, Recursive=True)  # -> Segments, Vertices
pshift_9 = ShiftPaths(Data=explode_3.Segments, Offset=-1)
boundary_2 = BoundarySurfaces(Edges=crv_7)
neg_10 = Negative(Value=release_tab_length_2)
Z_18 = UnitZ(Factor=foundation_plate_thickness_2)
item_21 = ListItem(List=explode_3.Segments, Index=0, Wrap=True)
offset_3 = Offset(Curve=item_21, Distance=neg_10, Plane=PlaneXY(0, 0, 0), Corners=1)
extr = Extrude(Base=boundary_2, Direction=Z_18)
pshift_10 = ShiftPaths(Data=offset_3, Offset=-1)
loft = Loft(
    Curves=[item_21, pshift_10],
    Options={Adjust=False, Closed=False, LoftEnds=0, LoftSimp=0, LoftType=0, Rebuild=10, Refit=0.01})
extr_2 = Extrude(Base=loft, Direction=Z_18)
rad_2 = Radians(Degrees=release_tab_angle_2)
rotax = RotateAxis(Geometry=extr_2, Angle=rad_2, Axis=item_21)  # -> Geometry, Transform
mesh_7 = MeshBrep(
    Brep=flatten([extr, rotax.Geometry]),
    Settings={GridMaxCount=0, GridMinCount=16, JaggedSeams=False, MaxEdgeLength=0, MinEdgeLength=0.0001, MinTolerance=0, Refine=True, RefineAngle=0, RelativeTolerance=0.65, SimplePlanes=True, Tolerance=0})
supprt_platform = Mesh(mesh_7)

# ----
filter_16 = StreamFilter(Gate=render_slice_boolean, Stream0=up_vector_table_projection, Stream1=up_vector_render_sla)
build_platform_plane_3 = Plane(build_platform_plane)
supprt_platform_2 = Mesh(supprt_platform)

drill = Drill(drill_curves=cnc_drill_curves_2, I=cut_depth, I_2=milling_bit_diameter_2)  # -> drill_toolpaths_3, drill_preview_geometry_3
pocket = Pocket(
    curves_for_raster_pocket=filter_3,
    cut_depth_pocket=filter_7,
    pass_depth=pass_depth_2,
    tool_diameter=milling_bit_diameter_2,
    stepover_0_1=pocket_stepover_2,
    raster_along_y_0_1=raster_direction_along_y_2)
cutout = Cutout(
    curves_for_cutout=filter_4,
    cut_depth=filter_8,
    pass_depth=pass_depth_2,
    tool_diameter=milling_bit_diameter_2,
    cutout_tolerance=cutout_tolerance_4,
    use_climb_direction=use_climb_direction_2,
    use_inside_cutting=use_inside_cutting_2)
engrave = Engrave(engrave_curves=cnc_line_engrave_curves_2, cut_depth=cut_depth_line_engrave_2, pass_depth=pass_depth_2)

drill_preview_geometry = Curve(drill.drill_preview_geometry_3)
engrave_toolpaths = Curve(flatten(engrave))
cutout_toolpaths = Curve(flatten(cutout))
pocket_toolpaths = Curve(flatten(pocket))

support_spacing_distance_5 = Panel(support_spacing_distance_3)
oultines_for_support_grid = Curve(aligned_curves)
multiplication_24 = Multiplication(A=support_diameter_3, B="0.6")
flatten_3 = FlattenTree(Tree=oultines_for_support_grid, Path="{0}")
offset_4 = Offset(Curve=flatten_3, Distance=multiplication_24, Plane=PlaneXY(0, 0, 0), Corners=1)
pshift_11 = ShiftPaths(Data=offset_4, Offset=-1)
boundary_3 = BoundarySurfaces(Edges=pshift_11)
edges = BrepEdges(Brep=boundary_3)  # -> Naked, Interior, NonManifold
join_2 = JoinCurves(Curves=edges.Naked, Preserve=False)
dim_4 = Dimensions(Surface=boundary_3)  # -> UDimension, VDimension
divide_curve_even_lenght_2 = DivideCurveEvenLenght(crv=join_2, B=support_spacing_distance_3)
division_5 = Division(A=dim_4.UDimension, B=support_spacing_distance_5)
division_6 = Division(A=dim_4.VDimension, B=support_spacing_distance_5)
sdivide = DivideSurface(Surface=boundary_3, UCount=division_5, VCount=division_6)  # -> Points, Normals, Parameters
pline_5 = PolyLine(Vertices=divide_curve_even_lenght_2, Closed=Toggle(True))
pshift_12 = ShiftPaths(Data=sdivide.Points, Offset=-1)
clean = CleanTree(RemoveNulls=True, RemoveInvalid=True, RemoveEmpty=False, Tree=pshift_12)

pshift_13 = ShiftPaths(Data=pline_5, Offset=-1)
pt_11 = Point(clean)
multiplication_25 = Multiplication(A=support_spacing_distance_5, B="0.6")

cp_2 = ControlPoints(Curve=pshift_13)  # -> Points, Weights, Knots
cp_3 = ClosestPoint(Point=pt_11, Cloud=cp_2.Points)  # -> ClosestPoint, CPIndex, Distance
smaller_5 = SmallerThan(FirstNumber=cp_3.Distance, SecondNumber=multiplication_25)  # -> SmallerThan, OrEqualTo
dispatch_3 = Dispatch(List=pt_11, DispatchPattern=smaller_5.SmallerThan)  # -> ListA, ListB
merge_2 = Merge(Data1=dispatch_3.ListB, Data2=cp_2.Points)

lowest_point_on_model_loactions_2 = Point(lowest_point_on_model_loactions)
pt_12 = Point(merge_2)
multiplication_26 = Multiplication(A=support_spacing_distance_5, B="0.5")
cp_4 = ClosestPoint(Point=pt_12, Cloud=lowest_point_on_model_loactions_2)  # -> ClosestPoint, CPIndex, Distance
smaller_6 = SmallerThan(FirstNumber=cp_4.Distance, SecondNumber=multiplication_26)  # -> SmallerThan, OrEqualTo
dispatch_4 = Dispatch(List=pt_12, DispatchPattern=smaller_6.SmallerThan)  # -> ListA, ListB
grid_of_points = Point(dispatch_4.ListB)

lowest_point_on_model_loactions_3 = Point(lowest_point_on_model_loactions)
overhang_degree_threshold_3 = Panel(overhang_degree_threshold_2)
mesh_for_sla_print_4 = Mesh(mesh_for_sla_print_2)
mesh_for_sla_print_5 = Mesh(mesh_for_sla_print_2)
grid_of_points_2 = Point(grid_of_points)
Z_19 = UnitZ(Factor=1)
meshray_2 = MeshRay(Mesh=mesh_for_sla_print_4, Point=grid_of_points_2, Direction=Z_19)  # -> Point, Hit
meshray_3 = MeshRay(Mesh=mesh_for_sla_print_5, Point=lowest_point_on_model_loactions_3, Direction=Z_19)  # -> Point, Hit
meshcp = MeshClosestPoint(Point=meshray_2.Point, Mesh=mesh_for_sla_print_4)  # -> Point, Index, Parameter
meval = MeshEval(Mesh=mesh_for_sla_print_4, Parameter=meshcp.Parameter)  # -> Point, Normal, Colour
Z_20 = UnitZ(Factor=1)
rev_2 = Reverse(Vector=Z_20)
angle = Angle(VectorA=meval.Normal, VectorB=rev_2)  # -> Angle, Reflex
deg = Degrees(Radians=angle.Angle)
larger_5 = LargerThan(FirstNumber=deg, SecondNumber=overhang_degree_threshold_3)  # -> LargerThan, OrEqualTo
meshcp_2 = MeshClosestPoint(Point=meshray_3.Point, Mesh=mesh_for_sla_print_4)  # -> Point, Index, Parameter
meval_2 = MeshEval(Mesh=mesh_for_sla_print_4, Parameter=meshcp_2.Parameter)  # -> Point, Normal, Colour
dispatch_5 = Dispatch(List=meval.Normal, DispatchPattern=larger_5.LargerThan)  # -> ListA, ListB
dispatch_6 = Dispatch(List=meshray_2.Point, DispatchPattern=larger_5.LargerThan)  # -> ListA, ListB
clean_2 = CleanTree(RemoveNulls=True, RemoveInvalid=True, RemoveEmpty=False, Tree=dispatch_6.ListB)
clean_3 = CleanTree(RemoveNulls=True, RemoveInvalid=True, RemoveEmpty=False, Tree=dispatch_5.ListB)
clean_4 = CleanTree(RemoveNulls=True, RemoveInvalid=True, RemoveEmpty=False, Tree=meshray_3.Point)
clean_5 = CleanTree(RemoveNulls=True, RemoveInvalid=True, RemoveEmpty=False, Tree=meval_2.Normal)
merge_3 = Merge(Data1=clean_2, Data2=clean_4)
merge_4 = Merge(Data1=clean_3, Data2=clean_5)
support_location_normals = Vector(merge_4)
support_locations = Point(merge_3)

support_location_normals_2 = Vector(support_location_normals)
support_locations_2 = Point(support_locations)

# ---- group: Create suport stems
amp = Amplitude(Vector=support_location_normals_2, Amplitude=multiplication_14)
move_12 = Move(Geometry=support_locations_2, Motion=amp)  # -> Geometry, Transform
project_3 = Project(Geometry=move_12.Geometry, Plane=build_platform_plane_3)  # -> Geometry, Transform
ln_5 = Line(StartPoint=project_3.Geometry, EndPoint=move_12.Geometry)
multiplication_27 = Multiplication(A=support_diameter_4, B="1.5")
multiplication_28 = Multiplication(A=support_diameter_4, B="0.5")
multiplication_29 = Multiplication(A=support_diameter_4, B="0.5")
panel_17 = Panel("""0
0.3
1""")
vpipe_2 = PipeVariable(Curve=ln_5, Parameters=panel_17, Radii=[multiplication_27, multiplication_28, multiplication_29], Caps="0")
custom_mesh_settings_3 = SettingsCustom(
    StitchSeams=True,
    SimplePlanes=False,
    Refine=True,
    MinCount=16,
    MaxCount=400,
    AspectRatio=20,
    MaxDistance=0,
    MaxAngle=20,
    MinEdge="0.1",
    MaxEdge=0)
pshift_14 = ShiftPaths(Data=vpipe_2, Offset=-1)
mesh_8 = MeshBrep(Brep=pshift_14, Settings=custom_mesh_settings_3)
support_stem_mesh = Mesh(mesh_8)

# ---- group: Position support tips
pl = PlaneNormal(Origin=support_locations_2, ZAxis=support_location_normals_2)
xy_10 = XYPlane(Origin=Point(0, 0, 0))
orient = Orient(Geometry=support_tip_mesh, Source=xy_10, Target=pl)  # -> Geometry, Transform

# ---- group: Check for stem collisions with print object
mesh_for_sla_print_6 = Mesh(mesh_for_sla_print_2)
merge_5 = Merge(Data1=orient.Geometry, Data2=support_stem_mesh)
colom = CollisionOneMany(Collider=support_stem_mesh, Obstacles=mesh_for_sla_print_6)  # -> Collision, Index
dispatch_7 = Dispatch(List=merge_5, DispatchPattern=colom.Collision)  # -> ListA, ListB

# ---- group: Create support connectors
support_spacing_distance_6 = Panel(support_spacing_distance_3)
ln_6 = Line(StartPoint=project_3.Geometry, EndPoint=move_12.Geometry)
dispatch_8 = Dispatch(List=ln_6, DispatchPattern=colom.Collision)  # -> ListA, ListB
divlength_3 = DivideLength(Curve=flatten(dispatch_8.ListB), Length=support_spacing_distance_6)  # -> Points, Tangents, Parameters
cull_i_2 = CullIndex(List=divlength_3.Points, Indices="0", Wrap=True)
pshift_15 = ShiftPaths(Data=cull_i_2, Offset=-1)
flip_2 = FlipMatrix(Data=pshift_15)
con = DelaunayEdges(Points=flip_2, Plane=PlaneXY(0, 0, 0))  # -> Connectivity, Edges
clean_6 = CleanTree(RemoveNulls=True, RemoveInvalid=True, RemoveEmpty=False, Tree=flatten(con.Edges))
line = Line(clean_6)
len_2 = Length(Curve=line)
multiplication_30 = Multiplication(A=support_spacing_distance_6, B="2")
mesh_for_sla_print_7 = Mesh(mesh_for_sla_print_2)
larger_6 = LargerThan(FirstNumber=len_2, SecondNumber=multiplication_30)  # -> LargerThan, OrEqualTo
dispatch_9 = Dispatch(List=line, DispatchPattern=larger_6.LargerThan)  # -> ListA, ListB
colom_2 = CollisionOneMany(Collider=dispatch_9.ListB, Obstacles=mesh_for_sla_print_7)  # -> Collision, Index
dispatch_10 = Dispatch(List=dispatch_9.ListB, DispatchPattern=colom_2.Index)  # -> ListA, ListB
multiplication_31 = Multiplication(A=support_diameter_4, B="0.4")
line_2 = Line(dispatch_10.ListA)
pipe = Pipe(Curve=line_2, Radius=multiplication_31, Caps="1")
custom_mesh_settings_4 = SettingsCustom(
    StitchSeams=True,
    SimplePlanes=False,
    Refine=True,
    MinCount=16,
    MaxCount=400,
    AspectRatio=20,
    MaxDistance=0,
    MaxAngle=20,
    MinEdge="1",
    MaxEdge=0)
mesh_9 = MeshBrep(Brep=pipe, Settings=custom_mesh_settings_4)

# ----
support_stems = Mesh(dispatch_7.ListB)
support_beams = Mesh(mesh_9)
support_mesh = Mesh(flatten([support_stems, support_beams, supprt_platform_2]))
support_meshes_for_sla_print = Mesh(flatten(support_mesh))
mesh_10 = Mesh(support_meshes_for_sla_print)
gate_3 = StreamGate(Stream=mesh_10, Gate=render_slice)  # -> Target0, Target1
preview_4 = CustomPreview(Geometry=mesh_10, Shader=material_3)

enable_view_control = BooleanToggle(True)
int_5 = Integer(Slider(35, range=0..100))

# ---- group: Toolpath preview
milling_bit_diameter_7 = Panel(milling_bit_diameter_2)
swatch_4 = ColourSwatch(SwatchColor=RGB(66, 249, 255))
drill_preview_geometry_2 = Curve(drill.drill_preview_geometry_3)
jog_transitions = ColourSwatch(SwatchColor=RGB(71, 61, 38))
hold_down = ColourSwatch(SwatchColor=RGB(255, 191, 0))
cut_entries = ColourSwatch(SwatchColor=RGB(145, 193, 194))
cut_exits = ColourSwatch(SwatchColor=RGB(61, 88, 89))
preview_5 = CustomPreview(Geometry=drill_preview_geometry_2, Shader=hold_down)

# ----
filter_17 = StreamFilter(Gate=use_inside_cutting_3, Stream0=swatch_4, Stream1=ColourSwatch(SwatchColor=RGB(255, 61, 155)))

skip_top_slices_boolean_3 = Integer(skip_top_slices_boolean)
stepover_distance_5 = Panel(stepover_distance)
simplify_8 = SimplifyTree(Tree=skip_top_slices_boolean_3, Front=False)
pdecon_5 = Deconstruct(Point=pt_6)  # -> XComponent, YComponent, ZComponent

multiplication_32 = Multiplication(A=stepover_distance_5, B="0.33")

multiplication_33 = Multiplication(A=simplify_8, B=multiplication_32)
subtraction_8 = Subtraction(A=pdecon_5.ZComponent, B=multiplication_33)
pt_13 = ConstructPoint(XCoordinate=pdecon_5.XComponent, YCoordinate=pdecon_5.YComponent, ZCoordinate=subtraction_8)

upper_boundary_point = Point(pt_13)
ln_7 = Line(StartPoint=upper_boundary_point, EndPoint=lower_boundary_point)
master_graph_line = Line(ln_7)
divide_curve_even_lenght_3 = DivideCurveEvenLenght(crv=master_graph_line, B=inital_sample_slice_spacing_2)
master_graph_points = Point(divide_curve_even_lenght_3)
xy_11 = XYPlane(Origin=master_graph_points)
pshift_16 = ShiftPaths(Data=xy_11, Offset=-1)
sec_2 = MeshPlane(Mesh=graft, Plane=pshift_16)
divlength_4 = DivideLength(Curve=sec_2, Length=inital_sample_slice_spacing_3)  # -> Points, Tangents, Parameters
move_13 = Move(Geometry=divlength_4.Points, Motion=Z_8)  # -> Geometry, Transform
pshift_17 = ShiftPaths(Data=move_13.Geometry, Offset=-1)
simplify_9 = SimplifyTree(Tree=pshift_17, Front=False)
meshray_4 = MeshRay(Mesh=mjoin_3, Point=simplify_9, Direction=Z_9)  # -> Point, Hit
dispatch_11 = Dispatch(List=simplify_9, DispatchPattern=meshray_4.Hit)  # -> ListA, ListB
pt_14 = Point(dispatch_11.ListB)

# ---- group: test
clean_7 = CleanTree(RemoveNulls=True, RemoveInvalid=True, RemoveEmpty=True, Tree=pt_14)

# ----
meshcp_3 = MeshClosestPoint(Point=clean_7, Mesh=mjoin_3)  # -> Point, Index, Parameter
meval_3 = MeshEval(Mesh=mjoin_3, Parameter=meshcp_3.Parameter)  # -> Point, Normal, Colour
vdis = VectorDisplay(Anchor=clean_7, Vector=meval_3.Normal)
angle_2 = Angle(VectorA=meval_3.Normal, VectorB=Z_10)  # -> Angle, Reflex
deg_2 = Degrees(Radians=angle_2.Angle)
lng_7 = ListLength(List=deg_2)
sort_3 = SortList(Keys=deg_2)  # -> Keys, ValuesA
panel_18 = Panel(sort_3.Keys)
multiplication_34 = Multiplication(A=lng_7, B=sample_top_value_percentage)
round_3 = Round(Number=multiplication_34)  # -> Nearest, Floor, Ceiling
split = SplitList(List=sort_3.Keys, Index=round_3.Ceiling)  # -> ListA, ListB
panel_19 = Panel(split.ListA)
avr = Average(Input=split.ListA)
panel_20 = Panel(avr)
pshift_18 = ShiftPaths(Data=avr, Offset=-1)
pshift_19 = ShiftPaths(Data=pshift_18, Offset=-1)
pshift_20 = ShiftPaths(Data=avr, Offset=1)
filter_18 = StreamFilter(Gate=larger_4.LargerThan, Stream0=pshift_20, Stream1=pshift_19)
smaller_7 = SmallerThan(FirstNumber=filter_18, SecondNumber=max_angle_limit_2)  # -> SmallerThan, OrEqualTo
dispatch_12 = Dispatch(List=filter_18, DispatchPattern=smaller_7.SmallerThan)  # -> ListA, ListB
lng_8 = ListLength(List=dispatch_12.ListA)
dup = DuplicateData(Data=max_angle_limit_2, Number=lng_8, Order=True)
master_graph_points_2 = Point(master_graph_points)
master_graph_line_2 = Line(master_graph_line)
pshift_21 = ShiftPaths(Data=dup, Offset=-1)
weave_2 = Weave(Pattern=smaller_7.SmallerThan, Stream0=dispatch_12.ListB, Stream1=pshift_21, NullGaps=False)
average_surface_angle = Panel(weave_2)
lng_9 = ListLength(List=master_graph_points_2)
len_3 = Length(Curve=master_graph_line_2)
subtraction_9 = Subtraction(A=lng_9, B="1")
division_7 = Division(A=len_3, B=subtraction_9)
division_8 = Division(A=division_7, B="2")
neg_11 = Negative(Value=division_8)
Z_21 = UnitZ(Factor=neg_11)
Z_22 = UnitZ(Factor=division_8)
move_14 = Move(Geometry=master_graph_points_2, Motion=Z_22)  # -> Geometry, Transform
move_15 = Move(Geometry=master_graph_points_2, Motion=Z_21)  # -> Geometry, Transform
xy_12 = XYPlane(Origin=master_graph_points_2)
subtraction_10 = Subtraction(A="90", B=average_surface_angle)
xz = XZPlane(Origin=master_graph_points_2)
neg_12 = Negative(Value=division_8)
ln_8 = Line(StartPoint=move_14.Geometry, EndPoint=move_15.Geometry)
neg_13 = Negative(Value=subtraction_10)
Z_23 = UnitZ(Factor=neg_12)
Z_24 = UnitZ(Factor=division_8)
move_16 = Move(Geometry=xy_12, Motion=Z_24)  # -> Geometry, Transform
move_17 = Move(Geometry=xy_12, Motion=Z_23)  # -> Geometry, Transform
rotate_3 = Rotate(Geometry=ln_8, Angle=degrees(neg_13), Plane=xz)  # -> Geometry, Transform
plx = LinePlane(Line=rotate_3.Geometry, Plane=move_16.Geometry)  # -> Point, ParamL, ParamP
plx_2 = LinePlane(Line=rotate_3.Geometry, Plane=move_17.Geometry)  # -> Point, ParamL, ParamP
ln_9 = Line(StartPoint=plx.Point, EndPoint=plx_2.Point)
project_4 = Project(Geometry=ln_9, Plane=xy_4)  # -> Geometry, Transform
bbox_7 = BoundingBox(Content=ln_9, Plane=PlaneXY(0, 0, 0))  # -> Box, Box_2; disabled
len_4 = Length(Curve=project_4.Geometry)
dim_5 = Dimensions(Surface=bbox_7.Box)  # -> UDimension, VDimension; disabled
line_width = Number(len_4)
ma = MassAddition(Input=line_width)  # -> Result, PartialResults
division_9 = Division(A=line_width, B="2")
neg_14 = Negative(Value=ma.PartialResults)
X = UnitX(Factor=division_9)
X_2 = UnitX(Factor=neg_14)
move_18 = Move(Geometry=ln_9, Motion=X)  # -> Geometry, Transform
move_19 = Move(Geometry=move_18.Geometry, Motion=X_2)  # -> Geometry, Transform

milling_bit_radius_6 = Panel(multiplication_10)
curvepoint = PointOnCurve(move_19.Geometry, parameter=0.5)
intcrv = Interpolate(Vertices=curvepoint, Degree=3, Periodic=False, KnotStyle=1)  # -> Curve, Length, Domain
neg_15 = Negative(Value=milling_bit_radius_6)
xz_2 = XZPlane(Origin=Point(0, 0, 0))
offset_5 = Offset(Curve=intcrv.Curve, Distance=milling_bit_radius_6, Plane=xz_2, Corners=1)

crv_8 = Curve(intcrv.Curve)
end_2 = EndPoints(Curve=master_graph_line_2)  # -> Start, End
end_3 = EndPoints(Curve=crv_8)  # -> Start, End
vec2pt = Vector2Pt(PointA=end_3.End, PointB=end_2.End, Unitize=False)  # -> Vector, Length

# ---- group: fix skew vector
move_20 = Move(Geometry=crv_8, Motion=vec2pt.Vector)  # -> Geometry, Transform

# ----
simplify_10 = SimplifyTree(Tree=crv_8, Front=False)
divide_curve_even_lenght_4 = DivideCurveEvenLenght(crv=simplify_10, B=stepover)
pshift_22 = ShiftPaths(Data=divide_curve_even_lenght_4, Offset=-1)
pt_15 = Point(end_2.End)
pdecon_6 = Deconstruct(Point=pshift_22)  # -> XComponent, YComponent, ZComponent
pdecon_7 = Deconstruct(Point=pt_15)  # -> XComponent, YComponent, ZComponent
pt_16 = ConstructPoint(XCoordinate=pdecon_7.XComponent, YCoordinate=pdecon_6.YComponent, ZCoordinate=pdecon_6.ZComponent)

stepover_distance_6 = Panel(stepover_distance)
milling_bit_radius_7 = Panel(multiplication_10)
top_slice_location_point_2 = Point(item_12)
pt_17 = Point(pt_16)
subtraction_11 = Subtraction(A=milling_bit_radius_7, B=stepover_distance_6)
pdecon_8 = Deconstruct(Point=top_slice_location_point_2)  # -> XComponent, YComponent, ZComponent
pdecon_9 = Deconstruct(Point=pt_17)  # -> XComponent, YComponent, ZComponent
addition_5 = Addition(A=pdecon_8.ZComponent, B=subtraction_11)
item_22 = ListItem(List=pdecon_9.ZComponent, Index=0, Wrap=True)
p_n_c_2 = PickNChoose(Pattern=skip_top_slices_boolean_2, Stream0=item_22, Stream1=addition_5)
pshift_23 = ShiftPaths(Data=p_n_c_2, Offset=-1)
larger_7 = LargerThan(FirstNumber=pdecon_9.ZComponent, SecondNumber=pshift_23)  # -> LargerThan, OrEqualTo
dispatch_13 = Dispatch(List=pt_17, DispatchPattern=larger_7.LargerThan)  # -> ListA, ListB
pt_18 = Point(dispatch_13.ListB)

xy_13 = XYPlane(Origin=pt_18)
sec_3 = MeshPlane(Mesh=meshes_for_3d_milling_3, Plane=xy_13)
join_3 = JoinCurves(Curves=sec_3, Preserve=False)
clean_8 = CleanTree(RemoveNulls=True, RemoveInvalid=True, RemoveEmpty=True, Tree=join_3)
simplify_11 = SimplifyTree(Tree=clean_8, Front=False)
redpline = Reduce(Polyline=simplify_11, Tolerance=reduction_tolerance_2)  # -> Polyline, Reduction
cp_5 = ControlPoints(Curve=redpline.Polyline)  # -> Points, Weights, Knots
crv_9 = Curve(redpline.Polyline)
xy_14 = XYPlane(Origin=cp_5.Points)
cir_2 = Circle(Plane=xy_14, Radius=initial_sample_lenght)
ccx = CurveCurve(CurveA=cir_2, CurveB=graft(crv_9))  # -> Points, ParamsA, ParamsB
ccx_2 = CurveCurve(CurveA=crv_9, CurveB=cir_2)  # -> Points, ParamsA, ParamsB; disabled
pshift_24 = ShiftPaths(Data=ccx.Points, Offset=-1)
crv_10 = Curve(crv_9)
alongcrv = SortAlongCurve(Points=pshift_24, Curve=graft(crv_10))  # -> Points, Indices
pshift_25 = ShiftPaths(Data=alongcrv.Points, Offset=-1)
sample_points_for_offset = Point(pshift_25)
sample_points_for_offset_2 = Point(sample_points_for_offset)

meshcp_4 = MeshClosestPoint(Point=sample_points_for_offset_2, Mesh=meshes_for_3d_milling_5)  # -> Point, Index, Parameter
meval_4 = MeshEval(Mesh=meshes_for_3d_milling_5, Parameter=meshcp_4.Parameter)  # -> Point, Normal, Colour
amp_2 = Amplitude(Vector=meval_4.Normal, Amplitude=milling_bit_radius_3)
move_21 = Move(Geometry=meshcp_4.Point, Motion=amp_2)  # -> Geometry, Transform

pt_19 = Point(move_21.Geometry)

meshcp_5 = MeshClosestPoint(Point=pt_19, Mesh=meshes_for_3d_milling_5)  # -> Point, Index, Parameter
vec2pt_2 = Vector2Pt(PointA=meshcp_5.Point, PointB=pt_19, Unitize=False)  # -> Vector, Length
amp_3 = Amplitude(Vector=vec2pt_2.Vector, Amplitude=milling_bit_radius_3)
move_22 = Move(Geometry=meshcp_5.Point, Motion=amp_3)  # -> Geometry, Transform

crv_11 = Curve(crv_9)
cullpt_2 = CullDuplicates(Points=move_22.Geometry, Tolerance=reduction_tolerance_3, CullMode=3)  # -> Points, Indices, Valence
alongcrv_2 = SortAlongCurve(Points=cullpt_2.Points, Curve=graft(crv_11))  # -> Points, Indices
pline_6 = PolyLine(Vertices=cullpt_2.Points, Closed=True)
pline_7 = PolyLine(Vertices=alongcrv_2.Points, Closed=True)
redpline_2 = Reduce(Polyline=pline_7, Tolerance=reduction_tolerance_3)  # -> Polyline, Reduction
simplify_12 = SimplifyTree(Tree=redpline_2.Polyline, Front=False)
crv_12 = Curve(simplify_12)
cp_6 = ControlPoints(Curve=crv_12)  # -> Points, Weights, Knots
simplify_13 = SimplifyTree(Tree=cp_6.Points, Front=False)
cullpt_3 = CullDuplicates(Points=simplify_13, Tolerance=reduction_tolerance_3, CullMode=3)  # -> Points, Indices, Valence
pt_20 = Point(cullpt_3.Points)
crv_cp_3 = CurveClosestPoint(Point=pt_20, Curve=crv_12)  # -> Point, Parameter, Distance
eval_3 = EvaluateCurve(Curve=crv_12, Parameter=crv_cp_3.Parameter)  # -> Point, Tangent, Angle
pt_21 = Point(cullpt_3.Points)
larger_8 = LargerThan(FirstNumber=eval_3.Angle, SecondNumber=rad)  # -> LargerThan, OrEqualTo
p_n_c_3 = PickNChoose(Pattern=larger_8.LargerThan, Stream1=pt_20)
pt_22 = Point(p_n_c_3)
cps = ClosestPoints(Point=pt_22, Cloud=pt_22, Count="2")  # -> ClosestPoint, CPIndex, Distance
item_23 = ListItem(List=cps.Distance, Index="1", Wrap=True)
pshift_26 = ShiftPaths(Data=item_23, Offset=-1)
multiplication_35 = Multiplication(A=pshift_26, B="0.49")
division_10 = Division(A=multiplication_35, B=division_4)
round_4 = Round(Number=division_10)  # -> Nearest, Floor, Ceiling
pt_23 = Point(p_n_c_3)
pt_24 = Point(cullpt_3.Points)
division_11 = Division(A=multiplication_35, B=round_4.Ceiling)
xy_15 = XYPlane(Origin=pt_23)
series_2 = Series(Start=division_11, Step=division_11, Count=round_4.Ceiling)
graft_3 = GraftTree(Tree=xy_15, IncludeEmptyLists=True, IncludeNullItems=True)
sph = Sphere(Base=graft_3, Radius=series_2)
pshift_27 = ShiftPaths(Data=sph, Offset=-1)
bcx = BrepCurve(Brep=pshift_27, Curve=crv_12)  # -> Curves, Points
pshift_28 = ShiftPaths(Data=bcx.Points, Offset=-1)
merge_6 = Merge(Data1=cullpt_3.Points, Data2=pshift_28)
alongcrv_3 = SortAlongCurve(Points=merge_6, Curve=graft(crv_12))  # -> Points, Indices
pline_8 = PolyLine(Vertices=alongcrv_3.Points, Closed=True)
smoothpline = SmoothPolyline(Polyline=pline_8, Strength="1", Times="2")
redpline_3 = Reduce(Polyline=smoothpline, Tolerance=reduction_tolerance_4)  # -> Polyline, Reduction; disabled
cp_7 = ControlPoints(Curve=smoothpline)  # -> Points, Weights, Knots
pshift_29 = ShiftPaths(Data=cp_7.Points, Offset=-1)

meshcp_6 = MeshClosestPoint(Point=pshift_29, Mesh=meshes_for_3d_milling_5)  # -> Point, Index, Parameter
vec2pt_3 = Vector2Pt(PointA=meshcp_6.Point, PointB=pshift_29, Unitize=False)  # -> Vector, Length
amp_4 = Amplitude(Vector=vec2pt_3.Vector, Amplitude=milling_bit_radius_3)
move_23 = Move(Geometry=meshcp_6.Point, Motion=amp_4)  # -> Geometry, Transform

pline_9 = PolyLine(Vertices=move_23.Geometry, Closed=True)
crv_13 = Curve(pline_9)
explode_4 = Explode(Curve=crv_13, Recursive=True)  # -> Segments, Vertices

# ---- group: Remove undercut points
cp_8 = ControlPoints(Curve=explode_4.Segments)  # -> Points, Weights, Knots
# Fix undercut based on points on surface
simplify_14 = SimplifyTree(Tree=cp_8.Points, Front=False)
Z_25 = UnitZ(Factor="0.1")
move_24 = Move(Geometry=simplify_14, Motion=Z_25)  # -> Geometry, Transform
mjoin_4 = MeshJoin(Meshes=meshes_for_3d_milling_2)
simplify_15 = SimplifyTree(Tree=move_24.Geometry, Front=False)
Z_26 = UnitZ(Factor=1)
meshray_5 = MeshRay(Mesh=mjoin_4, Point=simplify_15, Direction=Z_26)  # -> Point, Hit
dispatch_14 = Dispatch(List=simplify_15, DispatchPattern=meshray_5.Hit)  # -> ListA, ListB
neg_16 = Negative(Value="0.1")
Z_27 = UnitZ(Factor=neg_16)
move_25 = Move(Geometry=dispatch_14.ListB, Motion=Z_27)  # -> Geometry, Transform

# ----
rev_3 = ReverseList(List=pt_18)
milling_bit_radius_8 = Panel(milling_bit_radius)
item_24 = ListItem(List=rev_3, Index=0, Wrap=True)
devec = DeconstructVector(Vector=item_24)  # -> XComponent, YComponent, ZComponent
subtraction_12 = Subtraction(A=devec.ZComponent, B=milling_bit_radius_8)
abs = Absolute(Value=subtraction_12)

# ---- group: Create slice plane positions
bbox_8 = BoundingBox(Content=[mesh_for_sla_print, support_meshes_for_sla_print], Plane=PlaneXY(0, 0, 0), UnionBox=True)  # -> Box, Box_2
layer_height_4 = Panel(layer_height_2)
debrep_7 = DeconstructBrep(Brep=bbox_8.Box)  # -> Faces, Edges, Vertices
item_25 = ListItem(List=debrep_7.Edges, Index="9", Wrap=True)
item_26 = ListItem(List=debrep_7.Faces, Index="4", Wrap=True)
area_8 = Area(Geometry=item_26)  # -> Area, Centroid

# ----
end_4 = EndPoints(Curve=item_25)  # -> Start, End

# ---- group: Create slice plane positions (continued)
vec2pt_4 = Vector2Pt(PointA=end_4.Start, PointB=area_8.Centroid, Unitize=False)  # -> Vector, Length
move_26 = Move(Geometry=item_25, Motion=vec2pt_4.Vector)  # -> Geometry, Transform
divlength_5 = DivideLength(Curve=move_26.Geometry, Length=layer_height_4)  # -> Points, Tangents, Parameters
lng_10 = ListLength(List=divlength_5.Points)
subtraction_13 = Subtraction(A=lng_10, B="1")

# ---- group: SLA export slider (continued)
number_of_slices = Panel(subtraction_13)

# ----
division_12 = Division(A="1", B=number_of_slices)
subtraction_14 = Subtraction(A="1", B=division_12)
multiplication_36 = Multiplication(A=current_slice, B=subtraction_14)
panel_21 = Panel(multiplication_36)

# ---- group: Create slice plane positions (continued)
current_slice_2 = Panel(panel_21)
multiplication_37 = Multiplication(A=lng_10, B=current_slice_2)
item_27 = ListItem(List=divlength_5.Points, Index=multiplication_37, Wrap=True)
xy_16 = XYPlane(Origin=item_27)

# ----
sec_4 = MeshPlane(Mesh=mesh_for_sla_print, Plane=xy_16)
sec_5 = MeshPlane(Mesh=support_meshes_for_sla_print, Plane=xy_16)
redpline_4 = Reduce(Polyline=sec_4, Tolerance=number_slider_6)  # -> Polyline, Reduction
redpline_5 = Reduce(Polyline=sec_5, Tolerance=number_slider_6)  # -> Polyline, Reduction
gate_4 = StreamGate(Stream=redpline_4.Polyline, Gate=render_slice)  # -> Target0, Target1
gate_5 = StreamGate(Stream=redpline_5.Polyline, Gate=render_slice)  # -> Target0, Target1

# ---- group: Create surfaces and remove overlpping edges
boundary_4 = BoundarySurfaces(Edges=gate_4.Target1)
sunion = SolidUnion(Breps=boundary_4)
lng_11 = ListLength(List=sunion)
flatten_4 = FlattenTree(Tree=lng_11, Path="{0}")
sort_4 = SortList(Keys=flatten_4)  # -> Keys, ValuesA
fmerge = MergeFaces(Brep=sunion)  # -> Breps, Before, After
item_28 = ListItem(List=sort_4.Keys, Index=0, Wrap=True)
smaller_8 = SmallerThan(FirstNumber=item_28, SecondNumber="1")  # -> SmallerThan, OrEqualTo
filter_19 = StreamFilter(Gate=smaller_8.SmallerThan, Stream0=fmerge.Breps, Stream1=boundary_4)
srf = Surface(filter_19)

# ---- group: Create slices for support
boundary_5 = BoundarySurfaces(Edges=gate_5.Target1)
jagged_2 = SettingsSpeed()
mesh_11 = MeshBrep(Brep=boundary_5, Settings=jagged_2)
support_slices = Mesh(mesh_11)

# ----
preview_6 = CustomPreview(Geometry=[redpline_4.Polyline, redpline_5.Polyline], Shader=ColourSwatch(SwatchColor=RGB(0, 242, 255)))

# ---- group: Create mesh grid and analyze grdis position distance from nearest edge
custom_mesh_settings_5 = SettingsCustom(
    StitchSeams=True,
    SimplePlanes=False,
    Refine=True,
    MinCount=16,
    MaxCount=400,
    AspectRatio=20,
    MaxDistance=0,
    MaxAngle=20,
    MinEdge=0,
    MaxEdge=gradient_sample_resolution)
mesh_12 = MeshBrep(Brep=srf, Settings=custom_mesh_settings_5)
demesh = DeconstructMesh(Mesh=mesh_12)  # -> Vertices, Faces, Colours, Normals
meshcp_7 = MeshClosestPoint(Point=demesh.Vertices, Mesh=mesh_for_sla_print)  # -> Point, Index, Parameter
dist_2 = Distance(PointA=demesh.Vertices, PointB=meshcp_7.Point)

# ---- group: Colur mesh with grdient colours
division_13 = Division(A=dist_2, B=edge_fade_count)
subtraction_15 = Subtraction(A=Slider(1, range=0..1), B=division_13)
swatch_5 = ColourSwatch(SwatchColor=RGB(255, 255, 255))
white_overexpose_factor = ColourSwatch(SwatchColor=RGB(87, 87, 87))
multiplication_38 = Multiplication(A=swatch_5, B=subtraction_15)
addition_6 = Addition(A=multiplication_38, B=white_overexpose_factor)
conmesh = ConstructMesh(Vertices=demesh.Vertices, Faces=demesh.Faces, Colours=addition_6)

# ----
support_slices_2 = Mesh(support_slices)
mcol = MeshColours(Mesh=support_slices_2, Colours=swatch_5)
mesh_slice_with_gradient = Mesh(flatten([conmesh, mcol]))
move_27 = Move(Geometry=mesh_slice_with_gradient, Motion=Y_6)  # -> Geometry, Transform
mesh_slice_with_gradient_moved_for_rende = Mesh(move_27.Geometry)  # "Mesh slice with gradient - moved for render"

plane_from_object_slice = Plane(xy_16)
camera_distance = Panel(camera_distance_79_for_50_micron)
deplane = DeconstructPlane(Plane=plane_from_object_slice)  # -> Origin, XAxis, YAxis, ZAxis
amp_5 = Amplitude(Vector=deplane.ZAxis, Amplitude=camera_distance)

pdecon_10 = Deconstruct(Point=deplane.Origin)  # -> XComponent, YComponent, ZComponent
pt_25 = ConstructPoint(XCoordinate=pdecon_4.XComponent, YCoordinate=pdecon_4.YComponent, ZCoordinate=pdecon_10.ZComponent)
pt_26 = Point(pt_25)
move_28 = Move(Geometry=pt_26, Motion=Y_6)  # -> Geometry, Transform
move_29 = Move(Geometry=move_28.Geometry, Motion=neg_5)  # -> Geometry, Transform; disabled
xy_17 = XYPlane(Origin=move_29.Geometry)
rectangle = Rectangle(Plane=xy_17, XSize=dom_3, YSize=dom_3, Radius=0)  # -> Rectangle, Length
boundary_6 = BoundarySurfaces(Edges=rectangle.Rectangle)
preview_7 = CustomPreview(Geometry=boundary_6, Shader=material_4)

move_30 = Move(Geometry=pt_26, Motion=amp_5)  # -> Geometry, Transform
target_position_render_sla = Point(move_28.Geometry)

target_position_render_sla_2 = Point(target_position_render_sla)
filter_20 = StreamFilter(Gate=render_slice_boolean, Stream0=target_position_table_projection, Stream1=target_position_render_sla_2)
move_31 = Move(Geometry=move_30.Geometry, Motion=Y_6)  # -> Geometry, Transform

camera_position_render_sla = Point(move_31.Geometry)

camera_position_render_sla_2 = Point(camera_position_render_sla)
filter_21 = StreamFilter(Gate=render_slice_boolean, Stream0=camera_position_table_projection, Stream1=camera_position_render_sla_2)

syncfloundercamera = SyncFlounderCamera(
    Activate=enable_view_control,
    ViewportName="Fellesverkstedet",
    Location=filter_21,
    Target=filter_20,
    Lens=int_5,
    Up=filter_16)

joined_meshes_2 = Mesh(mjoin_2)
neg_17 = Negative(Value="0.01")
pt_27 = Point(move_25.Geometry)
meshcp_8 = MeshClosestPoint(Point=pt_27, Mesh=joined_meshes_2)  # -> Point, Index, Parameter
Z_28 = UnitZ(Factor=neg_17)
move_32 = Move(Geometry=meshcp_8.Point, Motion=Z_28)  # -> Geometry, Transform
vertical_angle_cutoff_2 = Panel(vertical_angle_cutoff)
meshcp_9 = MeshClosestPoint(Point=move_32.Geometry, Mesh=joined_meshes_2)  # -> Point, Index, Parameter
meval_5 = MeshEval(Mesh=joined_meshes_2, Parameter=meshcp_9.Parameter)  # -> Point, Normal, Colour
Z_29 = UnitZ(Factor=1)
angle_3 = Angle(VectorA=meval_5.Normal, VectorB=Z_29)  # -> Angle, Reflex
deg_3 = Degrees(Radians=angle_3.Angle)
larger_9 = LargerThan(FirstNumber=deg_3, SecondNumber=vertical_angle_cutoff_2)  # -> LargerThan, OrEqualTo
dispatch_15 = Dispatch(List=pt_27, DispatchPattern=larger_9.LargerThan)  # -> ListA, ListB

vec2pt_5 = Vector2Pt(PointA=meshcp_9.Point, PointB=pt_27, Unitize=False)  # -> Vector, Length
dispatch_16 = Dispatch(List=vec2pt_5.Vector, DispatchPattern=larger_9.LargerThan)  # -> ListA, ListB
angle_4 = Angle(VectorA=dispatch_16.ListB, VectorB=Z_13)  # -> Angle, Reflex
deg_4 = Degrees(Radians=angle_4.Angle)
larger_10 = LargerThan(FirstNumber=deg_4, SecondNumber="90")  # -> LargerThan, OrEqualTo
dispatch_17 = Dispatch(List=dispatch_15.ListB, DispatchPattern=larger_10.LargerThan)  # -> ListA, ListB

pt_28 = Point(dispatch_17.ListB)

# ---- group: Remove points in cavity
milling_bit_radius_9 = Panel(multiplication_10)
joined_meshes_3 = Mesh(mjoin_2)
pt_29 = Point(pt_28)
meshcp_10 = MeshClosestPoint(Point=pt_29, Mesh=joined_meshes_3)  # -> Point, Index, Parameter
pdecon_11 = Deconstruct(Point=pt_29)  # -> XComponent, YComponent, ZComponent
pdecon_12 = Deconstruct(Point=meshcp_10.Point)  # -> XComponent, YComponent, ZComponent
pt_30 = ConstructPoint(XCoordinate=pdecon_12.XComponent, YCoordinate=pdecon_12.YComponent, ZCoordinate=pdecon_11.ZComponent)
vec2pt_6 = Vector2Pt(PointA=pt_29, PointB=pt_30, Unitize=False)  # -> Vector, Length
amp_6 = Amplitude(Vector=vec2pt_6.Vector, Amplitude=milling_bit_radius_9)
series_3 = Series(Start=0, Step=Slider(45, range=0..100), Count=Slider(8, range=0..10))
move_33 = Move(Geometry=pt_29, Motion=amp_6)  # -> Geometry, Transform
xy_18 = XYPlane(Origin=pt_29)
rad_3 = Radians(Degrees=series_3)
rotate_4 = Rotate(Geometry=move_33.Geometry, Angle=rad_3, Plane=xy_18)  # -> Geometry, Transform
Z_30 = UnitZ(Factor=1)
meshray_6 = MeshRay(Mesh=joined_meshes_3, Point=rotate_4.Geometry, Direction=Z_30)  # -> Point, Hit
sort_5 = SortList(Keys=meshray_6.Hit)  # -> Keys, ValuesA
rev_4 = ReverseList(List=sort_5.Keys)
item_29 = ListItem(List=rev_4, Index=0, Wrap=True)
dispatch_18 = Dispatch(List=pt_29, DispatchPattern=item_29)  # -> ListA, ListB
pt_31 = Point(dispatch_18.ListB)

# ----
pt_32 = Point(pt_31)
pline_10 = PolyLine(Vertices=pt_32, Closed=False)
clean_9 = CleanTree(RemoveNulls=True, RemoveInvalid=True, RemoveEmpty=True, Tree=pline_10)

crv_14 = Curve(clean_9)
explode_5 = Explode(Curve=crv_14, Recursive=True)  # -> Segments, Vertices
project_5 = Project(Geometry=explode_5.Segments, Plane=xy_7)  # -> Geometry, Transform
colom_3 = CollisionOneMany(Collider=project_5.Geometry, Obstacles=flatten(project.Geometry))  # -> Collision, Index

colom_4 = CollisionOneMany(Collider=explode_5.Segments, Obstacles=flatten(joined_meshes))  # -> Collision, Index
or_2 = GateOr(A=colom_4.Collision, B=colom_3.Collision)

dispatch_19 = Dispatch(List=explode_5.Segments, DispatchPattern=or_2)  # -> ListA, ListB
crv_15 = Curve(dispatch_19.ListB)

explode_6 = Explode(Curve=crv_15, Recursive=True)  # -> Segments, Vertices; disabled
simplify_16 = SimplifyTree(Tree=explode_6.Segments, Front=False)
curvepoint_2 = PointOnCurve(simplify_16, parameter=0.5)
project_6 = Project(Geometry=curvepoint_2, Plane=xy_7)  # -> Geometry, Transform; disabled
# Fix: make slices from donut shape work
panel_22 = Panel("0.6")
incurves = PointInCurves(Point=project_6.Geometry, Curves=flatten(project.Geometry))  # -> Relationship, Index, Point
multiplication_39 = Multiplication(A=incurves.Relationship, B=panel_22)
int_6 = Integer(multiplication_39)
dispatch_20 = Dispatch(List=simplify_16, DispatchPattern=int_6)  # -> ListA, ListB

collison_free_polylines = Curve(crv_15)

explode_7 = Explode(Curve=collison_free_polylines, Recursive=True)  # -> Segments, Vertices
number_of_checking_points_per_segment = Panel("4")
simplify_17 = SimplifyTree(Tree=explode_7.Segments, Front=False)
divide = DivideCurve(Curve=simplify_17, Count=number_of_checking_points_per_segment, Kinks=False)  # -> Points, Tangents, Parameters
mesh_13 = Mesh(mjoin_4)
cull_i_3 = CullIndex(List=divide.Points, Indices="0", Wrap=True)
rev_5 = ReverseList(List=cull_i_3)
cull_i_4 = CullIndex(List=rev_5, Indices="0", Wrap=True)
simplify_18 = SimplifyTree(Tree=cull_i_4, Front=False)

pt_33 = Point(simplify_18)

meshcp_11 = MeshClosestPoint(Point=pt_33, Mesh=mesh_13)  # -> Point, Index, Parameter
milling_bit_radius_10 = Panel(milling_bit_radius)
dist_3 = Distance(PointA=pt_33, PointB=meshcp_11.Point)
subtraction_16 = Subtraction(A=dist_3, B=milling_bit_radius_10)
abs_2 = Absolute(Value=subtraction_16)
sort_6 = SortList(Keys=abs_2)  # -> Keys, ValuesA
rev_6 = ReverseList(List=sort_6.Keys)
multiplication_40 = Multiplication(A=milling_bit_radius_10, B=ratio_for_cull)
item_30 = ListItem(List=rev_6, Index=0, Wrap=True)
larger_11 = LargerThan(FirstNumber=item_30, SecondNumber=multiplication_40)  # -> LargerThan, OrEqualTo
dispatch_21 = Dispatch(List=item_30, DispatchPattern=larger_11.LargerThan)  # -> ListA, ListB
dispatch_22 = Dispatch(List=simplify_17, DispatchPattern=larger_11.LargerThan)  # -> ListA, ListB
# For higher sampling number fix bridge curves beeing pulled under overhangs
larger_12 = LargerThan(FirstNumber=dispatch_21.ListB, SecondNumber=threshold_for_rebuild)  # -> LargerThan, OrEqualTo
crv_16 = Curve(dispatch_22.ListB)
dispatch_23 = Dispatch(List=crv_16, DispatchPattern=larger_12.LargerThan)  # -> ListA, ListB

multiplication_41 = Multiplication(A=number_of_checking_points_per_segment, B=panel_16)

# ---- group: Align curve directions
curves_for_aligned_direction_2 = Curve(merged_overlapping_curves)
graft_4 = GraftTree(Tree=curves_for_aligned_direction_2, IncludeEmptyLists=True, IncludeNullItems=True)
offset_6 = Offset(Curve=graft_4, Distance="0.01", Plane=PlaneXY(0, 0, 0), Corners=2)
end_5 = EndPoints(Curve=offset_6)  # -> Start, End
pshift_30 = ShiftPaths(Data=end_5.Start, Offset=-1)
incurve_2 = PointInCurve(Point=pshift_30, Curve=graft_4)  # -> Relationship, Point
multiplication_42 = Multiplication(A=incurve_2.Relationship, B="0.5")
round_5 = Round(Number=multiplication_42)  # -> Nearest, Floor, Ceiling
crv_17 = Curve(graft_4)
int_7 = Integer(round_5.Nearest)
flip_3 = FlipCurve(Curve=crv_17)  # -> Curve, Flag
weave_3 = Weave(Pattern=int_7, Stream0=flip_3.Curve, Stream1=crv_17, NullGaps=False)
pshift_31 = ShiftPaths(Data=weave_3, Offset=-1)

# ----
flip_4 = FlipCurve(Curve=pshift_31)  # -> Curve, Flag
filter_22 = StreamFilter(Gate=use_inside_cutting_4, Stream0=pshift_31, Stream1=flip_4.Curve)

# ---- group: Align curve directions (continued)
aligned_curves_2 = Curve(filter_22)

# ----
simplify_19 = SimplifyTree(Tree=aligned_curves_2, Front=False)

divide_2 = DivideCurve(Curve=dispatch_23.ListA, Count="1", Kinks=False)  # -> Points, Tangents, Parameters
pline_11 = PolyLine(Vertices=divide_2.Points, Closed=False)
clean_10 = CleanTree(RemoveNulls=True, RemoveInvalid=True, RemoveEmpty=False, Tree=pline_11)
pshift_32 = ShiftPaths(Data=clean_10, Offset=-1)
curvepoint_3 = PointOnCurve(pshift_32, parameter=0.496)
Z_31 = UnitZ(Factor="0.1")
move_34 = Move(Geometry=curvepoint_3, Motion=Z_31)  # -> Geometry, Transform
mjoin_5 = MeshJoin(Meshes=meshes_for_3d_milling_2)
simplify_20 = SimplifyTree(Tree=move_34.Geometry, Front=False)
Z_32 = UnitZ(Factor=1)
meshray_7 = MeshRay(Mesh=mjoin_5, Point=simplify_20, Direction=Z_32)  # -> Point, Hit
dispatch_24 = Dispatch(List=pshift_32, DispatchPattern=meshray_7.Hit)  # -> ListA, ListB
lng_12 = ListLength(List=dispatch_24.ListA)
crv_18 = Curve(dispatch_24.ListB)
dup_2 = DuplicateData(Data="0", Number=lng_12, Order=True)

pshift_33 = ShiftPaths(Data=dup_2, Offset=-1)

weave_4 = Weave(Pattern=[0, 1], Stream0=crv_18, Stream1=pshift_33, NullGaps=False)
weave_5 = Weave(Pattern=larger_12.LargerThan, Stream0=dispatch_23.ListB, Stream1=weave_4, NullGaps=False)
crv_19 = Curve(weave_5)
clean_11 = CleanTree(RemoveNulls=True, RemoveInvalid=True, RemoveEmpty=False, Tree=crv_19)

crv_20 = Curve(clean_11)
pshift_34 = ShiftPaths(Data=crv_20, Offset="-2")
null_5 = NullItem(Item=pshift_34)  # -> NullFlags, InvalidFlags, Description
flatten_5 = FlattenTree(Tree=crv_20, Path="{0}")
item_31 = ListItem(List=flatten(null_5.InvalidFlags), Index=0, Wrap=True)
filter_23 = StreamFilter(Gate=item_31, Stream0=pshift_34, Stream1=flatten_5)
join_4 = JoinCurves(Curves=filter_23, Preserve=False)
cp_9 = ControlPoints(Curve=join_4)  # -> Points, Weights, Knots

pdecon_13 = Deconstruct(Point=cp_9.Points)  # -> XComponent, YComponent, ZComponent
nblur = BlurNumbers(
    Numbers=pdecon_13.ZComponent,
    Strength=Slider(1, range=0..1),
    Iterations=Slider(10, range=0..10),
    Lock=Toggle(True),
    Wrap=False)

milling_bit_radius_11 = Panel(milling_bit_radius)
mesh_14 = Mesh(mjoin_2)
points_to_offset_with_tool_radius = Point(cp_9.Points)
meshcp_12 = MeshClosestPoint(Point=points_to_offset_with_tool_radius, Mesh=mesh_14)  # -> Point, Index, Parameter
dist_4 = Distance(PointA=points_to_offset_with_tool_radius, PointB=meshcp_12.Point)
vec2pt_7 = Vector2Pt(PointA=meshcp_12.Point, PointB=points_to_offset_with_tool_radius, Unitize=False)  # -> Vector, Length
subtraction_17 = Subtraction(A=milling_bit_radius_11, B=dist_4)
amp_7 = Amplitude(Vector=vec2pt_7.Vector, Amplitude=subtraction_17)
move_35 = Move(Geometry=points_to_offset_with_tool_radius, Motion=amp_7)  # -> Geometry, Transform
points_at_tool_radius_distance_from_mesh = Point(move_35.Geometry)

avr_2 = Average(Input=pdecon_13.ZComponent)
pt_34 = ConstructPoint(XCoordinate=pdecon_13.XComponent, YCoordinate=pdecon_13.YComponent, ZCoordinate=nblur)
pline_12 = PolyLine(Vertices=pt_34, Closed=False)
smoothpline_2 = SmoothPolyline(Polyline=pline_12, Strength=1, Times=Slider(5, range=0..10))
redpline_6 = Reduce(Polyline=smoothpline_2, Tolerance="0.02")  # -> Polyline, Reduction
cp_10 = ControlPoints(Curve=redpline_6.Polyline)  # -> Points, Weights, Knots
pt_35 = Point(cp_10.Points)

simplify_21 = SimplifyTree(Tree=points_at_tool_radius_distance_from_mesh, Front=False)
mjoin_6 = MeshJoin(Meshes=meshes_for_3d_milling_2)
Z_33 = UnitZ(Factor=1)
meshray_8 = MeshRay(Mesh=mjoin_6, Point=simplify_21, Direction=Z_33)  # -> Point, Hit
dispatch_25 = Dispatch(List=simplify_21, DispatchPattern=meshray_8.Hit)  # -> ListA, ListB
pt_36 = Point(dispatch_25.ListB)

pline_13 = PolyLine(Vertices=pt_36, Closed=False)
redpline_7 = Reduce(Polyline=pline_13, Tolerance=reduction_tolerance_5)  # -> Polyline, Reduction
len_5 = Length(Curve=redpline_7.Polyline)
smaller_9 = SmallerThan(FirstNumber=len_5, SecondNumber=multiplication_19)  # -> SmallerThan, OrEqualTo
dispatch_26 = Dispatch(List=redpline_7.Polyline, DispatchPattern=smaller_9.SmallerThan)  # -> ListA, ListB
crv_21 = Curve(dispatch_26.ListB)
filter_24 = StreamFilter(Gate=generate_roughing_3, Stream1=crv_21)
len_6 = Length(Curve=flatten(dispatch_26.ListB))

simplify_22 = SimplifyTree(Tree=filter_24, Front=False)
pshift_35 = ShiftPaths(Data=simplify_22, Offset=-1)
null_6 = NullItem(Item=pshift_35)  # -> NullFlags, InvalidFlags, Description
flatten_6 = FlattenTree(Tree=null_6.NullFlags, Path="{0}")
item_32 = ListItem(List=flatten_6, Index=0, Wrap=True)
filter_25 = StreamFilter(Gate=item_32, Stream0=pshift_35, Stream1=simplify_22)
pshift_36 = ShiftPaths(Data=filter_25, Offset=-1)
null_7 = NullItem(Item=pshift_36)  # -> NullFlags, InvalidFlags, Description
flatten_7 = FlattenTree(Tree=null_7.NullFlags, Path="{0}")
item_33 = ListItem(List=flatten_7, Index=0, Wrap=True)
filter_26 = StreamFilter(Gate=item_33, Stream0=pshift_36, Stream1=filter_25)
flatten_8 = FlattenTree(Tree=filter_26, Path="{0}")
pshift_37 = ShiftPaths(Data=filter_26, Offset=-1)
null_8 = NullItem(Item=pshift_37)  # -> NullFlags, InvalidFlags, Description
flatten_9 = FlattenTree(Tree=null_8.NullFlags, Path="{0}")
item_34 = ListItem(List=flatten_9, Index=0, Wrap=True)
filter_27 = StreamFilter(Gate=item_34, Stream0=pshift_37, Stream1=flatten_8)
rev_7 = ReverseList(List=filter_27)

ma_2 = MassAddition(Input=len_6)  # -> Result, PartialResults
panel_23 = Panel(ma_2.Result)

division_14 = Division(A=roughing_stepover_2, B=finish_stepover)
round_6 = Round(Number=division_14)  # -> Nearest, Floor, Ceiling
# Use cutout as last roughing pass?
# Fix: cull logic. not always true. make possible use all finsih for roughing
toggle = BooleanToggle(True)
smaller_10 = SmallerThan(FirstNumber=round_6.Floor, SecondNumber="2")  # -> SmallerThan, OrEqualTo
dup_3 = DuplicateData(Data=Toggle(False), Number=round_6.Floor, Order=True)
merge_7 = Merge(Data1=flatten(toggle), Data2=flatten(dup_3))
cull = CullPattern(List=rev_7, CullPattern=merge_7)
filter_28 = StreamFilter(Gate=smaller_10.SmallerThan, Stream0=cull, Stream1=rev_7)
clean_12 = CleanTree(RemoveNulls=True, RemoveInvalid=True, RemoveEmpty=True, Tree=filter_28)
rev_8 = ReverseList(List=clean_12)

# ----
# Fix: pick correct bottom lines when opn toolpaths in bottom
divide_3 = DivideCurve(Curve=rev_7, Count=10, Kinks=False)  # -> Points, Tangents, Parameters; disabled
pdecon_14 = Deconstruct(Point=divide_3.Points)  # -> XComponent, YComponent, ZComponent
avr_3 = Average(Input=pdecon_14.ZComponent)
pshift_38 = ShiftPaths(Data=avr_3, Offset=-1)
panel_24 = Panel(pshift_38)
filter_29 = StreamFilter(Gate=generate_finishing_3, Stream1=dispatch_26.ListB)

crv_22 = Curve(rev_8)
cp_11 = ControlPoints(Curve=crv_22)  # -> Points, Weights, Knots
points_to_offset_with_tool_radius_2 = Point(cp_11.Points)
milling_bit_radius_12 = Panel(milling_bit_radius)
mesh_15 = Mesh(mjoin_2)
roughing_material_leftover_2 = Panel(roughing_material_leftover)
addition_7 = Addition(A=milling_bit_radius_12, B=roughing_material_leftover_2)
meshcp_13 = MeshClosestPoint(Point=points_to_offset_with_tool_radius_2, Mesh=mesh_15)  # -> Point, Index, Parameter
dist_5 = Distance(PointA=points_to_offset_with_tool_radius_2, PointB=meshcp_13.Point)
vec2pt_8 = Vector2Pt(PointA=meshcp_13.Point, PointB=points_to_offset_with_tool_radius_2, Unitize=False)  # -> Vector, Length
subtraction_18 = Subtraction(A=addition_7, B=dist_5)
amp_8 = Amplitude(Vector=vec2pt_8.Vector, Amplitude=subtraction_18)
move_36 = Move(Geometry=points_to_offset_with_tool_radius_2, Motion=amp_8)  # -> Geometry, Transform
points_at_tool_radius_distance_from_mesh_2 = Point(move_36.Geometry)
pline_14 = PolyLine(Vertices=points_at_tool_radius_distance_from_mesh_2, Closed=False)

move_37 = Move(Geometry=filter_29, Motion=Z_14)  # -> Geometry, Transform
clean_13 = CleanTree(RemoveNulls=True, RemoveInvalid=True, RemoveEmpty=False, Tree=move_37.Geometry)
simplify_23 = SimplifyTree(Tree=clean_13, Front=False)
flatten_10 = FlattenTree(Tree=simplify_23, Path="{0}")
pshift_39 = ShiftPaths(Data=simplify_23, Offset="-1")
pshift_40 = ShiftPaths(Data=simplify_23, Offset="-2")
item_35 = ListItem(List=flatten(pshift_40), Index=0, Wrap=True)
null_9 = NullItem(Item=item_35)  # -> NullFlags, InvalidFlags, Description
filter_30 = StreamFilter(Gate=null_9.NullFlags, Stream0=pshift_40, Stream1=pshift_39)
filter_31 = StreamFilter(Gate=smaller_3.SmallerThan, Stream0=filter_30, Stream1=flatten_10)
finishing_toolpaths = Curve(filter_31)

cls_2 = Closed(Curve=finishing_toolpaths)  # -> Closed, Periodic
dispatch_27 = Dispatch(List=finishing_toolpaths, DispatchPattern=cls_2.Closed)  # -> ListA, ListB
xz_3 = XZPlane(Origin=Point(0, 0, 0))
end_6 = EndPoints(Curve=dispatch_27.ListB)  # -> Start, End
rotate_5 = Rotate(Geometry=end_6.Start, Angle=1.570796327, Plane=xz_3)  # -> Geometry, Transform
flatten_11 = FlattenTree(Tree=rotate_5.Geometry, Path="{0}")
item_36 = ListItem(List=flatten_11, Index=0, Wrap=True)
sort_pt = SortPoints(Points=rotate_5.Geometry)  # -> Points, Indices
null_10 = NullItem(Item=item_36)  # -> NullFlags, InvalidFlags, Description
item_37 = ListItem(List=dispatch_27.ListB, Index=sort_pt.Indices, Wrap=True)
rev_9 = ReverseList(List=item_37)
dispatch_28 = Dispatch(List=item_37, DispatchPattern=[True, False])  # -> ListA, ListB
flip_5 = FlipCurve(Curve=dispatch_28.ListB)  # -> Curve, Flag
weave_6 = Weave(Pattern=[0, 1], Stream0=dispatch_28.ListA, Stream1=flip_5.Curve, NullGaps=False)
weave_7 = Weave(Pattern=cls_2.Closed, Stream0=weave_6, Stream1=dispatch_27.ListA, NullGaps=False)

milling_bit_radius_13 = Panel(milling_bit_radius)
neg_18 = Negative(Value=milling_bit_radius_13)
pshift_41 = ShiftPaths(Data=pline_14, Offset=-1)
Z_34 = UnitZ(Factor=neg_18)
move_38 = Move(Geometry=pshift_41, Motion=Z_34)  # -> Geometry, Transform
xz_4 = XZPlane(Origin=Point(0, 0, 0))
pass_depth_cutout = Panel(pass_depth_roughing_and_cutout)
x_tremez = Extremes(Curve=move_38.Geometry, Plane=xz_4)  # -> Highest, Lowest
devec_2 = DeconstructVector(Vector=x_tremez.Lowest)  # -> XComponent, YComponent, ZComponent
division_15 = Division(A=devec_2.ZComponent, B=pass_depth_cutout)
round_7 = Round(Number=division_15)  # -> Nearest, Floor, Ceiling
neg_19 = Negative(Value=round_7.Floor)

filter_32 = StreamFilter(Gate=null_10.NullFlags, Stream0=weave_7, Stream1=finishing_toolpaths)
flatten_12 = FlattenTree(Tree=filter_32, Path="{0}")
clean_14 = CleanTree(RemoveNulls=True, RemoveInvalid=True, RemoveEmpty=False, Tree=flatten_12)
finishing_toolpaths_2 = Curve(clean_14)
smaller_11 = SmallerThan(FirstNumber=neg_19, SecondNumber="2")  # -> SmallerThan, OrEqualTo
dispatch_29 = Dispatch(List=neg_19, DispatchPattern=smaller_11.SmallerThan)  # -> ListA, ListB
crv_23 = Curve(move_38.Geometry)
subtraction_19 = Subtraction(A=dispatch_29.ListB, B="1")
dispatch_30 = Dispatch(List=crv_23, DispatchPattern=smaller_11.SmallerThan)  # -> ListA, ListB

series_4 = Series(Start=pass_depth_cutout, Step=pass_depth_cutout, Count=subtraction_19)
clean_15 = CleanTree(RemoveNulls=True, RemoveInvalid=True, RemoveEmpty=True, Tree=series_4)

end_7 = EndPoints(Curve=finishing_toolpaths_2)  # -> Start, End
crv_24 = Curve(dispatch_30.ListB)

Z_35 = UnitZ(Factor=clean_15)
move_39 = Move(Geometry=graft(crv_24), Motion=Z_35)  # -> Geometry, Transform
rev_10 = ReverseList(List=move_39.Geometry)
flatten_13 = FlattenTree(Tree=rev_10, Path="{0}")
crv_25 = Curve(flatten_13)

shift = ShiftList(List=end_7.Start, Shift="1", Wrap=True)
ln_10 = Line(StartPoint=end_7.End, EndPoint=shift)
len_7 = Length(Curve=ln_10)
larger_13 = LargerThan(FirstNumber=len_7, SecondNumber=multiplication_20)  # -> LargerThan, OrEqualTo
lng_13 = ListLength(List=finishing_toolpaths_2)

# ---- group: Flip every second curve to prep for weaving
cls_3 = Closed(Curve=crv_25)  # -> Closed, Periodic
dispatch_31 = Dispatch(List=crv_25, DispatchPattern=cls_3.Closed)  # -> ListA, ListB
dispatch_32 = Dispatch(List=dispatch_31.ListB, DispatchPattern=[True, False])  # -> ListA, ListB
flip_6 = FlipCurve(Curve=dispatch_32.ListB)  # -> Curve, Flag
weave_8 = Weave(Pattern=[0, 1], Stream0=dispatch_32.ListA, Stream1=flip_6.Curve, NullGaps=False)
weave_9 = Weave(Pattern=cls_3.Closed, Stream0=weave_8, Stream1=dispatch_31.ListA, NullGaps=False)

# ----
series_5 = Series(Start=0, Step=1, Count=lng_13)
dispatch_33 = Dispatch(List=series_5, DispatchPattern=larger_13.LargerThan)  # -> ListA, ListB
replace = ReplaceItems(List=ln_10, Indices=dispatch_33.ListA, Wrap=False)
end_8 = EndPoints(Curve=graft(replace))  # -> Start, End
rouging_toolpaths = Curve(weave_9)
move_40 = Move(Geometry=end_8.Start, Motion=Z_15)  # -> Geometry, Transform
move_41 = Move(Geometry=end_8.End, Motion=Z_15)  # -> Geometry, Transform
item_38 = ListItem(List=weave_9, Index=Slider(0, range=0..100), Wrap=False)
nurbs = NurbsCurve(Vertices=[end_8.Start, move_40.Geometry, move_41.Geometry, end_8.End], Degree=3, Periodic=False)  # -> Curve, Length, Domain
pshift_42 = ShiftPaths(Data=nurbs.Curve, Offset=-1)
filter_33 = StreamFilter(Gate=make_flea_jump_transitions_3, Stream0=replace, Stream1=pshift_42)
flatten_14 = FlattenTree(Tree=simplify_23, Path="{0}")
weave_10 = Weave(Pattern=[0, 1], Stream0=finishing_toolpaths_2, Stream1=filter_33, NullGaps=False)
rouging_toolpaths_2 = Curve(rouging_toolpaths)
clean_16 = CleanTree(RemoveNulls=True, RemoveInvalid=True, RemoveEmpty=False, Tree=flatten_14)
clean_17 = CleanTree(RemoveNulls=True, RemoveInvalid=True, RemoveEmpty=False, Tree=weave_10)
connected_finishing_toolpaths = Curve(clean_17)
finishing_toolpaths_3 = Curve(clean_16)
filter_34 = StreamFilter(Gate=connect_toolpaths_levels_3, Stream0=finishing_toolpaths_3, Stream1=connected_finishing_toolpaths)
finishing_toolpaths_4 = Curve(filter_34)
finishing_toolpaths_5 = Curve(finishing_toolpaths_4)
len_8 = Length(Curve=flatten(finishing_toolpaths_4))  # disabled
len_9 = Length(Curve=finishing_toolpaths_5)  # disabled
ma_3 = MassAddition(Input=len_8)  # -> Result, PartialResults
ma_4 = MassAddition(Input=len_9)  # -> Result, PartialResults
division_16 = Division(A=ma_3.Result, B=Slider(30, range=0..100))
panel_25 = Panel(ma_4.Result)
division_17 = Division(A=division_16, B=Slider(60, range=0..100))
panel_26 = Panel(division_17)

# ---- group: Detect curves inside curves
aligned_curves_3 = Curve(simplify_19)
end_9 = EndPoints(Curve=aligned_curves_3)  # -> Start, End
graft_5 = GraftTree(Tree=aligned_curves_3, IncludeEmptyLists=True, IncludeNullItems=True)

# ----
flatten_15 = FlattenTree(Tree=end_9.Start, Path="{0}")

# ---- group: Detect curves inside curves (continued)
incurve_3 = PointInCurve(Point=flatten_15, Curve=graft_5)  # -> Relationship, Point
multiplication_43 = Multiplication(A=incurve_3.Relationship, B="0.5")
round_8 = Round(Number=multiplication_43)  # -> Nearest, Floor, Ceiling
int_8 = Integer(round_8.Floor)

# ----
sort_7 = SortList(Keys=int_8)  # -> Keys, ValuesA
rev_11 = ReverseList(List=sort_7.Keys)
item_39 = ListItem(List=rev_11, Index=0, Wrap=True)
pshift_43 = ShiftPaths(Data=item_39, Offset=-1)
lng_14 = ListLength(List=pshift_43)
smaller_12 = SmallerThan(FirstNumber=lng_14, SecondNumber="2")  # -> SmallerThan, OrEqualTo
dispatch_34 = Dispatch(List=pshift_43, DispatchPattern=smaller_12.SmallerThan)  # -> ListA, ListB
not_2 = GateNot(A=dispatch_34.ListA)
weave_11 = Weave(Pattern=[0, 1], Stream0=dispatch_34.ListB, Stream1=not_2, NullGaps=False)

# ---- group: Detect curves inside curves (continued)
dispatch_35 = Dispatch(List=aligned_curves_3, DispatchPattern=weave_11)  # -> ListA, ListB
curves_outside = Curve(dispatch_35.ListA)
curves_inside = Curve(dispatch_35.ListB)

# ----
curves_for_offset_outwards = Curve(curves_outside)
curves_for_offset_inwards = Curve(curves_inside)
redpline_8 = Reduce(Polyline=curves_for_offset_outwards, Tolerance="0.02")  # -> Polyline, Reduction
redpline_9 = Reduce(Polyline=curves_for_offset_inwards, Tolerance="0.02")  # -> Polyline, Reduction
offset_7 = Offset(Curve=redpline_8.Polyline, Distance=neg_7, Plane=operation_plane_2, Corners=2)
offset_8 = Offset(Curve=redpline_9.Polyline, Distance=compensated_tool_radius, Plane=operation_plane_2, Corners=2)
cls_4 = Closed(Curve=offset_7)  # -> Closed, Periodic
cls_5 = Closed(Curve=offset_8)  # -> Closed, Periodic
safe_offset_curve = SafeOffsetCurve(offset_amount=compensated_tool_radius, curves_to_offset=redpline_8.Polyline)  # -> error_corrected_curves_outside_2, error_corrected_curves_inside_2
safe_offset_curve_2 = SafeOffsetCurve(offset_amount=compensated_tool_radius, curves_to_offset=redpline_9.Polyline)  # -> error_corrected_curves_outside_2, error_corrected_curves_inside_2
flip_7 = FlipCurve(Curve=safe_offset_curve.error_corrected_curves_outside_2)  # -> Curve, Flag
p_n_c_4 = PickNChoose(Pattern=cls_5.Closed, Stream0=safe_offset_curve_2.error_corrected_curves_inside_2, Stream1=offset_8)
p_n_c_5 = PickNChoose(Pattern=cls_4.Closed, Stream0=flip_7.Curve, Stream1=offset_7)
flip_8 = FlipCurve(Curve=p_n_c_4)  # -> Curve, Flag
outside_cutout_curves = Curve(p_n_c_5)
inside_cutout_curves = Curve(flip_8.Curve)

outside_cutout_curves_2 = Curve(outside_cutout_curves)
inside_cutout_curves_2 = Curve(inside_cutout_curves)
inside_outline_curves = Curve(inside_cutout_curves_2)
end_10 = EndPoints(Curve=inside_outline_curves)  # -> Start, End
incurves_2 = PointInCurves(Point=end_10.Start, Curves=outside_cutout_curves_2)  # -> Relationship, Index, Point
addition_8 = Addition(A=incurves_2.Index, B="1")
ins = InsertItems(List=outside_cutout_curves_2, Item=inside_outline_curves, Indices=incurves_2.Index, Wrap=True)

merge_8 = Merge(Data1=outside_cutout_curves, Data2=inside_cutout_curves)  # disabled

# ---- group: Flip curves for climb direction
sorted_inside_and_outside_curves = Curve(ins)
use_climb_direction_3 = Panel("0")
flip_9 = FlipCurve(Curve=sorted_inside_and_outside_curves)  # -> Curve, Flag
filter_35 = StreamFilter(Gate=use_climb_direction_3, Stream0=flip_9.Curve, Stream1=sorted_inside_and_outside_curves)
sorted_inside_and_outside_curves_2 = Curve(filter_35)

# ----
sorted_inside_and_outside_curves_3 = Curve(filter_35)
filter_36 = StreamFilter(Gate=generate_cutout_3, Stream1=sorted_inside_and_outside_curves_2)

# ---- group: Move cutout toolpaths to cut depths
extra_cut_depth_2 = Panel(addition)
cutout_depth_2 = Panel(cutout_depth)
cls_6 = Closed(Curve=outside_cutout_curves)  # -> Closed, Periodic
cull_2 = CullPattern(List=cutout_depth_2, CullPattern=cls_6.Closed)
simplify_24 = SimplifyTree(Tree=filter_36, Front=False)
clean_18 = CleanTree(RemoveNulls=True, RemoveInvalid=True, RemoveEmpty=True, Tree=cull_2)
clean_19 = CleanTree(RemoveNulls=True, RemoveInvalid=True, RemoveEmpty=False, Tree=simplify_24)
simplify_25 = SimplifyTree(Tree=clean_18, Front=False)
addition_9 = Addition(A=simplify_25, B=extra_cut_depth_2)
sorted_inside_and_outside_curves_4 = Curve(clean_19)
pass_depth_cutout_2 = Panel(pass_depth_roughing_and_cutout)
cut_depth_cutout_2 = Panel(addition_9)
division_18 = Division(A=cut_depth_cutout_2, B=pass_depth_cutout_2)
graft_6 = GraftTree(Tree=sorted_inside_and_outside_curves_4, IncludeEmptyLists=True, IncludeNullItems=True)
round_9 = Round(Number=division_18)  # -> Nearest, Floor, Ceiling
division_19 = Division(A=cut_depth_cutout_2, B=round_9.Ceiling)
actual_pass_depth = Panel(division_19)
series_6 = Series(Start=actual_pass_depth, Step=actual_pass_depth, Count=round_9.Ceiling)
neg_20 = Negative(Value=series_6)
Z_36 = UnitZ(Factor=neg_20)
move_42 = Move(Geometry=graft_6, Motion=Z_36)  # -> Geometry, Transform
flatten_16 = FlattenTree(Tree=move_42.Geometry, Path="{0}")

# ----
filter_37 = StreamFilter(Gate=generate_roughing_4, Stream1=sorted_inside_and_outside_curves_2)
cutout_curves = Curve(flatten_16)
item_40 = ListItem(List=cutout_curves, Index=Slider(10, range=0..10), Wrap=True)
cutout_curves_2 = Curve(cutout_curves)
len_10 = Length(Curve=cutout_curves_2)  # disabled
ma_5 = MassAddition(Input=len_10)  # -> Result, PartialResults
panel_27 = Panel(ma_5.Result)

extra_cut_depth_3 = Panel(addition)
roughing_material_leftover_3 = Panel(roughing_material_leftover)
cutout_depth_3 = Panel(abs)
simplify_26 = SimplifyTree(Tree=filter_37, Front=False)
clean_20 = CleanTree(RemoveNulls=True, RemoveInvalid=True, RemoveEmpty=False, Tree=simplify_26)
cls_7 = Closed(Curve=outside_cutout_curves)  # -> Closed, Periodic
cull_3 = CullPattern(List=cutout_depth_3, CullPattern=cls_7.Closed)
clean_21 = CleanTree(RemoveNulls=True, RemoveInvalid=True, RemoveEmpty=True, Tree=cull_3)
simplify_27 = SimplifyTree(Tree=clean_21, Front=False)
addition_10 = Addition(A=simplify_27, B=extra_cut_depth_3)
pass_depth_cutout_3 = Panel(pass_depth_roughing_and_cutout)
cut_depth_cutout_3 = Panel(addition_10)
division_20 = Division(A=cut_depth_cutout_3, B=pass_depth_cutout_3)
round_10 = Round(Number=division_20)  # -> Nearest, Floor, Ceiling
division_21 = Division(A=cut_depth_cutout_3, B=round_10.Ceiling)
actual_pass_depth_2 = Panel(division_21)
subtraction_20 = Subtraction(A=round_10.Ceiling, B="1")
series_7 = Series(Start=actual_pass_depth_2, Step=actual_pass_depth_2, Count=subtraction_20)
neg_21 = Negative(Value=series_7)
Z_37 = UnitZ(Factor=neg_21)

offset_9 = Offset(Curve=clean_20, Distance=roughing_material_leftover_3, Plane=PlaneXY(0, 0, 0), Corners=1)

sorted_inside_and_outside_curves_5 = Curve(offset_9)

graft_7 = GraftTree(Tree=sorted_inside_and_outside_curves_5, IncludeEmptyLists=True, IncludeNullItems=True)

move_43 = Move(Geometry=graft_7, Motion=Z_37)  # -> Geometry, Transform
flatten_17 = FlattenTree(Tree=move_43.Geometry, Path="{0}")

final_roughing_passes = Curve(flatten_17)
final_roughing_passes_2 = Curve(final_roughing_passes)
merge_9 = Merge(Data1=rouging_toolpaths_2, Data2=final_roughing_passes_2)
rouging_toolpaths_3 = Curve(merge_9)
rouging_toolpaths_4 = Curve(rouging_toolpaths_3)
len_11 = Length(Curve=rouging_toolpaths_4)  # disabled
merge_10 = Merge(Data1=flatten(rouging_toolpaths_4), Data2=flatten(finishing_toolpaths_5), Data3=flatten(cutout_curves_2))
ma_6 = MassAddition(Input=len_11)  # -> Result, PartialResults
clean_22 = CleanTree(RemoveNulls=True, RemoveInvalid=True, RemoveEmpty=False, Tree=merge_10)
panel_28 = Panel(ma_6.Result)
_3d_mill_toolpaths = Curve(clean_22)

wip_3d_mill_toolpaths = Curve(_3d_mill_toolpaths)
merge_11 = Merge(
    Data1=flatten(drill.drill_toolpaths_3),
    Data2=flatten(pocket),
    Data3=flatten(engrave),
    Data4=flatten(wip_3d_mill_toolpaths),
    Data5=flatten(cutout))

_3d_mill_toolpaths_2 = Curve(flatten(wip_3d_mill_toolpaths))
shopbot_code_postprocessor = ShopBotCodePostProcessor(
    toolpath_curves=merge_11,
    tab_breps=tab_breps_2,
    feed_rate=feed_rate_2,
    plunge_rate=plunge_rate_2,
    safe_z_height=safe_z_height,
    use_spindle=use_spindle_2,
    spindle_speed=spindle_speed_2,
    ramp_plunges=ramp_plunges_2,
    ramp_angle=ramp_angle_2,
    use_custom_jog_home=use_custom_jog_home_2,
    custom_home_x=custom_jog_home_x_2,
    custom_home_y=custom_jog_home_y_2,
    deviation_tolerance=deviation_tolerance_2,
    job_name=job_name)  # -> shopbot_code_connect_panel_stream_and_sa, toolpath_preview_line_2, cut_transition_preview_line_2, cut_entry_preview_line_2, cut_exit_preview_line_2
preview_graphic_for_1_1_projection_on_ma = PreviewGraphicFor11ProjectionOnMachine(
    toolpath_curves=[pocket_toolpaths, cutout_toolpaths, engrave_toolpaths, _3d_mill_toolpaths_2],
    cutting_curves=cutting_curves,
    pocket_curves=pocket_curves,
    drill_preview_curves=drill_preview_geometry,
    expected_projected_size=expected_projected_size,
    measured_projected_size=measured_projected_size,
    position_correction_x=position_correction_x,
    position_correction_y=position_correction_y,
    rotation_correction=rotation_correction,
    svg_px_width="719",
    svg_px_heigth="1279")  # "Preview graphic for 1:1 projection on machine"

# ---- group: ShopBot code
stream_and_save_as_sbp = Panel(shopbot_code_postprocessor.shopbot_code_connect_panel_stream_and_sa)

# ----
stream_and_save_as_svg = Panel(preview_graphic_for_1_1_projection_on_ma)

# ---- group: Toolpath preview (continued)
glowing_end_mill_paths = GlowingEndMillPaths(
    curves_for_glowpipe_preview=shopbot_code_postprocessor.toolpath_preview_line_2,
    bit_diameter=milling_bit_diameter_7,
    path_color=filter_17)  # disabled
preview_8 = CustomPreview(Geometry=shopbot_code_postprocessor.toolpath_preview_line_2, Shader=filter_13)
preview_9 = CustomPreview(Geometry=shopbot_code_postprocessor.cut_transition_preview_line_2, Shader=jog_transitions)
preview_10 = CustomPreview(Geometry=shopbot_code_postprocessor.cut_entry_preview_line_2, Shader=cut_entries)
preview_11 = CustomPreview(Geometry=shopbot_code_postprocessor.cut_exit_preview_line_2, Shader=cut_exits)

# ==== cluster DivideCurveEvenLenght: Calculates approximate curve length for even division
crv = ClusterInput()
crv_2 = Curve(crv)
B = ClusterInput()
len = Length(Curve=crv_2)
division = Division(A=len, B=B)
int = Integer(division)
divide = DivideCurve(Curve=crv_2, Count=int, Kinks=False)  # -> Points, Tangents, Parameters
P = ClusterOutput(divide.Points)

# ==== cluster SafeOffsetCurve: Always makes closed non intersecting curves from offset. Can handle extreme offset values.
curves_to_offset = ClusterInput()
offset_amount = ClusterInput()
curves_to_offset_2 = Curve(curves_to_offset)
offset_amount_2 = Number(offset_amount)
multiplication = Multiplication(A=offset_amount_2, B=Slider(0.05, range=0..1))
multiplication_2 = Multiplication(A=offset_amount_2, B=Slider(0.1, range=0..1))
curve_reduction_tolerance = Number(multiplication)
offset_fix_sample_distance = Number(multiplication_2)
topoly = CurveToPolyline(Curve=curves_to_offset_2, ToleranceDistance=curve_reduction_tolerance, ToleranceAngle=0)  # -> Polyline, Segments
neg = Negative(Value=offset_amount_2)
graft = GraftTree(Tree=topoly.Polyline, IncludeEmptyLists=True, IncludeNullItems=True)
num = Number([offset_amount_2, neg])
offset_l = OffsetLoose(Curve=graft, Distance=num)
crv = Curve(offset_l)
cp = ControlPoints(Curve=crv)  # -> Points, Weights, Knots
hull = ConvexHull(Points=cp.Points, Plane=PlaneXY(0, 0, 0))  # -> Hull, HullZ, Indices
len = Length(Curve=hull.Hull)
division = Division(A=len, B=offset_fix_sample_distance)
int = Integer(division)
dom = ConstructDomain(DomainStart=Slider(0, range=0..100), DomainEnd=Slider(500, range=0..10000))
constrain = Constrain(Number=int, Domain=dom)
pframes = PerpFrames(Curve=hull.Hull, Count=constrain, Align=True)  # -> Frames, Parameters
deplane = DeconstructPlane(Plane=pframes.Frames)  # -> Origin, XAxis, YAxis, ZAxis
pcx = CurvePlane(Curve=graft(crv), Plane=pframes.Frames)  # -> Points, ParamsC, ParamsP
dist = Distance(PointA=graft(deplane.Origin), PointB=pcx.Points)
sort = SortList(Keys=dist, ValuesA=pcx.Points)  # -> Keys, ValuesA
item = ListItem(List=sort.ValuesA, Index=0, Wrap=True)
pshift = ShiftPaths(Data=item, Offset=-1)
pline = PolyLine(Vertices=pshift, Closed=True)
pshift_2 = ShiftPaths(Data=pline, Offset=2)
flip = FlipMatrix(Data=pshift_2)
len_2 = Length(Curve=flip)
sort_2 = SortList(Keys=len_2, ValuesA=flip)  # -> Keys, ValuesA
rev = ReverseList(List=sort_2.ValuesA)
curve_reduction_tolerance_2 = Number(curve_reduction_tolerance)
item_2 = ListItem(List=sort_2.ValuesA, Index=0, Wrap=True)
item_3 = ListItem(List=rev, Index=0, Wrap=True)
redpline = Reduce(Polyline=item_3, Tolerance=curve_reduction_tolerance_2)  # -> Polyline, Reduction
redpline_2 = Reduce(Polyline=item_2, Tolerance=curve_reduction_tolerance_2)  # -> Polyline, Reduction
flip_2 = FlipCurve(Curve=redpline_2.Polyline)  # -> Curve, Flag
error_corrected_curves_outside = Curve(redpline.Polyline)
error_corrected_curves_inside = Curve(flip_2.Curve)
error_corrected_curves_outside_2 = ClusterOutput(error_corrected_curves_outside)
error_corrected_curves_inside_2 = ClusterOutput(error_corrected_curves_inside)

# ==== cluster Pocket
curves_for_raster_pocket = ClusterInput()
cut_depth_pocket = ClusterInput()
raster_along_y_0_1 = ClusterInput()
tool_diameter = ClusterInput()
stepover_0_1 = ClusterInput()
pass_depth = ClusterInput()
raster_trim_safety_distance = Panel("0.09")
cut_depth_pocket_2 = Number(cut_depth_pocket)

# ---- group: Filter out open curves
curves_for_raster_pocket_2 = Curve(curves_for_raster_pocket)
cls = Closed(Curve=curves_for_raster_pocket_2)  # -> Closed, Periodic
dispatch = Dispatch(List=curves_for_raster_pocket_2, DispatchPattern=cls.Closed)  # -> ListA, ListB
dispatch_2 = Dispatch(List=cut_depth_pocket_2, DispatchPattern=cls.Closed)  # -> ListA, ListB

# ----
raster_along_y_0_1_2 = Integer(raster_along_y_0_1)
tool_diameter_2 = Number(tool_diameter)
stepover_0_1_2 = Number(stepover_0_1)
pass_depth_2 = Number(pass_depth)
xy = XYPlane(Origin=Point(0, 0, 0))
multiplication = Multiplication(A=tool_diameter_2, B="0.5")
multiplication_2 = Multiplication(A=tool_diameter_2, B=stepover_0_1_2)
operation_plane = Plane(xy)
tool_radius = Panel(multiplication)
stepover_distance = Panel(multiplication_2)
tool_radius_2 = Panel(tool_radius)

# ---- group: Merge overlapping curves //removed for alowing multiple side by side pocket depths
curves_for_merging_overlap = Curve()
mcx = MultipleCurves(Curves=curves_for_merging_overlap)  # -> Points, IndexA, IndexB, ParamA, ParamB
dcon = DeleteConsecutive(Set=[mcx.IndexA, mcx.IndexB], Wrap=False)  # -> Set, Count
item = ListItem(List=curves_for_merging_overlap, Index=dcon.Set, Wrap=True)
cull_i = CullIndex(List=curves_for_merging_overlap, Indices=dcon.Set, Wrap=True)
runion = RegionUnion(Curves=item, Plane=operation_plane)
merged_overlapping_curves = Curve([runion, cull_i])

# ---- group: Align curve directions
curves_for_aligned_direction = Curve(dispatch.ListA)
graft = GraftTree(Tree=curves_for_aligned_direction, IncludeEmptyLists=True, IncludeNullItems=True)
offset = Offset(Curve=graft, Distance="0.01", Plane=PlaneXY(0, 0, 0), Corners=2)
end = EndPoints(Curve=offset)  # -> Start, End
pshift = ShiftPaths(Data=end.Start, Offset=-1)
incurve = PointInCurve(Point=pshift, Curve=graft)  # -> Relationship, Point
multiplication_3 = Multiplication(A=incurve.Relationship, B="0.5")
round = Round(Number=multiplication_3)  # -> Nearest, Floor, Ceiling
crv = Curve(graft)
int = Integer(round.Nearest)
flip = FlipCurve(Curve=crv)  # -> Curve, Flag
weave = Weave(Pattern=int, Stream0=flip.Curve, Stream1=crv, NullGaps=False)
pshift_2 = ShiftPaths(Data=weave, Offset=-1)
aligned_curves = Curve(pshift_2)

# ---- group: Detect curves inside curves
aligned_curves_2 = Curve(aligned_curves)
area = Area(Geometry=aligned_curves_2)  # -> Area, Centroid
graft_2 = GraftTree(Tree=aligned_curves_2, IncludeEmptyLists=True, IncludeNullItems=True)
end_2 = EndPoints(Curve=aligned_curves_2)  # -> Start, End
crv_cp = CurveClosestPoint(Point=area.Centroid, Curve=aligned_curves_2)  # -> Point, Parameter, Distance
incurve_2 = PointInCurve(Point=crv_cp.Point, Curve=graft_2)  # -> Relationship, Point
multiplication_4 = Multiplication(A=incurve_2.Relationship, B="0.5")
round_2 = Round(Number=multiplication_4)  # -> Nearest, Floor, Ceiling
int_2 = Integer(round_2.Floor)
flip_2 = FlipMatrix(Data=int_2)
cut_depth_pocket_3 = Number(dispatch_2.ListA)
ma = MassAddition(Input=flip_2)  # -> Result, PartialResults
pshift_3 = ShiftPaths(Data=ma.Result, Offset=-1)
dispatch_3 = Dispatch(List=cut_depth_pocket_3, DispatchPattern=pshift_3)  # -> ListA, ListB
dispatch_4 = Dispatch(List=aligned_curves_2, DispatchPattern=pshift_3)  # -> ListA, ListB
cut_depths_outer_pocket = Number(dispatch_3.ListB)
curves_outside = Curve(dispatch_4.ListB)
curves_inside = Curve(dispatch_4.ListA)

# ----
curves_for_offset_outwards = Curve(curves_inside)
curves_for_offset_inwards = Curve(curves_outside)
operation_plane_2 = Plane(operation_plane)
neg = Negative(Value=tool_radius_2)
offset_2 = Offset(Curve=curves_for_offset_inwards, Distance=tool_radius_2, Plane=operation_plane_2, Corners=2)
offset_3 = Offset(Curve=curves_for_offset_outwards, Distance=neg, Plane=operation_plane_2, Corners=2)
pshift_4 = ShiftPaths(Data=offset_3, Offset=-1)
pshift_5 = ShiftPaths(Data=offset_2, Offset=-1)

# ---- group: Merge overlapping inside curves
curves_for_merging_overlap_2 = Curve(pshift_4)
mcx_2 = MultipleCurves(Curves=curves_for_merging_overlap_2)  # -> Points, IndexA, IndexB, ParamA, ParamB
dcon_2 = DeleteConsecutive(Set=[mcx_2.IndexA, mcx_2.IndexB], Wrap=False)  # -> Set, Count
item_2 = ListItem(List=curves_for_merging_overlap_2, Index=dcon_2.Set, Wrap=True)
runion_2 = RegionUnion(Curves=item_2, Plane=operation_plane_2)
cull_i_2 = CullIndex(List=curves_for_merging_overlap_2, Indices=dcon_2.Set, Wrap=True)
merged_overlapping_curves_2 = Curve([runion_2, cull_i_2])

# ----
operation_plane_3 = Plane(operation_plane_2)

# ---- group: Detect narrow gaps
graft_3 = GraftTree(Tree=merged_overlapping_curves_2, IncludeEmptyLists=True, IncludeNullItems=True)
ccx = CurveCurve(CurveA=flatten(pshift_5), CurveB=graft_3)  # -> Points, ParamsA, ParamsB
lng = ListLength(List=ccx.ParamsB)
larger = LargerThan(FirstNumber=lng, SecondNumber="0")  # -> LargerThan, OrEqualTo
pshift_6 = ShiftPaths(Data=larger.LargerThan, Offset=-1)
ma_2 = MassAddition(Input=pshift_6)  # -> Result, PartialResults
pshift_7 = ShiftPaths(Data=ma_2.Result, Offset=-1)
dispatch_5 = Dispatch(List=merged_overlapping_curves_2, DispatchPattern=pshift_7)  # -> ListA, ListB
rdiff = RegionDifference(CurvesA=pshift_5, CurvesB=dispatch_5.ListA, Plane=operation_plane_3)
inside_outline_curves = Curve(dispatch_5.ListB)
fixed_outline_curves = Curve(rdiff)

# ----
curves_for_raster_generation = Curve(fixed_outline_curves)
raster_direction_bollean = Integer(raster_along_y_0_1_2)

oultine_curve = Curve(curves_for_raster_generation)
X = UnitX(Factor=1)
Y = UnitY(Factor=1)
bbox = BoundingBox(Content=oultine_curve, Plane=PlaneXY(0, 0, 0))  # -> Box, Box_2
rev = Reverse(Vector=Y)
edges = BrepEdges(Brep=bbox.Box)  # -> Naked, Interior, NonManifold
filter = StreamFilter(Gate=raster_direction_bollean, Stream0="2", Stream1="3")
filter_2 = StreamFilter(Gate=raster_direction_bollean, Stream0="3", Stream1="2")
filter_3 = StreamFilter(Gate=raster_direction_bollean, Stream0=rev, Stream1=X)
item_3 = ListItem(List=edges.Naked, Index=filter_2, Wrap=True)
item_4 = ListItem(List=edges.Naked, Index=filter, Wrap=True)
len = Length(Curve=item_3)
stepover_distance_2 = Panel(stepover_distance)
division = Division(A=len, B=stepover_distance_2)
round_3 = Round(Number=division)  # -> Nearest, Floor, Ceiling
series = Series(Start=stepover_distance_2, Step=stepover_distance_2, Count=round_3.Floor)
amp = Amplitude(Vector=filter_3, Amplitude=series)
move = Move(Geometry=item_4, Motion=amp)  # -> Geometry, Transform
raster_curves = Curve(move.Geometry)

raster_cutoff_safety_factor = Panel("0.05")
raster_trim_safety_distance_2 = Panel(raster_trim_safety_distance)

# ---- group: Trim raster curves
dispatch_6 = Dispatch(List=flatten(raster_curves), DispatchPattern=[True, False])  # -> ListA, ListB
operation_plane_4 = Plane(operation_plane)
oultine_curve_2 = Curve(curves_for_raster_generation)
flip_3 = FlipCurve(Curve=dispatch_6.ListA)  # -> Curve, Flag
weave_2 = Weave(Pattern=[0, 1], Stream0=flip_3.Curve, Stream1=dispatch_6.ListB, NullGaps=False)
raster_curves_2 = Curve(weave_2)
offset_4 = Offset(Curve=oultine_curve_2, Distance=raster_trim_safety_distance_2, Plane=operation_plane_4, Corners=1)
trim = TrimWithRegion(Curve=raster_curves_2, Region=offset_4, Plane=operation_plane_4)  # -> Inside, Outside
simplify = SimplifyTree(Tree=trim.Inside, Front=False)
trimmed_raster_curves = Curve(simplify)

# ----
multiplication_5 = Multiplication(A=tool_radius_2, B=raster_cutoff_safety_factor)

# ---- group: Filter short curves
stepover_distance_3 = Panel(stepover_distance_2)
len_2 = Length(Curve=trimmed_raster_curves)
multiplication_6 = Multiplication(A=stepover_distance_3, B="0.8")
smaller = SmallerThan(FirstNumber=len_2, SecondNumber=multiplication_6)  # -> SmallerThan, OrEqualTo
dispatch_7 = Dispatch(List=trimmed_raster_curves, DispatchPattern=smaller.SmallerThan)  # -> ListA, ListB
trimmed_and_filtered_raster_curves = Curve(dispatch_7.ListB)

# ---- group: Create line connections
oultine_curve_3 = Curve(oultine_curve_2)
lng_2 = ListLength(List=flatten(oultine_curve_3))
smaller_2 = SmallerThan(FirstNumber=lng_2, SecondNumber="2")  # -> SmallerThan, OrEqualTo
flatten = FlattenTree(Tree=trimmed_and_filtered_raster_curves, Path="{0}")
pshift_8 = ShiftPaths(Data=trimmed_and_filtered_raster_curves, Offset=-1)
filter_4 = StreamFilter(Gate=smaller_2.SmallerThan, Stream0=pshift_8, Stream1=flatten)
crv_2 = Curve(filter_4)
shift = ShiftList(List=crv_2, Shift="-1", Wrap=False)
shift_2 = ShiftList(List=crv_2, Shift="1", Wrap=False)
end_3 = EndPoints(Curve=shift)  # -> Start, End
end_4 = EndPoints(Curve=shift_2)  # -> Start, End
ln = Line(StartPoint=end_3.End, EndPoint=end_4.Start)

# ---- group: Filter intersecting curves
line_connections = Curve(ln)
inside_outline_curves_2 = Curve(inside_outline_curves)
oultine_curve_4 = Curve(oultine_curve_2)
colom = CollisionOneMany(Collider=line_connections, Obstacles=oultine_curve_4)  # -> Collision, Index
dispatch_8 = Dispatch(List=line_connections, DispatchPattern=colom.Collision)  # -> ListA, ListB
colom_2 = CollisionOneMany(Collider=dispatch_8.ListB, Obstacles=inside_outline_curves_2)  # -> Collision, Index
dispatch_9 = Dispatch(List=line_connections, DispatchPattern=colom_2.Collision)  # -> ListA, ListB
connection_lines = Curve(dispatch_9.ListB)

# ----
cut_depths_outer_pocket_2 = Number(flatten(cut_depths_outer_pocket))

# ---- group: Trim with inside outline curves
connection_lines_2 = Curve(connection_lines)
trimmed_and_filtered_raster_curves_2 = Curve(trimmed_and_filtered_raster_curves)
inside_outline_curves_3 = Curve(inside_outline_curves)
operation_plane_5 = Plane(operation_plane)
neg_2 = Negative(Value=raster_trim_safety_distance_2)
offset_5 = Offset(Curve=inside_outline_curves_3, Distance=neg_2, Plane=operation_plane_5, Corners=1)
oultine_curve_5 = Curve(oultine_curve_2)
lng_3 = ListLength(List=flatten(oultine_curve_5))
smaller_3 = SmallerThan(FirstNumber=lng_3, SecondNumber="2")  # -> SmallerThan, OrEqualTo
pshift_9 = ShiftPaths(Data=trimmed_and_filtered_raster_curves_2, Offset=-1)
flatten_2 = FlattenTree(Tree=trimmed_and_filtered_raster_curves_2, Path="{0}")
filter_5 = StreamFilter(Gate=smaller_3.SmallerThan, Stream0=pshift_9, Stream1=flatten_2)
pshift_10 = ShiftPaths(Data=offset_5, Offset=-1)
lng_4 = ListLength(List=flatten(inside_outline_curves_3))
smaller_4 = SmallerThan(FirstNumber=lng_4, SecondNumber="1")  # -> SmallerThan, OrEqualTo
trim_2 = TrimWithRegions(Curve=filter_5, Regions=pshift_10, Plane=operation_plane_4)  # -> Inside, Outside

# ----
filter_6 = StreamFilter(Gate=smaller_4.SmallerThan, Stream0=trim_2.Outside, Stream1=filter_5)

# ---- group: Trim with inside outline curves (continued)
crv_3 = Curve(filter_6)
join = JoinCurves(Curves=flatten([connection_lines_2, crv_3]), Preserve=True)
raster_curves_3 = Curve(join)

# ----
end_5 = EndPoints(Curve=raster_curves_3)  # -> Start, End
cps = ClosestPoints(Point=end_5.End, Cloud=end_5.Start, Count=2)  # -> ClosestPoint, CPIndex, Distance
dist = Distance(PointA=graft(end_5.Start), PointB=cps.ClosestPoint)
equals = Equality(FirstNumber=dist, SecondNumber="0")  # -> Equality, Inequality
dispatch_10 = Dispatch(List=cps.ClosestPoint, DispatchPattern=equals.Equality)  # -> ListA, ListB
item_5 = ListItem(List=dispatch_10.ListB, Index=0, Wrap=True)
ln_2 = Line(StartPoint=item_5, EndPoint=graft(end_5.End))

merge = Merge(Data1=inside_outline_curves_3, Data2=oultine_curve_4)
insied_and_outside_outline_curves = Curve(flatten(merge))
line_connections_2 = Curve(ln_2)
colom_3 = CollisionOneMany(Collider=line_connections_2, Obstacles=insied_and_outside_outline_curves)  # -> Collision, Index
dispatch_11 = Dispatch(List=line_connections_2, DispatchPattern=colom_3.Collision)  # -> ListA, ListB
stepover_distance_4 = Panel(stepover_distance_2)
len_3 = Length(Curve=dispatch_11.ListB)
multiplication_7 = Multiplication(A=stepover_distance_4, B="3")
larger_2 = LargerThan(FirstNumber=len_3, SecondNumber=multiplication_7)  # -> LargerThan, OrEqualTo
dispatch_12 = Dispatch(List=dispatch_11.ListB, DispatchPattern=larger_2.LargerThan)  # -> ListA, ListB
extra_connection_lines = Curve(dispatch_12.ListB)

extra_connection_lines_2 = Curve(extra_connection_lines)
raster_curves_4 = Curve(join)
join_2 = JoinCurves(Curves=flatten([raster_curves_4, extra_connection_lines_2]), Preserve=False)
raster_curves_5 = Curve(join_2)

inside_outline_curves_4 = Curve(inside_outline_curves)
oultine_curve_6 = Curve(curves_for_raster_generation)
raster_curves_6 = Curve(raster_curves_5)
flatten_3 = FlattenTree(Tree=oultine_curve_6, Path="{0}")
end_6 = EndPoints(Curve=inside_outline_curves_4)  # -> Start, End
incurves = PointInCurves(Point=end_6.Start, Curves=flatten_3)  # -> Relationship, Index, Point
addition = Addition(A=incurves.Index, B="1")
# fix curve order fail when no raster lines
# fix offset from when 1 line becomes more ? (narrow channels)
ins = InsertItems(List=flatten_3, Item=inside_outline_curves_4, Indices=addition, Wrap=True)
end_7 = EndPoints(Curve=raster_curves_6)  # -> Start, End
incurves_2 = PointInCurves(Point=end_7.Start, Curves=ins)  # -> Relationship, Index, Point
ins_2 = InsertItems(List=ins, Item=raster_curves_6, Indices=incurves_2.Index, Wrap=True)
flatten_4 = FlattenTree(Tree=ins_2, Path="{0}")
item_6 = ListItem(List=flatten_4, Index=0, Wrap=True)
null = NullItem(Item=item_6)  # -> NullFlags, InvalidFlags, Description
filter_7 = StreamFilter(Gate=null.NullFlags, Stream0=ins_2, Stream1=flatten_3)
sorted_raster_and_outline_routes = Curve(flatten(filter_7))

# ---- group: Sort curves
aligned_curves_3 = Curve(sorted_raster_and_outline_routes)
curves_outside_2 = Curve(flatten(dispatch_4.ListB))
graft_4 = GraftTree(Tree=curves_outside_2, IncludeEmptyLists=True, IncludeNullItems=True)
end_8 = EndPoints(Curve=aligned_curves_3)  # -> Start, End
lng_5 = ListLength(List=curves_outside_2)
incurve_3 = PointInCurve(Point=end_8.Start, Curve=graft_4)  # -> Relationship, Point
dup = DuplicateData(Data=graft(aligned_curves_3), Number=lng_5, Order=True)
multiplication_8 = Multiplication(A=incurve_3.Relationship, B="0.5")
pshift_11 = ShiftPaths(Data=dup, Offset=-1)
round_4 = Round(Number=multiplication_8)  # -> Nearest, Floor, Ceiling
flip_4 = FlipMatrix(Data=pshift_11)
int_3 = Integer(round_4.Floor)
cull = CullPattern(List=flip_4, CullPattern=int_3)
sorted_curves = Curve(cull)

# ---- group: Move pocket toolpaths to cut depths
pass_depth_3 = Panel(pass_depth_2)
cut_depth_pocket_4 = Panel(cut_depths_outer_pocket_2)
sorted_raster_and_outline_routes_2 = Curve(sorted_curves)
division_2 = Division(A=cut_depth_pocket_4, B=pass_depth_3)
round_5 = Round(Number=division_2)  # -> Nearest, Floor, Ceiling
division_3 = Division(A=cut_depth_pocket_4, B=round_5.Ceiling)
actual_pass_depth = Panel(division_3)
series_2 = Series(Start=actual_pass_depth, Step=actual_pass_depth, Count=round_5.Ceiling)
neg_3 = Negative(Value=series_2)
item_7 = ListItem(List=neg_3, Index=0, Wrap=True)
null_2 = NullItem(Item=item_7)  # -> NullFlags, InvalidFlags, Description
filter_8 = StreamFilter(Gate=null_2.NullFlags, Stream0=neg_3, Stream1="0")
Z = UnitZ(Factor=filter_8)

# ----
group = Group(Objects=sorted_raster_and_outline_routes_2)

# ---- group: Fix curve order
rev_2 = ReverseList(List=sorted_raster_and_outline_routes_2)  # disabled
item_8 = ListItem(List=rev_2, Index=0, Wrap=True)
pshift_12 = ShiftPaths(Data=item_8, Offset=-1)
curves_for_raster_pocket_3 = Curve(dispatch.ListA)  # disabled
end_9 = EndPoints(Curve=pshift_12)  # -> Start, End
incurves_3 = PointInCurves(Point=end_9.Start, Curves=curves_for_raster_pocket_3)  # -> Relationship, Index, Point
pshift_13 = ShiftPaths(Data=group, Offset=-1)
item_9 = ListItem(List=pshift_13, Index=incurves_3.Index, Wrap=True)
item_10 = ListItem(List=item_9, Index=0, Wrap=True)

# ---- group: Move pocket toolpaths to cut depths (continued)
move_2 = Move(Geometry=group, Motion=Z)  # -> Geometry, Transform
ungroup = Ungroup(Group=move_2.Geometry)
flatten_5 = FlattenTree(Tree=ungroup, Path="{0}")

# ----
pocket_toolpaths = Curve(flatten_5)
pocket_toolpaths_2 = ClusterOutput(pocket_toolpaths)

# ==== cluster Drill
I = ClusterInput()
I_2 = ClusterInput()
default_tool_diameter = Panel("6")
default_drill_depth = Panel("10")
null = NullItem(Item=I_2)  # -> NullFlags, InvalidFlags, Description
null_2 = NullItem(Item=I)  # -> NullFlags, InvalidFlags, Description
drill_curves = ClusterInput()
filter = StreamFilter(Gate=null.NullFlags, Stream0=I_2, Stream1=default_tool_diameter)
filter_2 = StreamFilter(Gate=null_2.NullFlags, Stream0=I, Stream1=default_drill_depth)

# ---- group: Creat hold down drill lines
drill_curves_2 = Curve(drill_curves)
drill_depth = Number(filter_2)
area = Area(Geometry=drill_curves_2)  # -> Area, Centroid
drill_depth_2 = Panel(drill_depth)
pdecon = Deconstruct(Point=area.Centroid)  # -> XComponent, YComponent, ZComponent
pt = ConstructPoint(XCoordinate=pdecon.XComponent, YCoordinate=pdecon.YComponent, ZCoordinate=0)
neg = Negative(Value=drill_depth_2)
Z = UnitZ(Factor=neg)
move = Move(Geometry=pt, Motion=Z)  # -> Geometry, Transform
ln = Line(StartPoint=pt, EndPoint=move.Geometry)

# ----
tool_diameter_for_preview = Number(filter)

# ---- group: Create hold down preview circles
drill_toolpaths = Curve(ln)
tool_diameter = Panel(tool_diameter_for_preview)
end = EndPoints(Curve=drill_toolpaths)  # -> Start, End
multiplication = Multiplication(A=tool_diameter, B="0.5")
pt_2 = Point(end.Start)
neg_2 = Negative(Value=multiplication)
neg_3 = Negative(Value=multiplication)
X = UnitX(Factor=multiplication)
X_2 = UnitX(Factor=neg_3)
Y = UnitY(Factor=neg_2)
Y_2 = UnitY(Factor=multiplication)
move_2 = Move(Geometry=pt_2, Motion=Y)  # -> Geometry, Transform
xy = XYPlane(Origin=pt_2)
move_3 = Move(Geometry=pt_2, Motion=X_2)  # -> Geometry, Transform
move_4 = Move(Geometry=pt_2, Motion=Y_2)  # -> Geometry, Transform
move_5 = Move(Geometry=pt_2, Motion=X)  # -> Geometry, Transform
cir = Circle(Plane=xy, Radius=multiplication)
ln_2 = Line(StartPoint=move_4.Geometry, EndPoint=move_2.Geometry)
ln_3 = Line(StartPoint=move_5.Geometry, EndPoint=move_3.Geometry)
drill_preview_geometry = Curve([ln_3, ln_2, cir])

# ----
drill_preview_geometry_2 = Curve(drill_preview_geometry)
drill_toolpaths_2 = Curve(ln)
drill_preview_geometry_3 = ClusterOutput(drill_preview_geometry_2)
drill_toolpaths_3 = ClusterOutput(drill_toolpaths_2)

# ==== cluster Engrave
engrave_curves = ClusterInput()
pass_depth = ClusterInput()
cut_depth = ClusterInput()
engrave_curves_2 = Curve(engrave_curves)
pass_depth_2 = Number(pass_depth)
cut_depth_2 = Number(cut_depth)
pass_depth_3 = Panel(pass_depth_2)
cut_depth_line_engrave = Panel(cut_depth_2)
division = Division(A=cut_depth_line_engrave, B=pass_depth_3)
round = Round(Number=division)  # -> Nearest, Floor, Ceiling
division_2 = Division(A=cut_depth_line_engrave, B=round.Ceiling)
actual_pass_depth = Panel(division_2)
series = Series(Start=actual_pass_depth, Step=actual_pass_depth, Count=round.Ceiling)
neg = Negative(Value=series)
null = NullItem(Item=division_2)  # -> NullFlags, InvalidFlags, Description
filter = StreamFilter(Gate=null.NullFlags, Stream0=neg, Stream1="0")
Z = UnitZ(Factor=filter)
move = Move(Geometry=graft(engrave_curves_2), Motion=Z)  # -> Geometry, Transform
flatten = FlattenTree(Tree=move.Geometry, Path="{0}")
engrave_toolpaths = Curve(flatten)
engrave_toolpaths_2 = ClusterOutput(engrave_toolpaths)

# ==== cluster Cutout
use_climb_direction = ClusterInput()
use_inside_cutting = ClusterInput()
curves_for_cutout = ClusterInput()
cutout_tolerance = ClusterInput()
tool_diameter = ClusterInput()
pass_depth = ClusterInput()
cut_depth = ClusterInput()
use_climb_direction_2 = Integer(use_climb_direction)
use_inside_cutting_2 = Integer(use_inside_cutting)
curves_for_cutout_2 = Curve(curves_for_cutout)
cutout_tolerance_2 = Number(cutout_tolerance)
tool_diameter_2 = Number(tool_diameter)
pass_depth_2 = Number(pass_depth)
cut_depth_2 = Number(cut_depth)
tool_diameter_3 = Panel(tool_diameter_2)
use_climb_direction_3 = Panel(use_climb_direction_2)
use_inside_cutting_3 = Panel(use_inside_cutting_2)

# ---- group: Filter out open curves
curves_for_cutout_3 = Curve(curves_for_cutout_2)
cls = Closed(Curve=curves_for_cutout_3)  # -> Closed, Periodic
dispatch = Dispatch(List=curves_for_cutout_3, DispatchPattern=cls.Closed)  # -> ListA, ListB

# ----
xy = XYPlane(Origin=Point(0, 0, 0))
operation_plane = Plane(xy)
multiplication = Multiplication(A=tool_diameter_3, B="0.5")
cutout_tolerance_3 = Panel(cutout_tolerance_2)
tool_radius = Panel(multiplication)
addition = Addition(A=tool_radius, B=cutout_tolerance_3)
compensated_tool_radius = Panel(addition)

# ---- group: Merge overlapping curves
curves_for_merging_overlap = Curve(dispatch.ListA)
mcx = MultipleCurves(Curves=curves_for_merging_overlap)  # -> Points, IndexA, IndexB, ParamA, ParamB
dcon = DeleteConsecutive(Set=[mcx.IndexA, mcx.IndexB], Wrap=False)  # -> Set, Count
item = ListItem(List=curves_for_merging_overlap, Index=dcon.Set, Wrap=True)
cull_i = CullIndex(List=curves_for_merging_overlap, Indices=dcon.Set, Wrap=True)
runion = RegionUnion(Curves=item, Plane=operation_plane)
merged_overlapping_curves = Curve([runion, cull_i])

# ----
use_inside_cutting_4 = Panel(use_inside_cutting_3)
operation_plane_2 = Plane(operation_plane)
neg = Negative(Value=compensated_tool_radius)
pass_depth_3 = Number(pass_depth_2)
cut_depth_3 = Number(cut_depth_2)

# ---- group: Align curve directions
curves_for_aligned_direction = Curve(merged_overlapping_curves)
graft = GraftTree(Tree=curves_for_aligned_direction, IncludeEmptyLists=True, IncludeNullItems=True)
offset = Offset(Curve=graft, Distance="0.01", Plane=PlaneXY(0, 0, 0), Corners=2)
end = EndPoints(Curve=offset)  # -> Start, End
pshift = ShiftPaths(Data=end.Start, Offset=-1)
incurve = PointInCurve(Point=pshift, Curve=graft)  # -> Relationship, Point
multiplication_2 = Multiplication(A=incurve.Relationship, B="0.5")
round = Round(Number=multiplication_2)  # -> Nearest, Floor, Ceiling
crv = Curve(graft)
int = Integer(round.Nearest)
flip = FlipCurve(Curve=crv)  # -> Curve, Flag
weave = Weave(Pattern=int, Stream0=flip.Curve, Stream1=crv, NullGaps=False)
pshift_2 = ShiftPaths(Data=weave, Offset=-1)

# ----
flip_2 = FlipCurve(Curve=pshift_2)  # -> Curve, Flag
filter = StreamFilter(Gate=use_inside_cutting_4, Stream0=pshift_2, Stream1=flip_2.Curve)

# ---- group: Align curve directions (continued)
aligned_curves = Curve(filter)

# ---- group: Detect curves inside curves
aligned_curves_2 = Curve(aligned_curves)
graft_2 = GraftTree(Tree=aligned_curves_2, IncludeEmptyLists=True, IncludeNullItems=True)
end_2 = EndPoints(Curve=aligned_curves_2)  # -> Start, End
incurve_2 = PointInCurve(Point=end_2.Start, Curve=graft_2)  # -> Relationship, Point
multiplication_3 = Multiplication(A=incurve_2.Relationship, B="0.5")
round_2 = Round(Number=multiplication_3)  # -> Nearest, Floor, Ceiling
int_2 = Integer(round_2.Floor)
flip_3 = FlipMatrix(Data=int_2)
ma = MassAddition(Input=flip_3)  # -> Result, PartialResults
pshift_3 = ShiftPaths(Data=ma.Result, Offset=-1)
dispatch_2 = Dispatch(List=aligned_curves_2, DispatchPattern=pshift_3)  # -> ListA, ListB
curves_outside = Curve(dispatch_2.ListB)
curves_inside = Curve(dispatch_2.ListA)

# ----
curves_for_offset_outwards = Curve(curves_outside)
curves_for_offset_inwards = Curve(curves_inside)
offset_2 = Offset(Curve=curves_for_offset_outwards, Distance=neg, Plane=operation_plane_2, Corners=2)
offset_3 = Offset(Curve=curves_for_offset_inwards, Distance=compensated_tool_radius, Plane=operation_plane_2, Corners=2)
pshift_4 = ShiftPaths(Data=offset_3, Offset=-1)
pshift_5 = ShiftPaths(Data=offset_2, Offset=-1)
flip_4 = FlipCurve(Curve=pshift_4)  # -> Curve, Flag
outside_cutout_curves = Curve(pshift_5)
inside_cutout_curves = Curve(flip_4.Curve)

outside_cutout_curves_2 = Curve(outside_cutout_curves)
inside_cutout_curves_2 = Curve(inside_cutout_curves)
inside_outline_curves = Curve(inside_cutout_curves_2)
flatten = FlattenTree(Tree=outside_cutout_curves_2, Path="{0}")
end_3 = EndPoints(Curve=inside_outline_curves)  # -> Start, End
incurves = PointInCurves(Point=end_3.Start, Curves=flatten)  # -> Relationship, Index, Point
addition_2 = Addition(A=incurves.Index, B="1")
ins = InsertItems(List=flatten, Item=inside_outline_curves, Indices=incurves.Index, Wrap=True)

# ---- group: Flip curves for climb direction
sorted_inside_and_outside_curves = Curve(ins)
use_climb_direction_4 = Panel(use_climb_direction_3)
flip_5 = FlipCurve(Curve=sorted_inside_and_outside_curves)  # -> Curve, Flag
filter_2 = StreamFilter(Gate=use_climb_direction_4, Stream0=flip_5.Curve, Stream1=sorted_inside_and_outside_curves)
sorted_inside_and_outside_curves_2 = Curve(filter_2)

# ---- group: Move cutout toolpaths to cut depths
sorted_inside_and_outside_curves_3 = Curve(sorted_inside_and_outside_curves_2)
pass_depth_4 = Panel(pass_depth_3)
cut_depth_cutout = Panel(cut_depth_3)
division = Division(A=cut_depth_cutout, B=pass_depth_4)
graft_3 = GraftTree(Tree=sorted_inside_and_outside_curves_3, IncludeEmptyLists=True, IncludeNullItems=True)
round_3 = Round(Number=division)  # -> Nearest, Floor, Ceiling
division_2 = Division(A=cut_depth_cutout, B=round_3.Ceiling)
actual_pass_depth = Panel(division_2)
series = Series(Start=actual_pass_depth, Step=actual_pass_depth, Count=round_3.Ceiling)
neg_2 = Negative(Value=series)
Z = UnitZ(Factor=neg_2)
simplify = SimplifyTree(Tree=graft_3, Front=False)
simplify_2 = SimplifyTree(Tree=Z, Front=False)
move = Move(Geometry=simplify, Motion=simplify_2)  # -> Geometry, Transform
flatten_2 = FlattenTree(Tree=move.Geometry, Path="{0}")

# ----
cutout_toolpaths = Curve(flatten_2)
cutout_toolpaths_2 = ClusterOutput(cutout_toolpaths)

# ==== cluster PreviewGraphicFor11ProjectionOnMachine
measured_projected_size = ClusterInput()
expected_projected_size = ClusterInput()
position_correction_x = ClusterInput()
position_correction_y = ClusterInput()
drill_preview_curves = ClusterInput()
rotation_correction = ClusterInput()
toolpath_curves = ClusterInput()
cutting_curves = ClusterInput()
svg_px_heigth = ClusterInput()
pocket_curves = ClusterInput()
svg_px_width = ClusterInput()
toolpath_curves_2 = Curve(flatten(toolpath_curves))
cutting_curves_2 = Curve(cutting_curves)
drill_preview_curves_2 = Curve(drill_preview_curves)
measured_projected_size_2 = Number(measured_projected_size)
position_correction_x_2 = Number(position_correction_x)
position_correction_y_2 = Number(position_correction_y)
svg_px_width_2 = Number(svg_px_width)
pocket_curves_2 = Curve(pocket_curves)
expected_projected_size_2 = Number(expected_projected_size)
rotation_correction_2 = Number(rotation_correction)
svg_px_heigth_2 = Number(svg_px_heigth)
background_color = ColourSwatch(SwatchColor=RGB(0, 0, 0))
explode = Explode(Curve=toolpath_curves_2, Recursive=True)  # -> Segments, Vertices
pt = ConstructPoint(XCoordinate=position_correction_x_2, YCoordinate=position_correction_y_2, ZCoordinate=0)
division = Division(A=expected_projected_size_2, B=measured_projected_size_2)
pt_2 = ConstructPoint(XCoordinate="0", YCoordinate="0", ZCoordinate=0)
vec2pt = Vector2Pt(PointA=pt_2, PointB=pt, Unitize=False)  # -> Vector, Length
xy = XYPlane(Origin=pt_2)
pocket_curves_3 = Curve(flatten(pocket_curves_2))
x_y_and_z_axis_indicators = Curve([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])
cutting_curves_3 = Curve(flatten(cutting_curves_2))
toolpath_curves_3 = Curve(flatten(explode.Segments))
drill_preview_curves_3 = Curve(drill_preview_curves_2)
scale = Scale(Geometry=flatten(x_y_and_z_axis_indicators), Center=pt_2, Factor=division)  # -> Geometry, Transform
scale_2 = Scale(Geometry=cutting_curves_3, Center=pt_2, Factor=division)  # -> Geometry, Transform
scale_3 = Scale(Geometry=pocket_curves_3, Center=pt_2, Factor=division)  # -> Geometry, Transform
scale_4 = Scale(Geometry=drill_preview_curves_3, Center=pt_2, Factor=division)  # -> Geometry, Transform
move = Move(Geometry=scale_3.Geometry, Motion=vec2pt.Vector)  # -> Geometry, Transform
move_2 = Move(Geometry=scale_2.Geometry, Motion=vec2pt.Vector)  # -> Geometry, Transform
scale_5 = Scale(Geometry=toolpath_curves_3, Center=pt_2, Factor=division)  # -> Geometry, Transform
move_3 = Move(Geometry=scale.Geometry, Motion=vec2pt.Vector)  # -> Geometry, Transform
move_4 = Move(Geometry=scale_4.Geometry, Motion=vec2pt.Vector)  # -> Geometry, Transform
move_5 = Move(Geometry=scale_5.Geometry, Motion=vec2pt.Vector)  # -> Geometry, Transform
rotate = Rotate(Geometry=move_2.Geometry, Angle=rotation_correction_2, Plane=xy)  # -> Geometry, Transform
rotate_2 = Rotate(Geometry=move.Geometry, Angle=rotation_correction_2, Plane=xy)  # -> Geometry, Transform
rotate_3 = Rotate(Geometry=move_4.Geometry, Angle=rotation_correction_2, Plane=xy)  # -> Geometry, Transform
rotate_4 = Rotate(Geometry=move_3.Geometry, Angle=rotation_correction_2, Plane=xy)  # -> Geometry, Transform
rotate_5 = Rotate(Geometry=move_5.Geometry, Angle=rotation_correction_2, Plane=xy)  # -> Geometry, Transform
topoly = CurveToPolyline(Curve=rotate_3.Geometry, ToleranceDistance=Slider(0.25, range=0..1), ToleranceAngle=0)  # -> Polyline, Segments
topoly_2 = CurveToPolyline(Curve=rotate_2.Geometry, ToleranceDistance=Slider(0.25, range=0..1), ToleranceAngle=0)  # -> Polyline, Segments
topoly_3 = CurveToPolyline(Curve=rotate.Geometry, ToleranceDistance=Slider(0.25, range=0..1), ToleranceAngle=0)  # -> Polyline, Segments
topoly_4 = CurveToPolyline(Curve=rotate_4.Geometry, ToleranceDistance=Slider(0.25, range=0..1), ToleranceAngle=0)  # -> Polyline, Segments
topoly_5 = CurveToPolyline(Curve=rotate_5.Geometry, ToleranceDistance=Slider(0.25, range=0..1), ToleranceAngle=0)  # -> Polyline, Segments
explode_2 = Explode(Curve=topoly_4.Polyline, Recursive=True)  # -> Segments, Vertices
crv = Curve(topoly.Polyline)
int = Integer(svg_px_heigth_2)
int_2 = Integer(svg_px_heigth_2)
crv_2 = Curve(topoly_2.Polyline)
crv_3 = Curve(flatten(explode_2.Segments))
int_3 = Integer(svg_px_heigth_2)
crv_4 = Curve(topoly_3.Polyline)
int_4 = Integer(svg_px_heigth_2)
crv_5 = Curve(topoly_5.Polyline)
int_5 = Integer(svg_px_heigth_2)
cluster = Cluster_2(
    background_height=int,
    polyline=crv,
    stroke_color=ColourSwatch(SwatchColor=RGB(255, 191, 0)),
    stroke_width=Slider(0.8, range=0..5))
cluster_2 = Cluster_2(
    background_height=int_2,
    polyline=crv_2,
    stroke_color=ColourSwatch(SwatchColor=RGB(251, 0, 255)),
    stroke_width=Slider(0.8, range=0..5))
cluster_3 = Cluster_2(
    background_height=int_3,
    polyline=crv_4,
    stroke_color=ColourSwatch(SwatchColor=RGB(0, 140, 255)),
    stroke_width=Slider(0.8, range=0..5))
cluster_4 = Cluster_2(
    background_height=int_4,
    polyline=crv_3,
    stroke_color=ColourSwatch(SwatchColor=RGB(106, 150, 158)),
    stroke_width=Slider(0.8, range=0..5))
cluster_5 = Cluster_2(
    background_height=int_5,
    polyline=crv_5,
    stroke_color=ColourSwatch(SwatchColor=RGB(184, 251, 255)),
    stroke_width=Slider(0.8, range=0..5))
flatten = FlattenTree(Tree=cluster, Path="{0}")
flatten_2 = FlattenTree(Tree=cluster_2, Path="{0}")
flatten_3 = FlattenTree(Tree=cluster_3, Path="{0}")
flatten_4 = FlattenTree(Tree=cluster_4, Path="{0}")
flatten_5 = FlattenTree(Tree=cluster_5, Path="{0}")
flatten_6 = FlattenTree(Tree=[flatten_5, flatten_3, flatten, flatten_2, flatten_4], Path="{0}")
cluster_6 = Cluster(background_width=svg_px_width_2, background_height=svg_px_heigth_2, background_color=background_color, data=flatten_6)
stream_save_as_svg = Panel(cluster_6)
composed_svg_stream_save_as_svg = ClusterOutput(cluster_6)

# ==== cluster ShopBotCodePostProcessor
use_custom_jog_home = ClusterInput()
deviation_tolerance = ClusterInput()
custom_home_x = ClusterInput()
toolpath_curves = ClusterInput()
custom_home_y = ClusterInput()
ramp_plunges = ClusterInput()
spindle_speed = ClusterInput()
safe_z_height = ClusterInput()
ramp_angle = ClusterInput()
use_spindle = ClusterInput()
plunge_rate = ClusterInput()
tab_breps = ClusterInput()
job_name = ClusterInput()
feed_rate = ClusterInput()

convert_to_inches = BooleanToggle(False)
toolpath_curves_2 = Curve(toolpath_curves)
tab_breps_2 = Brep(tab_breps)
feed_rate_2 = Number(feed_rate)
plunge_rate_2 = Number(plunge_rate)
safe_z_height_2 = Number(safe_z_height)
use_spindle_2 = Integer(use_spindle)
spindle_speed_2 = Number(spindle_speed)
ramp_plunges_2 = Integer(ramp_plunges)
ramp_angle_2 = Number(ramp_angle)
use_custom_jog_home_2 = Integer(use_custom_jog_home)
custom_home_x_2 = Number(custom_home_x)
custom_home_y_2 = Number(custom_home_y)
deviation_tolerance_2 = Number(deviation_tolerance)
job_name_2 = Text(job_name)
use_inches_boolean = Panel(convert_to_inches)
flatten = FlattenTree(Tree=tab_breps_2, Path="{0}")
flatten_2 = FlattenTree(Tree=toolpath_curves_2, Path="{0}")
filter = StreamFilter(Gate=use_inches_boolean, Stream0="1", Stream1="25.4")
division = Division(A=custom_home_x_2, B=filter)
division_2 = Division(A=custom_home_y_2, B=filter)
join = TextJoin(Text=flatten(["'", job_name_2]))
topoly = CurveToPolyline(Curve=flatten_2, ToleranceDistance=deviation_tolerance_2, ToleranceAngle=0)  # -> Polyline, Segments
division_3 = Division(A=feed_rate_2, B=filter)
division_4 = Division(A=plunge_rate_2, B=filter)
division_5 = Division(A=safe_z_height_2, B=filter)
polyline_toolpaths = Curve(topoly.Polyline)

# ---- group: Add ramps to toolpaths
ramp_toolpath_plunges = RampToolpathPlunges(toolpaths_to_ramp=polyline_toolpaths, ramp_angle=ramp_angle_2)
ramp_plunges_3 = Integer(ramp_plunges_2)
filter_2 = StreamFilter(Gate=ramp_plunges_3, Stream0=polyline_toolpaths, Stream1=ramp_toolpath_plunges)

# ---- group: Eliminate unecessary jog Z
connect_overlapping_toolpaths = ConnectOverlappingToolpaths(polyline_toolpaths=filter_2)

# ---- group: Adds tabs to toolpaths
tab_toolpaths = TabToolpaths(polyline_toolpaths=connect_overlapping_toolpaths, tab_breps=flatten)

# ---- group: Create safe Z transtions
cp = ControlPoints(Curve=tab_toolpaths)  # -> Points, Weights, Knots
rev = ReverseList(List=cp.Points)
safe_z_height_3 = Number(division_5)
item = ListItem(List=cp.Points, Index=0, Wrap=True)
item_2 = ListItem(List=rev, Index=0, Wrap=True)
pdecon = Deconstruct(Point=item)  # -> XComponent, YComponent, ZComponent
pdecon_2 = Deconstruct(Point=item_2)  # -> XComponent, YComponent, ZComponent
pt = ConstructPoint(XCoordinate=pdecon.XComponent, YCoordinate=pdecon.YComponent, ZCoordinate=safe_z_height_3)
pt_2 = ConstructPoint(XCoordinate=pdecon_2.XComponent, YCoordinate=pdecon_2.YComponent, ZCoordinate=safe_z_height_3)
safe_z_end_point = Point(pt_2)
safe_z_start_point = Point(pt)

# ----
toolpath_points = Point(cp.Points)
pdecon_3 = Deconstruct(Point=toolpath_points)  # -> XComponent, YComponent, ZComponent

# ---- group: Optional MM to inch conversion
convert_to_inches_boolean = Panel(convert_to_inches)
filter_3 = StreamFilter(Gate=convert_to_inches_boolean, Stream0="1", Stream1="25.4")
division_6 = Division(A=pdecon_3.XComponent, B=filter_3)
division_7 = Division(A=pdecon_3.YComponent, B=filter_3)
division_8 = Division(A=pdecon_3.ZComponent, B=filter_3)

# ----
lng = ListLength(List=toolpath_points)
flatten_3 = FlattenTree(Tree=lng, Path="{0}")
merge = Merge(Data1=Slider(0, range=0..100), Data2=flatten_3)
panel = Panel(division_6)
panel_2 = Panel(division_7)
panel_3 = Panel(division_8)

# ---- group: Create toolpath preview
rev_2 = ReverseList(List=flatten(safe_z_end_point))
cull_i = CullIndex(List=flatten(safe_z_start_point), Indices=0, Wrap=True)
cull_i_2 = CullIndex(List=rev_2, Indices=0, Wrap=True)
rev_3 = ReverseList(List=flatten(cull_i_2))
ln = Line(StartPoint=rev_3, EndPoint=cull_i)
ln_2 = Line(StartPoint=safe_z_start_point, EndPoint=item)
ln_3 = Line(StartPoint=item_2, EndPoint=safe_z_end_point)
cut_transition_preview_line = Curve(flatten(ln))
cut_entry_preview_line = Curve(flatten(ln_2))
cut_exit_preview_line = Curve(flatten(ln_3))
toolpath_preview_line = Curve(tab_toolpaths)

# ---- group: Jog to safe Z
safe_z_height_4 = Number(flatten(safe_z_height_3))
text = Text("JZ,")
graft = GraftTree(Tree=safe_z_height_4, IncludeEmptyLists=True, IncludeNullItems=True)
graft_2 = GraftTree(Tree=text, IncludeEmptyLists=True, IncludeNullItems=True)
lng_2 = ListLength(List=flatten(merge))
join_2 = TextJoin(Text=[graft_2, graft])
dup = DuplicateData(Data=join_2, Number=lng_2, Order=True)

# ---- group: Name
panel_4 = Panel(join)

# ---- group: Set spindle speed
spindle_speed_3 = Number(spindle_speed_2)
int = Integer(spindle_speed_3)
join_3 = TextJoin(Text=["TR,", int, ",1"])

# ---- group: Turn off spindle
filter_4 = StreamFilter(Gate=use_spindle_2, Stream1="SO,1,0")

# ---- group: Toolpath coordinates
text_2 = Text("M3,")
text_3 = Text(",")
text_4 = Text(",")
dup_2 = DuplicateData(Data=text_4, Number=lng, Order=True)
dup_3 = DuplicateData(Data=text_3, Number=lng, Order=True)
dup_4 = DuplicateData(Data=text_2, Number=lng, Order=True)
simplify = SimplifyTree(Tree=flatten(dup_4), Front=False)
simplify_2 = SimplifyTree(Tree=flatten(panel), Front=False)
simplify_3 = SimplifyTree(Tree=flatten(dup_3), Front=False)
simplify_4 = SimplifyTree(Tree=flatten(panel_2), Front=False)
simplify_5 = SimplifyTree(Tree=flatten(dup_2), Front=False)
simplify_6 = SimplifyTree(Tree=flatten(panel_3), Front=False)
graft_3 = GraftTree(Tree=simplify, IncludeEmptyLists=True, IncludeNullItems=True)
graft_4 = GraftTree(Tree=simplify_2, IncludeEmptyLists=True, IncludeNullItems=True)
graft_5 = GraftTree(Tree=simplify_3, IncludeEmptyLists=True, IncludeNullItems=True)
graft_6 = GraftTree(Tree=simplify_4, IncludeEmptyLists=True, IncludeNullItems=True)
graft_7 = GraftTree(Tree=simplify_5, IncludeEmptyLists=True, IncludeNullItems=True)
graft_8 = GraftTree(Tree=simplify_6, IncludeEmptyLists=True, IncludeNullItems=True)
join_4 = TextJoin(Text=[graft_3, graft_4, graft_5, graft_6, graft_7, graft_8])
flatten_4 = FlattenTree(Tree=join_4, Path="{0}")

# ---- group: Start spindle
panel_5 = Panel("PAUSE 1")
filter_5 = StreamFilter(Gate=use_spindle_2, Stream1="SO,1,1")

# ---- group: Set Feed rate (X Y speed) and plunge rate (Z speed)
feed_rate_3 = Number(division_3)
plunge_rate_3 = Number(division_4)
plunge_rate_4 = Number(plunge_rate_3)
feed_rate_4 = Number(feed_rate_3)
text_5 = Text("MS,")
text_6 = Text(",")
join_5 = TextJoin(Text=flatten([text_5, feed_rate_4, text_6, plunge_rate_4]))

# ----
filter_6 = StreamFilter(Gate=use_spindle_2, Stream1=join_3)
cut_transition_preview_line_2 = ClusterOutput(cut_transition_preview_line)
cut_exit_preview_line_2 = ClusterOutput(cut_exit_preview_line)
toolpath_preview_line_2 = ClusterOutput(toolpath_preview_line)
cut_entry_preview_line_2 = ClusterOutput(cut_entry_preview_line)
text_7 = Text("J2,")
text_8 = Text(",")
join_6 = TextJoin(Text=[text_7, division, text_8, division_2])

# ---- group: Insert JZ commands
ma = MassAddition(Input=merge)  # -> Result, PartialResults
ins = InsertItems(List=flatten_4, Item=dup, Indices=ma.PartialResults, Wrap=True)

# ---- group: Jog to startpoints
item_3 = ListItem(List=division_6, Index=0, Wrap=True)
item_4 = ListItem(List=division_7, Index=0, Wrap=True)
lng_3 = ListLength(List=flatten(item_3))
text_9 = Text(",")
text_10 = Text("J2,")
dup_5 = DuplicateData(Data=text_10, Number=lng_3, Order=True)
dup_6 = DuplicateData(Data=text_9, Number=lng_3, Order=True)
simplify_7 = SimplifyTree(Tree=flatten(dup_5), Front=False)
simplify_8 = SimplifyTree(Tree=flatten(item_3), Front=False)
simplify_9 = SimplifyTree(Tree=flatten(dup_6), Front=False)
simplify_10 = SimplifyTree(Tree=flatten(item_4), Front=False)
graft_9 = GraftTree(Tree=simplify_7, IncludeEmptyLists=True, IncludeNullItems=True)
graft_10 = GraftTree(Tree=simplify_8, IncludeEmptyLists=True, IncludeNullItems=True)
graft_11 = GraftTree(Tree=simplify_9, IncludeEmptyLists=True, IncludeNullItems=True)
graft_12 = GraftTree(Tree=simplify_10, IncludeEmptyLists=True, IncludeNullItems=True)
join_7 = TextJoin(Text=[graft_9, graft_10, graft_11, graft_12])
jh = Text("JH")
flatten_5 = FlattenTree(Tree=join_7, Path="{0}")

# ----
filter_7 = StreamFilter(Gate=use_custom_jog_home_2, Stream0=jh, Stream1=flatten(join_6))

# ---- group: Jog to startpoints (continued)
merge_2 = Merge(Data1=flatten_5, Data2=filter_7)

# ---- group: Insert J2 commands
lng_4 = ListLength(List=merge_2)
dup_7 = DuplicateData(Data=Slider(1, range=0..1), Number=lng_4, Order=True)
addition = Addition(A=dup_7, B=merge)
ma_2 = MassAddition(Input=addition)  # -> Result, PartialResults
ins_2 = InsertItems(List=ins, Item=merge_2, Indices=ma_2.PartialResults, Wrap=True)

# ----
flatten_6 = FlattenTree(Tree=ins_2, Path="{0}")
merge_3 = Merge(Data1=panel_4, Data3=filter_6, Data4=filter_5, Data5=panel_5, Data6=join_5, Data7=flatten_6, Data8=filter_4)
shopbot_code_connect_panel_stream_and_sa = ClusterOutput(merge_3)  # "ShopBot code - Connect panel, stream and save as .sbp"
stream_and_save_as_sbp = Panel(merge_3)

# ==== cluster Dogboner
corner_angle_threshold = ClusterInput()
milling_bit_diameter = ClusterInput()
flip_cornes_boolean = ClusterInput()
curves_to_dogbone = ClusterInput()
flip_cornes_boolean_2 = Integer(flip_cornes_boolean)
radius_margin = Panel("0.1")

milling_bit_diameter_2 = Number(milling_bit_diameter)
multiplication = Multiplication(A=milling_bit_diameter_2, B="0.5")
addition = Addition(A=multiplication, B=radius_margin)
dogbone_radius = Panel(addition)

corner_angle_threshold_2 = Number(corner_angle_threshold)
dom = ConstructDomain(DomainStart="1", DomainEnd="179")
constrain = Constrain(Number=corner_angle_threshold_2, Domain=dom)
subtraction = Subtraction(A="360", B=constrain)
division = Division(A=subtraction, B="360")
dogbone_minium_angle = Panel(division)

curves_to_dogbone_2 = Curve(curves_to_dogbone)
flatten = FlattenTree(Tree=curves_to_dogbone_2, Path="{0}")

# ---- group: Merge overlapping curves //removed to alow neighbouring pockets
mcx = MultipleCurves(Curves=flatten)  # -> Points, IndexA, IndexB, ParamA, ParamB; disabled
dcon = DeleteConsecutive(Set=[mcx.IndexA, mcx.IndexB], Wrap=False)  # -> Set, Count
item = ListItem(List=flatten, Index=dcon.Set, Wrap=True)
cull_i = CullIndex(List=flatten, Indices=dcon.Set, Wrap=True)
runion = RegionUnion(Curves=item)
merged_overlapping_curves = Curve([runion, cull_i])

# ---- group: Detect curves inside curves
aligned_curves = Curve(flatten)
graft = GraftTree(Tree=aligned_curves, IncludeEmptyLists=True, IncludeNullItems=True)
end = EndPoints(Curve=aligned_curves)  # -> Start, End
incurve = PointInCurve(Point=end.Start, Curve=graft)  # -> Relationship, Point
multiplication_2 = Multiplication(A=incurve.Relationship, B="0.5")
round = Round(Number=multiplication_2)  # -> Nearest, Floor, Ceiling
int = Integer(round.Floor)
flip = FlipMatrix(Data=int)
ma = MassAddition(Input=flip)  # -> Result, PartialResults
pshift = ShiftPaths(Data=ma.Result, Offset=-1)
dispatch = Dispatch(List=aligned_curves, DispatchPattern=pshift)  # -> ListA, ListB
curves_outside = Curve(dispatch.ListB)
curves_inside = Curve(dispatch.ListA)

# ----
xy = XYPlane(Origin=Point(0, 0, 0))
cir = Circle(Plane=xy, Radius="0.01")
dogbone_minium_angle_2 = Panel(dogbone_minium_angle)
len = Length(Curve=cir)
multiplication_3 = Multiplication(A=len, B=dogbone_minium_angle_2)

xy_2 = XYPlane(Origin=Point(0, 0, 0))
cir_2 = Circle(Plane=xy_2, Radius="0.01")
dogbone_minium_angle_3 = Panel(dogbone_minium_angle)
len_2 = Length(Curve=cir_2)
multiplication_4 = Multiplication(A=len_2, B=dogbone_minium_angle_3)

flip_cornes_boolean_3 = Panel(flip_cornes_boolean_2)
flip_cornes_boolean_4 = Panel(flip_cornes_boolean_2)
curves_to_dogbone_3 = Curve(flatten)
lng = ListLength(List=curves_to_dogbone_3)

curves_for_dogbone = Curve(curves_inside)
cp = ControlPoints(Curve=curves_for_dogbone)  # -> Points, Weights, Knots

disc = Discontinuity(Curve=curves_for_dogbone, Level=1)  # -> Points, Parameters

curves_for_dogbone_2 = Curve(curves_outside)
cp_2 = ControlPoints(Curve=curves_for_dogbone_2)  # -> Points, Weights, Knots

disc_2 = Discontinuity(Curve=curves_for_dogbone_2, Level=1)  # -> Points, Parameters

xy_3 = XYPlane(Origin=disc.Points)
cir_3 = Circle(Plane=xy_3, Radius="0.01")
trim = TrimWithRegion(Curve=cir_3, Region=graft(curves_for_dogbone), Plane=xy_3)  # -> Inside, Outside

filter = StreamFilter(Gate=flip_cornes_boolean_4, Stream0=trim.Outside, Stream1=trim.Inside)

pshift_2 = ShiftPaths(Data=filter, Offset=-1)
len_3 = Length(Curve=pshift_2)

xy_4 = XYPlane(Origin=disc_2.Points)
cir_4 = Circle(Plane=xy_4, Radius="0.01")
trim_2 = TrimWithRegion(Curve=cir_4, Region=graft(curves_for_dogbone_2), Plane=xy_4)  # -> Inside, Outside

filter_2 = StreamFilter(Gate=flip_cornes_boolean_3, Stream0=trim_2.Inside, Stream1=trim_2.Outside)

pshift_3 = ShiftPaths(Data=filter_2, Offset=-1)
len_4 = Length(Curve=pshift_3)

larger = LargerThan(FirstNumber=len_3, SecondNumber=multiplication_3)  # -> LargerThan, OrEqualTo
dogbone_radius_2 = Panel(dogbone_radius)
dispatch_2 = Dispatch(List=disc.Points, DispatchPattern=larger.LargerThan)  # -> ListA, ListB
dispatch_3 = Dispatch(List=pshift_2, DispatchPattern=larger.LargerThan)  # -> ListA, ListB
eval = EvaluateLength(Curve=dispatch_3.ListA, Length="0.5", Normalized=True)  # -> Point, Tangent, Parameter
pt = Point(dispatch_2.ListA)
pln = Plane(dispatch_2.ListA)
pt_2 = Point(eval.Point)
vec2pt = Vector2Pt(PointA=pt_2, PointB=pt, Unitize=False)  # -> Vector, Length

amp = Amplitude(Vector=vec2pt.Vector, Amplitude=dogbone_radius_2)

move = Move(Geometry=pln, Motion=amp)  # -> Geometry, Transform
cir_5 = Circle(Plane=move.Geometry, Radius=dogbone_radius_2)

lng_2 = ListLength(List=cir_5)
larger_2 = LargerThan(FirstNumber=lng_2, SecondNumber="0.01")  # -> LargerThan, OrEqualTo
pshift_4 = ShiftPaths(Data=larger_2.LargerThan, Offset=-1)
ma_2 = MassAddition(Input=pshift_4)  # -> Result, PartialResults
dispatch_4 = Dispatch(List=curves_for_dogbone, DispatchPattern=pshift_4)  # -> ListA, ListB
crv = Curve(dispatch_4.ListB)
smaller = SmallerThan(FirstNumber=ma_2.Result, SecondNumber="0.5")  # -> SmallerThan, OrEqualTo
clean = CleanTree(RemoveNulls=True, RemoveInvalid=True, RemoveEmpty=False, Tree=crv)

crv_2 = Curve(curves_for_dogbone)
graft_2 = GraftTree(Tree=crv_2, IncludeEmptyLists=True, IncludeNullItems=True)
runion_2 = RegionUnion(Curves=[cir_5, graft_2])
pshift_5 = ShiftPaths(Data=runion_2, Offset=-1)
pshift_6 = ShiftPaths(Data=pshift_5, Offset=-1)

filter_3 = StreamFilter(Gate=smaller.SmallerThan, Stream0=pshift_6)
merge = Merge(Data1=filter_3, Data2=clean)
dogboned_inside_curves = Curve(merge)

larger_3 = LargerThan(FirstNumber=len_4, SecondNumber=multiplication_4)  # -> LargerThan, OrEqualTo
dogbone_radius_3 = Panel(dogbone_radius)
dispatch_5 = Dispatch(List=disc_2.Points, DispatchPattern=larger_3.LargerThan)  # -> ListA, ListB
dispatch_6 = Dispatch(List=pshift_3, DispatchPattern=larger_3.LargerThan)  # -> ListA, ListB
eval_2 = EvaluateLength(Curve=dispatch_6.ListA, Length="0.5", Normalized=True)  # -> Point, Tangent, Parameter
pln_2 = Plane(dispatch_5.ListA)
pt_3 = Point(dispatch_5.ListA)
pt_4 = Point(eval_2.Point)
vec2pt_2 = Vector2Pt(PointA=pt_4, PointB=pt_3, Unitize=False)  # -> Vector, Length

amp_2 = Amplitude(Vector=vec2pt_2.Vector, Amplitude=dogbone_radius_3)

move_2 = Move(Geometry=pln_2, Motion=amp_2)  # -> Geometry, Transform
cir_6 = Circle(Plane=move_2.Geometry, Radius=dogbone_radius_3)

crv_3 = Curve(curves_for_dogbone_2)
flip_cornes_boolean_5 = Panel(flip_cornes_boolean_2)
graft_3 = GraftTree(Tree=crv_3, IncludeEmptyLists=True, IncludeNullItems=True)
gate = StreamGate(Stream=[graft_3, cir_6], Gate=flip_cornes_boolean_5)  # -> Target0, Target1
gate_2 = StreamGate(Stream=graft_3, Gate=flip_cornes_boolean_5)  # -> Target0, Target1
gate_3 = StreamGate(Stream=cir_6, Gate=flip_cornes_boolean_5)  # -> Target0, Target1
runion_3 = RegionUnion(Curves=gate.Target1)
rdiff = RegionDifference(CurvesA=gate_2.Target0, CurvesB=gate_3.Target0)
filter_4 = StreamFilter(Gate=flip_cornes_boolean_5, Stream0=rdiff, Stream1=runion_3)
pshift_7 = ShiftPaths(Data=filter_4, Offset=-1)
pshift_8 = ShiftPaths(Data=pshift_7, Offset=-1)

lng_3 = ListLength(List=cir_6)
larger_4 = LargerThan(FirstNumber=lng_3, SecondNumber="0.01")  # -> LargerThan, OrEqualTo
pshift_9 = ShiftPaths(Data=larger_4.LargerThan, Offset=-1)
ma_3 = MassAddition(Input=pshift_9)  # -> Result, PartialResults
dispatch_7 = Dispatch(List=curves_for_dogbone_2, DispatchPattern=pshift_9)  # -> ListA, ListB
crv_4 = Curve(dispatch_7.ListB)
smaller_2 = SmallerThan(FirstNumber=ma_3.Result, SecondNumber="0.5")  # -> SmallerThan, OrEqualTo
clean_2 = CleanTree(RemoveNulls=True, RemoveInvalid=True, RemoveEmpty=False, Tree=crv_4)
filter_5 = StreamFilter(Gate=smaller_2.SmallerThan, Stream0=pshift_8)
merge_2 = Merge(Data1=filter_5, Data2=clean_2)
dogboned_outside_curves = Curve(merge_2)
merge_3 = Merge(Data1=dogboned_inside_curves, Data2=dogboned_outside_curves)
flatten_2 = FlattenTree(Tree=merge_3, Path="{0}")
end_2 = EndPoints(Curve=flatten_2)  # -> Start, End
dup = DuplicateData(Data=graft(flatten_2), Number=lng, Order=True)
flip_2 = FlipMatrix(Data=dup)
crv_cp = CurveClosestPoint(Point=end_2.Start, Curve=graft(curves_to_dogbone_3))  # -> Point, Parameter, Distance
pshift_10 = ShiftPaths(Data=flip_2, Offset=-1)
sort = SortList(Keys=crv_cp.Distance, ValuesA=pshift_10)  # -> Keys, ValuesA
item_2 = ListItem(List=sort.ValuesA, Index=0, Wrap=True)
flatten_3 = FlattenTree(Tree=item_2, Path="{0}")
dogboned_curves = Curve(flatten_3)
dogboned_curves_2 = ClusterOutput(dogboned_curves)

# ==== cluster Automill
breps_to_mill = ClusterInput()
number_of_iso_curve_samples = Panel("10")
connect_toolpath_tolerance_factor = Panel("2")
extra_cut_depth = Panel("0.6")
tolerance = Panel("0.01")
connect_toolpaths_levels = Panel(Toggle(True))
make_horizontal_isocurves = Panel(Toggle(False))
include_surface_edges = Panel(Toggle(False))
use_ballnose_for_3d_milling = Panel(Toggle(False))
millling_bit_diameter = Panel("6")
stepover = Panel("0.05")
overshoot_margin = Panel("0.5")
breps_to_mill_2 = Brep(breps_to_mill)

# ---- group: Detect surfaces for robo fab finishing pass
number_slider = Slider(5, range=0..10)
surfaces_from_brep = Surface()
identifier_surfaces = Surface(<surface referenced from the Rhino model>)
sdivide = DivideSurface(Surface=identifier_surfaces, UCount=number_slider, VCount=number_slider)  # -> Points, Normals, Parameters
graft = GraftTree(Tree=surfaces_from_brep, IncludeEmptyLists=True, IncludeNullItems=True)
srf_cp = SurfaceClosestPoint(Point=sdivide.Points, Surface=graft)  # -> Point, UVPoint, Distance
avr = Average(Input=srf_cp.Distance)
simplify = SimplifyTree(Tree=avr, Front=False)
equals = Equality(FirstNumber=simplify, SecondNumber="0")  # -> Equality, Inequality
dispatch = Dispatch(List=graft, DispatchPattern=equals.Equality)  # -> ListA, ListB
identified_surfaces = Surface(dispatch.ListA)

# ----
multiplication = Multiplication(A=millling_bit_diameter, B=stepover)

bbox = BoundingBox(Content=breps_to_mill_2, Plane=PlaneXY(0, 0, 0))  # -> Box, Box_2
debrep = DeconstructBrep(Brep=bbox.Box)  # -> Faces, Edges, Vertices
item = ListItem(List=debrep.Edges, Index="8", Wrap=True)
pshift = ShiftPaths(Data=item, Offset=-1)
end = EndPoints(Curve=pshift)  # -> Start, End
len = Length(Curve=pshift)
pt = Point(end.End)
pdecon = Deconstruct(Point=pt)  # -> XComponent, YComponent, ZComponent
object_heights = Panel(len)
lovest_points = Panel(pdecon.ZComponent)

stepover_distance = Panel(multiplication)
multiplication_2 = Multiplication(A=millling_bit_diameter, B="0.5")
millling_bit_radius = Panel(multiplication_2)
millling_bit_radius_2 = Panel(millling_bit_radius)
number_slider_2 = Slider(3, range=0..10)
neg = Negative(Value=millling_bit_radius_2)
breps_to_mill_3 = Brep(breps_to_mill_2)
mesh = MeshBrep(
    Brep=breps_to_mill_3,
    Settings={GridMaxCount=0, GridMinCount=16, JaggedSeams=False, MaxEdgeLength=0, MinEdgeLength=0.0001, MinTolerance=0, Refine=True, RefineAngle=0, RelativeTolerance=0.65, SimplePlanes=True, Tolerance=0})
mjoin = MeshJoin(Meshes=flatten(mesh))
Z = UnitZ(Factor=1)
cp = ControlPoints()  # -> Points, Weights, Knots
use_ballnose_for_3d_milling_2 = Panel(use_ballnose_for_3d_milling)
use_ballnose_for_3d_milling_3 = Panel(use_ballnose_for_3d_milling)
connect_toolpaths_levels_booloean = Boolean(connect_toolpaths_levels)
connect_toolpaths_levels_booloean_2 = Boolean(connect_toolpaths_levels_booloean)

debrep_2 = DeconstructBrep(Brep=breps_to_mill_2)  # -> Faces, Edges, Vertices
planar = IsPlanar(Surface=debrep_2.Faces, Interior=True)  # -> Planar, Plane
dispatch_2 = Dispatch(List=debrep_2.Faces, DispatchPattern=planar.Planar)  # -> ListA, ListB
dispatch_3 = Dispatch(List=planar.Plane, DispatchPattern=planar.Planar)  # -> ListA, ListB
curving_surfaces = Surface(dispatch_2.ListB)
planar_surfaces = Surface(dispatch_2.ListA)
Z_2 = UnitZ(Factor=1)
align = AlignPlane(Plane=dispatch_3.ListA, Direction=Z_2)  # -> Plane, Angle
deplane = DeconstructPlane(Plane=align.Plane)  # -> Origin, XAxis, YAxis, ZAxis
angle = Angle(VectorA=deplane.XAxis, VectorB=Z_2)  # -> Angle, Reflex
larger = LargerThan(FirstNumber=angle.Angle, SecondNumber="0.01")  # -> LargerThan, OrEqualTo
pi = Pi(Factor=1)
dispatch_4 = Dispatch(List=planar_surfaces, DispatchPattern=larger.LargerThan)  # -> ListA, ListB
multiplication_3 = Multiplication(A="0.5", B=pi)
dispatch_5 = Dispatch(List=angle.Angle, DispatchPattern=larger.LargerThan)  # -> ListA, ListB
non_vertical_surfaces = Surface(dispatch_4.ListA)

multiplication_4 = Multiplication(A=multiplication_3, B="10000")
multiplication_5 = Multiplication(A=dispatch_5.ListA, B="10000")
int = Integer(multiplication_5)
int_2 = Integer(multiplication_4)

equals_2 = Equality(FirstNumber=int, SecondNumber=int_2)  # -> Equality, Inequality

dispatch_6 = Dispatch(List=non_vertical_surfaces, DispatchPattern=equals_2.Equality)  # -> ListA, ListB

horizontal_surfaces = Surface(dispatch_6.ListA)
breps_to_mill_4 = Brep(breps_to_mill_2)
graft_2 = GraftTree(Tree=breps_to_mill_4, IncludeEmptyLists=True, IncludeNullItems=True)
area = Area(Geometry=horizontal_surfaces)  # -> Area, Centroid
mesh_2 = MeshBrep(
    Brep=graft_2,
    Settings={GridMaxCount=0, GridMinCount=16, JaggedSeams=False, MaxEdgeLength=0, MinEdgeLength=0.0001, MinTolerance=0, Refine=True, RefineAngle=0, RelativeTolerance=0.65, SimplePlanes=True, Tolerance=0})
srf_cp_2 = SurfaceClosestPoint(Point=area.Centroid, Surface=horizontal_surfaces)  # -> Point, UVPoint, Distance
vec2pt = Vector2Pt(PointA=area.Centroid, PointB=srf_cp_2.Point, Unitize=False)  # -> Vector, Length
addition = Addition(A=srf_cp_2.Distance, B="0.1")
amp = Amplitude(Vector=vec2pt.Vector, Amplitude=addition)
move = Move(Geometry=area.Centroid, Motion=amp)  # -> Geometry, Transform
meshcp = MeshClosestPoint(Point=move.Geometry, Mesh=mesh_2)  # -> Point, Index, Parameter
meval = MeshEval(Mesh=mesh_2, Parameter=meshcp.Parameter)  # -> Point, Normal, Colour
Z_3 = UnitZ(Factor=1)
angle_2 = Angle(VectorA=meval.Normal, VectorB=Z_3)  # -> Angle, Reflex
larger_2 = LargerThan(FirstNumber=angle_2.Angle, SecondNumber=multiplication_3)  # -> LargerThan, OrEqualTo
dispatch_7 = Dispatch(List=horizontal_surfaces, DispatchPattern=larger_2.LargerThan)  # -> ListA, ListB
upward_pointing_surfaces = Surface(dispatch_7.ListB)

downward_pointing_surfaces = Surface(dispatch_7.ListA)

upward_pointing_surfaces_2 = Surface(upward_pointing_surfaces)
planar_2 = IsPlanar(Surface=upward_pointing_surfaces_2, Interior=True)  # -> Planar, Plane
deplane_2 = DeconstructPlane(Plane=planar_2.Plane)  # -> Origin, XAxis, YAxis, ZAxis
pdecon_2 = Deconstruct(Point=deplane_2.Origin)  # -> XComponent, YComponent, ZComponent
multiplication_6 = Multiplication(A=pdecon_2.ZComponent, B="100")
int_3 = Integer(multiplication_6)
equals_3 = Equality(FirstNumber=int_3, SecondNumber="0")  # -> Equality, Inequality
dispatch_8 = Dispatch(List=upward_pointing_surfaces_2, DispatchPattern=equals_3.Equality)  # -> ListA, ListB
lower_surfaces = Surface(dispatch_8.ListB)

slanted_surfaces = Surface(dispatch_6.ListB)
curving_surfaces_2 = Surface(curving_surfaces)
merge = Merge(Data1=flatten(slanted_surfaces), Data2=flatten(curving_surfaces_2))

tolerance_2 = Panel(tolerance)
lovest_points_2 = Panel(lovest_points)
breps_to_mill_5 = Brep(breps_to_mill_2)
non_vertical_surfaces_2 = Surface(non_vertical_surfaces)
custom_mesh_settings = SettingsCustom(
    StitchSeams=True,
    SimplePlanes=False,
    Refine=True,
    MinCount=16,
    MaxCount=400,
    AspectRatio=20,
    MaxDistance=tolerance_2,
    MaxAngle=20,
    MinEdge=0,
    MaxEdge=0)
smooth = SettingsQuality()
mesh_3 = MeshBrep(Brep=breps_to_mill_5, Settings=smooth)
mesh_4 = MeshBrep(Brep=breps_to_mill_5, Settings=custom_mesh_settings)
meshes_from_breps = Mesh(mesh_4)
meshes_from_breps_2 = Mesh(mesh_3)
xy = XYPlane(Origin=Point(0, 0, 0))
xy_2 = XYPlane(Origin=Point(0, 0, 0))
abs = Absolute(Value=lovest_points_2)
mshadow = MeshShadow(Mesh=meshes_from_breps_2, Light=Vector(0, 0, -1), Plane=xy)
mshadow_2 = MeshShadow(Mesh=meshes_from_breps, Light=Vector(0, 0, -1), Plane=xy_2)
join = JoinCurves(Curves=mshadow, Preserve=False)
join_2 = JoinCurves(Curves=mshadow_2, Preserve=False)
area_2 = Area(Geometry=join)  # -> Area, Centroid
area_3 = Area(Geometry=join_2)  # -> Area, Centroid
smaller = SmallerThan(FirstNumber=area_3.Area, SecondNumber=area_2.Area)  # -> SmallerThan, OrEqualTo
weave = Weave(Pattern=smaller.SmallerThan, Stream0=join_2, Stream1=join, NullGaps=False)
graft_3 = GraftTree(Tree=abs, IncludeEmptyLists=True, IncludeNullItems=True)
extra_cut_depth_2 = Panel(extra_cut_depth)

mshadow_3 = MeshShadow(Mesh=meshes_from_breps, Light=Vector(0, 0, -1), Plane=xy_2)
ma = MassAddition(Input=area_2.Area)  # -> Result, PartialResults
ma_2 = MassAddition(Input=area_3.Area)  # -> Result, PartialResults
smaller_2 = SmallerThan(FirstNumber=ma_2.Result, SecondNumber=ma.Result)  # -> SmallerThan, OrEqualTo
simplify_2 = SimplifyTree(Tree=smaller_2.SmallerThan, Front=False)
simplify_3 = SimplifyTree(Tree=weave, Front=False)
weave_2 = Weave(Pattern=simplify_2, Stream0=graft(meshes_from_breps), Stream1=graft(meshes_from_breps_2), NullGaps=False)
flatten = FlattenTree(Tree=weave_2, Path="{0}")
mjoin_2 = MeshJoin(Meshes=flatten)
simplify_4 = SimplifyTree(Tree=graft_3, Front=False)

master_shadow_curve = Curve(simplify_3)
lng = ListLength(List=master_shadow_curve)
pshift_2 = ShiftPaths(Data=lng, Offset=-1)
pshift_3 = ShiftPaths(Data=pshift_2, Offset=-1)
dup = DuplicateData(Data=simplify_4, Number=lng, Order=True)
redpline = Reduce(Polyline=master_shadow_curve, Tolerance=tolerance_2)  # -> Polyline, Reduction
cut_depths = Panel(dup)
flatten_2 = FlattenTree(Tree=redpline.Polyline, Path="{0}")
addition_2 = Addition(A=cut_depths, B=extra_cut_depth_2)
flatten_3 = FlattenTree(Tree=addition_2, Path="{0}")
item_2 = ListItem(List=cut_depths, Index=0, Wrap=True)
cut_depths_with_margin = Panel(flatten_3)
null = NullItem(Item=item_2)  # -> NullFlags, InvalidFlags, Description
cutout_curves = Curve(flatten_2)
filter = StreamFilter(Gate=null.NullFlags, Stream0=cut_depths_with_margin, Stream1=cut_depths)

joined_mesh_mesh_from_breps = Mesh(mjoin_2)
joined_mesh_mesh_from_breps_2 = Mesh(joined_mesh_mesh_from_breps)

# ---- group: Surface isocurve extraction
joined_mesh_mesh_from_breps_3 = Mesh(joined_mesh_mesh_from_breps_2)
number_of_iso_curve_samples_2 = Panel(number_of_iso_curve_samples)
surfaces_for_3d_mill = Surface(reparameterize(merge))
make_horizontal_isocurves_2 = Panel(make_horizontal_isocurves)
include_surface_edges_boolean = Panel(include_surface_edges)
untrim = Untrim(Surface=surfaces_for_3d_mill)
surfaces_for_isocurve_extraction = Surface(untrim)
panel = Panel(number_of_iso_curve_samples_2)
subtraction = Subtraction(A="1", B="0.01")
subtraction_2 = Subtraction(A=subtraction, B="0.01")
subtraction_3 = Subtraction(A=panel, B="1")
division = Division(A=subtraction_2, B=subtraction_3)
series = Series(Start="0.01", Step=division, Count=panel)
pt_2 = ConstructPoint(XCoordinate=series, YCoordinate=series, ZCoordinate=0)
iso = IsoCurve(Surface=surfaces_for_isocurve_extraction, UVPoint=graft(pt_2))  # -> UIsocurve, VIsocurve
pshift_4 = ShiftPaths(Data=iso.VIsocurve, Offset=-1)
pshift_5 = ShiftPaths(Data=iso.UIsocurve, Offset=-1)
flip = FlipMatrix(Data=pshift_4)
flip_2 = FlipMatrix(Data=pshift_5)
bbox_2 = BoundingBox(Content=flip_2, Plane=PlaneXY(0, 0, 0))  # -> Box, Box_2
bbox_3 = BoundingBox(Content=flip, Plane=PlaneXY(0, 0, 0))  # -> Box, Box_2
debox = DeconstructBox(Box=bbox_2.Box)  # -> Plane, X, Y, Z
debox_2 = DeconstructBox(Box=bbox_3.Box)  # -> Plane, X, Y, Z
dedomain = DeconstructDomain(Domain=debox.Z)  # -> Start, End
dedomain_2 = DeconstructDomain(Domain=debox_2.Z)  # -> Start, End
pt_3 = ConstructPoint(XCoordinate=0, YCoordinate=0, ZCoordinate=dedomain.End)
pt_4 = ConstructPoint(XCoordinate=0, YCoordinate=0, ZCoordinate=dedomain.Start)
pt_5 = ConstructPoint(XCoordinate=0, YCoordinate=0, ZCoordinate=dedomain_2.End)
pt_6 = ConstructPoint(XCoordinate=0, YCoordinate=0, ZCoordinate=dedomain_2.Start)
ln = Line(StartPoint=pt_4, EndPoint=pt_3)
ln_2 = Line(StartPoint=pt_6, EndPoint=pt_5)
len_2 = Length(Curve=ln)
len_3 = Length(Curve=ln_2)
avr_2 = Average(Input=len_2)
avr_3 = Average(Input=len_3)
larger_3 = LargerThan(FirstNumber=avr_2, SecondNumber=avr_3)  # -> LargerThan, OrEqualTo
make_horizontal_isocurves_boolean = Boolean(make_horizontal_isocurves_2)
not = GateNot(A=larger_3.LargerThan)
filter_2 = StreamFilter(Gate=make_horizontal_isocurves_boolean, Stream0=larger_3.LargerThan, Stream1=not)
u_or_v_slice_booleans = Panel(filter_2)
weave_3 = Weave(Pattern=u_or_v_slice_booleans, Stream0=flip_2, Stream1=flip, NullGaps=False)
crv = Curve(weave_3)
len_4 = Length(Curve=crv)
avr_4 = Average(Input=len_4)
simplify_5 = SimplifyTree(Tree=avr_4, Front=False)
base_lenghts_for_stepover_distance = Panel(simplify_5)
stepover_distance_2 = Panel(stepover_distance)
division_2 = Division(A=base_lenghts_for_stepover_distance, B=stepover_distance_2)
round = Round(Number=division_2)  # -> Nearest, Floor, Ceiling
number_of_iscourves = Panel(round.Ceiling)
panel_2 = Panel(number_of_iscourves)
subtraction_4 = Subtraction(A=panel_2, B="1")
division_3 = Division(A="1", B=subtraction_4)
series_2 = Series(Start=0, Step=division_3, Count=panel_2)
pt_7 = ConstructPoint(XCoordinate=series_2, YCoordinate=series_2, ZCoordinate=0)
surfaces_for_3d_mill_2 = Surface(reparameterize(surfaces_for_3d_mill))
pshift_6 = ShiftPaths(Data=pt_7, Offset=-1)
iso_2 = IsoCurve(Surface=graft(surfaces_for_3d_mill_2), UVPoint=pshift_6)  # -> UIsocurve, VIsocurve
u_or_v_slice_booleans_2 = Panel(u_or_v_slice_booleans)
edges = BrepEdges(Brep=surfaces_for_3d_mill_2)  # -> Naked, Interior, NonManifold
pshift_7 = ShiftPaths(Data=iso_2.UIsocurve, Offset=-1)
pshift_8 = ShiftPaths(Data=iso_2.VIsocurve, Offset=-1)
crv_2 = Curve([edges.Naked, edges.Interior])
simplify_6 = SimplifyTree(Tree=u_or_v_slice_booleans_2, Front=False)
weave_4 = Weave(Pattern=simplify_6, Stream0=pshift_8, Stream1=pshift_7, NullGaps=False)
merge_2 = Merge(Data1=crv_2, Data2=weave_4)
include_surface_edges_boolean_2 = Panel(include_surface_edges_boolean)
filter_3 = StreamFilter(Gate=include_surface_edges_boolean_2, Stream0=weave_4, Stream1=merge_2)
toolpaths_from_isocurves = Curve(filter_3)

# ----
cutout_curves_2 = Curve(cutout_curves)
cutout_depths = Number(filter)
cutout_depths_2 = ClusterOutput(cutout_depths)
cutout_curves_3 = ClusterOutput(cutout_curves_2)

# ---- group: Remove undercut points
toolpaths_from_isocurves_2 = Curve(toolpaths_from_isocurves)
surfaces_for_3d_mill_3 = Surface(reparameterize(surfaces_for_3d_mill))
tolerance_3 = Panel(tolerance)
topoly = CurveToPolyline(Curve=toolpaths_from_isocurves_2, ToleranceDistance=tolerance_3, ToleranceAngle=0)  # -> Polyline, Segments
surfaces_for_3d_mill_4 = Surface(reparameterize(surfaces_for_3d_mill_3))
cp_2 = ControlPoints(Curve=topoly.Polyline)  # -> Points, Weights, Knots
pshift_9 = ShiftPaths(Data=cp_2.Points, Offset=-1)
srf_cp_3 = SurfaceClosestPoint(Point=pshift_9, Surface=graft(surfaces_for_3d_mill_4))  # -> Point, UVPoint, Distance
evalsrf = EvaluateSurface(Surface=graft(surfaces_for_3d_mill_4), Point=srf_cp_3.UVPoint)  # -> Point, Normal, Frame
unflatten = UnflattenTree(Tree=evalsrf.Normal, Guide=cp_2.Points)
unflatten_2 = UnflattenTree(Tree=evalsrf.Point, Guide=cp_2.Points)
amp_2 = Amplitude(Vector=unflatten, Amplitude="1")
move_2 = Move(Geometry=unflatten_2, Motion=amp_2)  # -> Geometry, Transform
pt_8 = Point(unflatten_2)
neg_2 = Negative(Value="0.001")
Z_4 = UnitZ(Factor=neg_2)
move_3 = Move(Geometry=move_2.Geometry, Motion=Z_4)  # -> Geometry, Transform
pt_9 = Point(unflatten_2)
pdecon_3 = Deconstruct(Point=move_3.Geometry)  # -> XComponent, YComponent, ZComponent
pdecon_4 = Deconstruct(Point=pt_8)  # -> XComponent, YComponent, ZComponent
smaller_3 = SmallerThan(FirstNumber=pdecon_3.ZComponent, SecondNumber=pdecon_4.ZComponent)  # -> SmallerThan, OrEqualTo
dispatch_9 = Dispatch(List=pt_9, DispatchPattern=smaller_3.OrEqualTo)  # -> ListA, ListB
dispatch_10 = Dispatch(List=amp_2, DispatchPattern=smaller_3.OrEqualTo)  # -> ListA, ListB
undercut_free_points = Point(dispatch_9.ListB)
point_normals = Vector(dispatch_10.ListB)

# ----
gate = StreamGate(Stream=undercut_free_points, Gate=use_ballnose_for_3d_milling_2)  # -> Target0, Target1
gate_2 = StreamGate(Stream=point_normals, Gate=use_ballnose_for_3d_milling_2)  # -> Target0, Target1

# ---- group: Offset compenstate with end mill radius
millling_bit_radius_3 = Panel(millling_bit_radius)
undercut_free_points_2 = Point(gate.Target0)
point_normals_2 = Vector(gate_2.Target0)
move_4 = Move(Geometry=undercut_free_points_2, Motion=point_normals_2)  # -> Geometry, Transform
xy_3 = XYPlane(Origin=Point(0, 0, 0))
project = Project(Geometry=move_4.Geometry, Plane=xy_3)  # -> Geometry, Transform
project_2 = Project(Geometry=undercut_free_points_2, Plane=xy_3)  # -> Geometry, Transform
ln_3 = Line(StartPoint=project_2.Geometry, EndPoint=project.Geometry)
len_5 = Length(Curve=ln_3)
vec2pt_2 = Vector2Pt(PointA=project_2.Geometry, PointB=project.Geometry, Unitize=False)  # -> Vector, Length
smaller_4 = SmallerThan(FirstNumber=len_5, SecondNumber="0.001")  # -> SmallerThan, OrEqualTo
millling_bit_radius_4 = Panel(millling_bit_radius_3)
dispatch_11 = Dispatch(List=undercut_free_points_2, DispatchPattern=smaller_4.SmallerThan)  # -> ListA, ListB
dispatch_12 = Dispatch(List=vec2pt_2.Vector, DispatchPattern=smaller_4.SmallerThan)  # -> ListA, ListB
top_points = Point(dispatch_11.ListA)
side_points = Point(dispatch_11.ListB)
amp_3 = Amplitude(Vector=dispatch_12.ListB, Amplitude=millling_bit_radius_4)
move_5 = Move(Geometry=side_points, Motion=amp_3)  # -> Geometry, Transform
end_mill_compensated_points = Point(move_5.Geometry)

# ----
end_mill_compensated_points_2 = Point(end_mill_compensated_points)

lower_surfaces_2 = Surface(dispatch_8.ListB)
edges_2 = BrepEdges(Brep=lower_surfaces_2)  # -> Naked, Interior, NonManifold
join_3 = JoinCurves(Curves=edges_2.Naked, Preserve=False)
pshift_10 = ShiftPaths(Data=join_3, Offset=-1)
pshift_11 = ShiftPaths(Data=pshift_10, Offset=-1)
clean = CleanTree(RemoveNulls=True, RemoveInvalid=True, RemoveEmpty=Toggle(True), Tree=pshift_11)
pocket_curves = Curve(clean)
xy_4 = XYPlane(Origin=Point(0, 0, 0))

explode = Explode(Curve=pocket_curves, Recursive=True)  # -> Segments, Vertices
extended_pocket_curves = Curve(reparameterize(pocket_curves))
simplify_7 = SimplifyTree(Tree=explode.Segments, Front=False)
offset = Offset(Curve=simplify_7, Distance=neg, Plane=PlaneXY(0, 0, 0), Corners=1)
pshift_12 = ShiftPaths(Data=offset, Offset=-1)
eval = EvaluateLength(Curve=pshift_12, Length=Slider(0.5, range=0..1), Normalized=True)  # -> Point, Tangent, Parameter
end_2 = EndPoints(Curve=pshift_12)  # -> Start, End
simplify_8 = SimplifyTree(Tree=eval.Point, Front=False)
meshray = MeshRay(Mesh=mjoin, Point=simplify_8, Direction=Z)  # -> Point, Hit
dispatch_13 = Dispatch(List=pshift_12, DispatchPattern=meshray.Hit)  # -> ListA, ListB
dispatch_14 = Dispatch(List=simplify_7, DispatchPattern=meshray.Hit)  # -> ListA, ListB
crv_3 = Curve(dispatch_13.ListB)
crv_4 = Curve(simplify_7)
crv_5 = Curve(dispatch_13.ListA)
crv_6 = Curve(dispatch_14.ListA)
crv_7 = Curve(dispatch_14.ListB)
simplify_9 = SimplifyTree(Tree=crv_3, Front=False)
simplify_10 = SimplifyTree(Tree=crv_7, Front=False)
simplify_11 = SimplifyTree(Tree=crv_6, Front=False)
end_3 = EndPoints(Curve=simplify_10)  # -> Start, End
end_4 = EndPoints(Curve=simplify_9)  # -> Start, End
ln_4 = Line(StartPoint=end_4.Start, EndPoint=end_3.Start)
ln_5 = Line(StartPoint=end_4.End, EndPoint=end_3.End)
join_4 = JoinCurves(Curves=flatten([ln_4, ln_5, simplify_11, crv_3]), Preserve=False)
cls = Closed(Curve=join_4)  # -> Closed, Periodic

end_5 = EndPoints(Curve=extended_pocket_curves)  # -> Start, End
pdecon_5 = Deconstruct(Point=end_5.Start)  # -> XComponent, YComponent, ZComponent
abs_2 = Absolute(Value=pdecon_5.ZComponent)
project_3 = Project(Geometry=extended_pocket_curves, Plane=xy_4)  # -> Geometry, Transform
flatten_4 = FlattenTree(Tree=project_3.Geometry, Path="{0}")
clean_2 = CleanTree(RemoveNulls=True, RemoveInvalid=True, RemoveEmpty=False, Tree=flatten_4)
pocket_curves_2 = Curve(clean_2)

clean_3 = CleanTree(RemoveNulls=True, RemoveInvalid=True, RemoveEmpty=False, Tree=abs_2)

pocket_depths = Panel(clean_3)

flatten_5 = FlattenTree(Tree=pocket_depths, Path="{0}")
pocket_depths_2 = Panel(flatten_5)
pocket_curves_3 = Curve(pocket_curves_2)
pocket_depths_3 = Number(pocket_depths_2)
pocket_curves_4 = ClusterOutput(pocket_curves_3)
pocket_depths_4 = ClusterOutput(pocket_depths_3)

# ---- group: Offset compensate with ball nose radius
undercut_free_points_3 = Point(gate.Target1)
millling_bit_radius_5 = Panel(millling_bit_radius)
point_normals_3 = Vector(gate_2.Target1)
amp_4 = Amplitude(Vector=point_normals_3, Amplitude=millling_bit_radius_5)
move_6 = Move(Geometry=undercut_free_points_3, Motion=amp_4)  # -> Geometry, Transform
neg_3 = Negative(Value=millling_bit_radius_5)
Z_5 = UnitZ(Factor=neg_3)

# ----
move_7 = Move(Geometry=move_6.Geometry, Motion=Z_5)  # -> Geometry, Transform

# ---- group: Offset compensate with ball nose radius (continued)
ball_nose_compensated_points = Point(move_7.Geometry)

# ----
ball_nose_compensated_points_2 = Point(ball_nose_compensated_points)
filter_4 = StreamFilter(Gate=use_ballnose_for_3d_milling_3, Stream0=end_mill_compensated_points_2, Stream1=ball_nose_compensated_points_2)

# ---- group: Overshoot extend toolpaths
toolpath_points_for_overshoot = Point(filter_4)
overshoot_margin_2 = Panel(overshoot_margin)
pline = PolyLine(Vertices=toolpath_points_for_overshoot, Closed=False)
ext = ExtendCurve(Curve=pline, Type=0, Start=overshoot_margin_2, End=overshoot_margin_2)
extended_toolpaths = Curve(ext)

# ---- group: Collision correct toolpaths
millling_bit_radius_6 = Panel(millling_bit_radius)
tolerance_4 = Panel(tolerance)
toolpath_subdivide_factor = Panel("0.2")
meshes_from_breps_3 = Mesh(joined_mesh_mesh_from_breps_3)
make_horizontal_isocurves_boolean_2 = Boolean(make_horizontal_isocurves_2)
use_ballnose_for_3d_milling_4 = Panel(use_ballnose_for_3d_milling)
collsion_mesh_tolerance_factor = Panel("0.5")
object_heights_2 = Panel(object_heights)
extended_toolpaths_2 = Curve(extended_toolpaths)
mjoin_3 = MeshJoin(Meshes=flatten(meshes_from_breps_3))
division_4 = Division(A=tolerance_4, B="3")
sort = SortList(Keys=object_heights_2)  # -> Keys, ValuesA
xy_5 = XYPlane(Origin=Point(0, 0, 0))
rev = ReverseList(List=sort.Keys)
multiplication_7 = Multiplication(A=millling_bit_radius_6, B=collsion_mesh_tolerance_factor)
item_3 = ListItem(List=rev, Index=0, Wrap=True)
panel_3 = Panel("0.01")
Z_6 = UnitZ(Factor=item_3)
multiplication_8 = Multiplication(A=tolerance_4, B="3")
custom_mesh_settings_2 = SettingsCustom(
    StitchSeams=True,
    SimplePlanes=False,
    Refine=True,
    MinCount=16,
    MaxCount=400,
    AspectRatio=20,
    MaxDistance=0,
    MaxAngle=20,
    MinEdge=multiplication_7,
    MaxEdge=0)
Z_7 = UnitZ(Factor=multiplication_8)
xy_6 = XYPlane(Origin=Point(0, 0, 0))
move_8 = Move(Geometry=extended_toolpaths_2, Motion=Z_7)  # -> Geometry, Transform
multiplication_9 = Multiplication(A=millling_bit_radius_6, B=toolpath_subdivide_factor)
divide_curve_even_lenght = DivideCurveEvenLenght(crv=move_8.Geometry, B=multiplication_9)
use_ballnose_for_3d_milling_5 = Panel(use_ballnose_for_3d_milling_4)
xy_7 = XYPlane(Origin=Point(0, 0, 0))
xy_8 = XYPlane(Origin=divide_curve_even_lenght)
mesh_from_breps = Mesh(mjoin_3)
neg_4 = Negative(Value=multiplication_8)
Z_8 = UnitZ(Factor=neg_4)
tolerance_5 = Panel(tolerance_4)

# ----
multiplication_10 = Multiplication(A=tolerance_4)
subtraction_5 = Subtraction(A=millling_bit_radius_6, B=division_4)
make_horizontal_isocurves_boolean_3 = Boolean(make_horizontal_isocurves_boolean_2)
make_horizontal_isocurves_boolean_4 = Boolean(make_horizontal_isocurves_boolean_2)

# ---- group: Collision correct toolpaths (continued)
cir = Circle(Plane=xy_5, Radius=subtraction_5)
extr = Extrude(Base=cir, Direction=Z_6)
cap = CapHoles(Brep=extr)
sph = Sphere(Base=xy_6, Radius=subtraction_5)
sunion = SolidUnion(Breps=flatten([sph, cap]))
Z_9 = UnitZ(Factor=subtraction_5)
move_9 = Move(Geometry=sunion, Motion=Z_9)  # -> Geometry, Transform
filter_5 = StreamFilter(Gate=use_ballnose_for_3d_milling_5, Stream0=extr, Stream1=move_9.Geometry)
mesh_5 = MeshBrep(Brep=filter_5, Settings=custom_mesh_settings_2)
collison_detection_mesh = Mesh(mesh_5)
orient = Orient(Geometry=collison_detection_mesh, Source=xy_7, Target=xy_8)  # -> Geometry, Transform
colom = CollisionOneMany(Collider=orient.Geometry, Obstacles=mesh_from_breps)  # -> Collision, Index
dispatch_15 = Dispatch(List=divide_curve_even_lenght, DispatchPattern=colom.Collision)  # -> ListA, ListB
move_10 = Move(Geometry=dispatch_15.ListB, Motion=Z_8)  # -> Geometry, Transform

# ----
gate_3 = StreamGate(Stream=move_10.Geometry, Gate=make_horizontal_isocurves_boolean_3)  # -> Target0, Target1

# ---- group: Fix colliding horizontal toolpaths
pline_2 = PolyLine(Vertices=gate_3.Target1, Closed=False)
explode_2 = Explode(Curve=pline_2, Recursive=True)  # -> Segments, Vertices
extended_toolpaths_3 = Curve(extended_toolpaths)
simplify_12 = SimplifyTree(Tree=explode_2.Segments, Front=False)
eval_2 = EvaluateLength(Curve=simplify_12, Length="0.5", Normalized=True)  # -> Point, Tangent, Parameter
pshift_13 = ShiftPaths(Data=extended_toolpaths_3, Offset=-1)
crv_cp = CurveClosestPoint(Point=eval_2.Point, Curve=extended_toolpaths_3)  # -> Point, Parameter, Distance
pshift_14 = ShiftPaths(Data=crv_cp.Distance, Offset=-1)
larger_4 = LargerThan(FirstNumber=crv_cp.Distance, SecondNumber="0.1")  # -> LargerThan, OrEqualTo
dispatch_16 = Dispatch(List=simplify_12, DispatchPattern=larger_4.LargerThan)  # -> ListA, ListB
crv_8 = Curve(dispatch_16.ListB)
join_5 = JoinCurves(Curves=crv_8, Preserve=True)

# ---- group: Collision correct toolpaths (continued)
pline_3 = PolyLine(Vertices=gate_3.Target0, Closed=False)

# ----
filter_6 = StreamFilter(Gate=make_horizontal_isocurves_boolean_4, Stream0=pline_3, Stream1=join_5)

# ---- group: Collision correct toolpaths (continued)
redpline_2 = Reduce(Polyline=filter_6, Tolerance=tolerance_5)  # -> Polyline, Reduction
collision_corrected_toolpaths = Curve(redpline_2.Polyline)

# ----
gate_4 = StreamGate(Stream=collision_corrected_toolpaths, Gate=connect_toolpaths_levels_booloean)  # -> Target0, Target1
collision_corrected_toolpaths_2 = Curve(gate_4.Target0)

# ---- group: Weave toolpaths
toolpaths_to_weave = Curve(gate_4.Target1)
simplify_13 = SimplifyTree(Tree=toolpaths_to_weave, Front=False)
flatten_6 = FlattenTree(Tree=simplify_13, Path="{0}")

# ----
pshift_15 = ShiftPaths(Data=simplify_13, Offset=-1)
flatten_7 = FlattenTree(Tree=pshift_15, Path="{0}")
item_4 = ListItem(List=flatten_7, Index=0, Wrap=True)
null_2 = NullItem(Item=item_4)  # -> NullFlags, InvalidFlags, Description
filter_7 = StreamFilter(Gate=null_2.NullFlags, Stream0=pshift_15, Stream1=flatten_6)

# ---- group: Weave toolpaths (continued)
dispatch_17 = Dispatch(List=filter_7, DispatchPattern=[True, False])  # -> ListA, ListB
flip_3 = FlipCurve(Curve=dispatch_17.ListB)  # -> Curve, Flag
weave_5 = Weave(Pattern=[0, 1], Stream0=dispatch_17.ListA, Stream1=flip_3.Curve, NullGaps=False)
simplify_14 = SimplifyTree(Tree=weave_5, Front=False)
woven_toolpaths = Curve(simplify_14)

# ----
toolpaths_to_connect = Curve(woven_toolpaths)
stepover_distance_3 = Panel(stepover_distance)
connect_toolpath_tolerance_factor_2 = Panel(connect_toolpath_tolerance_factor)
end_6 = EndPoints(Curve=toolpaths_to_connect)  # -> Start, End
shift = ShiftList(List=end_6.Start, Shift="1", Wrap=True)
multiplication_11 = Multiplication(A=stepover_distance_3, B=connect_toolpath_tolerance_factor_2)
ln_6 = Line(StartPoint=shift, EndPoint=end_6.End)
len_6 = Length(Curve=ln_6)
larger_5 = LargerThan(FirstNumber=len_6, SecondNumber=multiplication_11)  # -> LargerThan, OrEqualTo
lng_2 = ListLength(List=toolpaths_to_connect)
series_3 = Series(Start=0, Step=1, Count=lng_2)
dispatch_18 = Dispatch(List=series_3, DispatchPattern=larger_5.LargerThan)  # -> ListA, ListB
replace = ReplaceItems(List=ln_6, Indices=dispatch_18.ListA, Wrap=False)
weave_6 = Weave(Pattern=[0, 1], Stream0=toolpaths_to_connect, Stream1=replace, NullGaps=False)
clean_4 = CleanTree(RemoveNulls=True, RemoveInvalid=True, RemoveEmpty=False, Tree=weave_6)

join_6 = JoinCurves(Curves=clean_4, Preserve=False)

simplify_15 = SimplifyTree(Tree=join_6, Front=False)
connected_toolpaths = Curve(simplify_15)

connected_toolpaths_2 = Curve(connected_toolpaths)
filter_8 = StreamFilter(Gate=connect_toolpaths_levels_booloean_2, Stream0=collision_corrected_toolpaths_2, Stream1=connected_toolpaths_2)
_3d_line_engrave_toolpaths = Curve(filter_8)
_3d_line_engrave_curves = Curve(flatten(_3d_line_engrave_toolpaths))
len_7 = Length(Curve=_3d_line_engrave_curves)
ma_3 = MassAddition(Input=len_7)  # -> Result, PartialResults
panel_4 = Panel(ma_3.Result)
_3d_line_engrave_curves_2 = ClusterOutput(_3d_line_engrave_curves)

# ==== cluster GlowingCurves
curves_for_glowpipe_preview = ClusterInput()
pipe_color = ClusterInput()
number_slider = Slider(0.2, range=0..10)
corner_fill_factor = Slider(0.05, range=0..1)
number_slider_2 = Slider(6, range=0..10)
number_slider_3 = Slider(0.3, range=0..10)
number_slider_4 = Slider(4.5, range=0..10)
number_slider_5 = Slider(1.5, range=0..10)
number_slider_6 = Slider(1.3, range=0..10)
curves_for_glowpipe_preview_2 = Curve(curves_for_glowpipe_preview)
default_color = ColourSwatch(SwatchColor=RGB(31, 229, 255))
xy = XYPlane(Origin=Point(0, 0, 0))
polygon = Polygon(Plane=xy, Radius=number_slider_3, Segments=number_slider_2, FilletRadius=0)  # -> Polygon, Length
col = Colour(pipe_color)
topoly = CurveToPolyline(Curve=curves_for_glowpipe_preview_2, ToleranceDistance=number_slider, ToleranceAngle=0)  # -> Polyline, Segments
explode = Explode(Curve=polygon.Polygon, Recursive=True)  # -> Segments, Vertices
flatten = FlattenTree(Tree=col, Path="{0}")
redpline = Reduce(Polyline=topoly.Polyline, Tolerance=number_slider)  # -> Polyline, Reduction
multiplication = Multiplication(A=number_slider_3, B=number_slider_4)
multiplication_2 = Multiplication(A=multiplication, B=number_slider_5)
multiplication_3 = Multiplication(A=multiplication_2, B=number_slider_6)
item = ListItem(List=explode.Segments, Index=1, Wrap=True)
explode_2 = Explode(Curve=redpline.Polyline, Recursive=True)  # -> Segments, Vertices
item_2 = ListItem(List=flatten, Index=0, Wrap=True)
Z = UnitZ(Factor=Slider(1, range=0..100))
multiplication_4 = Multiplication(A=multiplication_2, B=corner_fill_factor)
multiplication_5 = Multiplication(A=multiplication, B=corner_fill_factor)
multiplication_6 = Multiplication(A=multiplication_3, B=corner_fill_factor)
flatten_2 = FlattenTree(Tree=explode_2.Segments, Path="{0}")
null = NullItem(Item=item_2)  # -> NullFlags, InvalidFlags, Description
extr = Extrude(Base=item, Direction=Z)
neg = Negative(Value=multiplication_5)
neg_2 = Negative(Value=multiplication_4)
neg_3 = Negative(Value=multiplication_6)
filter = StreamFilter(Gate=null.NullFlags, Stream0=col, Stream1=default_color)
arrpolar = PolarArray(Geometry=extr, Plane=xy, Count=number_slider_2, Angle=6.283185307)  # -> Geometry, Transform
len = Length(Curve=flatten_2)
pframe = PerpFrame(Curve=flatten_2, Parameter="0")
Z_2 = UnitZ(Factor=multiplication_4)
Z_3 = UnitZ(Factor=multiplication_6)
Z_4 = UnitZ(Factor=multiplication_5)
join = BrepJoin(Breps=arrpolar.Geometry)  # -> Breps, Closed
curve_lengths = Panel(len)
curve_planes = Plane(pframe)
multiplication_7 = Multiplication(A=multiplication_5, B="2")
multiplication_8 = Multiplication(A=multiplication_4, B="2")
multiplication_9 = Multiplication(A=multiplication_6, B="2")
move = Move(Geometry=xy, Motion=Z_4)  # -> Geometry, Transform
move_2 = Move(Geometry=move.Geometry, Motion=Z_2)  # -> Geometry, Transform
move_3 = Move(Geometry=move_2.Geometry, Motion=Z_3)  # -> Geometry, Transform
mesh = MeshBrep(
    Brep=join.Breps,
    Settings={GridMaxCount=0, GridMinCount=16, JaggedSeams=False, MaxEdgeLength=0, MinEdgeLength=0.0001, MinTolerance=0, Refine=True, RefineAngle=0, RelativeTolerance=0.65, SimplePlanes=True, Tolerance=0})
addition = Addition(A=curve_lengths, B=multiplication_7)
addition_2 = Addition(A=addition, B=multiplication_8)
addition_3 = Addition(A=addition_2, B=multiplication_9)
scale_nu = ScaleNU(Geometry=mesh, Plane=xy, ScaleX=number_slider_4, ScaleY=number_slider_4, ScaleZ=1)  # -> Geometry, Transform
scale_nu_2 = ScaleNU(Geometry=scale_nu.Geometry, Plane=xy, ScaleX=number_slider_5, ScaleY=number_slider_5, ScaleZ=1)  # -> Geometry, Transform
scale_nu_3 = ScaleNU(Geometry=scale_nu_2.Geometry, Plane=xy, ScaleX=number_slider_6, ScaleY=number_slider_6, ScaleZ=1)  # -> Geometry, Transform
flatten_3 = FlattenTree(Tree=scale_nu.Geometry, Path="{0}")
flatten_4 = FlattenTree(Tree=scale_nu_2.Geometry, Path="{0}")
flatten_5 = FlattenTree(Tree=mesh, Path="{0}")
flatten_6 = FlattenTree(Tree=move.Geometry, Path="{0}")
flatten_7 = FlattenTree(Tree=move_2.Geometry, Path="{0}")
flatten_8 = FlattenTree(Tree=scale_nu_3.Geometry, Path="{0}")
flatten_9 = FlattenTree(Tree=xy, Path="{0}")
flatten_10 = FlattenTree(Tree=move_3.Geometry, Path="{0}")
flatten_11 = FlattenTree(Tree=addition, Path="{0}")
flatten_12 = FlattenTree(Tree=addition_2, Path="{0}")
flatten_13 = FlattenTree(Tree=curve_lengths, Path="{0}")
flatten_14 = FlattenTree(Tree=addition_3, Path="{0}")
graft = GraftTree(Tree=flatten_13, IncludeEmptyLists=True, IncludeNullItems=True)
graft_2 = GraftTree(Tree=flatten_14, IncludeEmptyLists=True, IncludeNullItems=True)
graft_3 = GraftTree(Tree=flatten_11, IncludeEmptyLists=True, IncludeNullItems=True)
graft_4 = GraftTree(Tree=flatten_12, IncludeEmptyLists=True, IncludeNullItems=True)
merge = Merge(Data1=flatten_5, Data2=flatten_3, Data3=flatten_4, Data4=flatten_8)
merge_2 = Merge(Data1=flatten_9, Data2=flatten_6, Data3=flatten_7, Data4=flatten_10)
graft_5 = GraftTree(Tree=merge, IncludeEmptyLists=True, IncludeNullItems=True)
graft_6 = GraftTree(Tree=merge_2, IncludeEmptyLists=True, IncludeNullItems=True)
merge_3 = Merge(Data1=graft, Data2=graft_3, Data3=graft_4, Data4=graft_2)
flip = FlipMatrix(Data=merge_3)
curve_lengths_2 = Panel(flip)
panel = Panel(graft_6)
pipe_preview_meshes = Mesh(graft_5)
xy_2 = XYPlane(Origin=Point(0, 0, 0))
curve_planes_2 = Plane(curve_planes)
scale_nu_4 = ScaleNU(Geometry=pipe_preview_meshes, Plane=xy_2, ScaleX=1, ScaleY=1, ScaleZ=curve_lengths_2)  # -> Geometry, Transform
xy_3 = XYPlane(Origin=Point(0, 0, 0))
orient = Orient(Geometry=scale_nu_4.Geometry, Source=graft_6, Target=curve_planes_2)  # -> Geometry, Transform
scaled_and_oriented_preview_meshes = Mesh(orient.Geometry)
flip_2 = FlipMatrix(Data=scaled_and_oriented_preview_meshes)
panel_2 = Panel("0")
item_3 = ListItem(List=flip_2, Index="3", Wrap=True)
item_4 = ListItem(List=flip_2, Index=0, Wrap=True)
item_5 = ListItem(List=flip_2, Index="2", Wrap=True)
item_6 = ListItem(List=flip_2, Index="1", Wrap=True)
col_2 = Colour(filter)
swatch = ColourSwatch(SwatchColor=RGB(255, 255, 255))
material = CreateMaterial(Diffuse=col_2, Specular=swatch, Emission=col_2, Transparency=Slider(0.968, range=0..1), Shine=0)
material_2 = CreateMaterial(Diffuse=col_2, Specular=swatch, Emission=col_2, Transparency=Slider(0.905, range=0..1), Shine=0)
material_3 = CreateMaterial(Diffuse=col_2, Specular=swatch, Emission=col_2, Transparency=Slider(0.861, range=0..1), Shine=0)
material_4 = CreateMaterial(Diffuse=col_2, Specular=swatch, Emission=col_2, Transparency=Slider(0, range=0..1), Shine=0)
preview = CustomPreview(Geometry=item_6, Shader=material_3)
preview_2 = CustomPreview(Geometry=item_4, Shader=material_4)
preview_3 = CustomPreview(Geometry=item_5, Shader=material_2)
preview_4 = CustomPreview(Geometry=item_3, Shader=material)

# ==== cluster GlowingEndMillPaths
curves_for_glowpipe_preview = ClusterInput()
bit_diameter = ClusterInput()
path_color = ClusterInput()
number_slider = Slider(0.2, range=0..10)
corner_fill_factor = Slider(0.05, range=0..1)
number_slider_2 = Slider(0.751, range=0..1)
number_slider_3 = Slider(0.665, range=0..1)
number_slider_4 = Slider(6, range=0..10)
number_slider_5 = Slider(0.48, range=0..1)
bit_diameter_2 = Number(bit_diameter)
curves_for_glowpipe_preview_2 = Curve(curves_for_glowpipe_preview)
bit_diameter_3 = Number(bit_diameter_2)
default_color = ColourSwatch(SwatchColor=RGB(31, 229, 255))
multiplication = Multiplication(A=bit_diameter_3, B="0.5")
xy = XYPlane(Origin=Point(0, 0, 0))
multiplication_2 = Multiplication(A=multiplication, B=Slider(0.8, range=0..1))
neg = Negative(Value=".1")
col = Colour(path_color)
neg_2 = Negative(Value=multiplication_2)
topoly = CurveToPolyline(Curve=curves_for_glowpipe_preview_2, ToleranceDistance=number_slider, ToleranceAngle=0)  # -> Polyline, Segments
pt = ConstructPoint(XCoordinate=0, YCoordinate=multiplication_2, ZCoordinate=neg)
pt_2 = ConstructPoint(XCoordinate=0, YCoordinate=neg_2, ZCoordinate=neg)
flatten = FlattenTree(Tree=col, Path="{0}")
redpline = Reduce(Polyline=topoly.Polyline, Tolerance=number_slider)  # -> Polyline, Reduction
multiplication_3 = Multiplication(A=Slider(0, range=0..10), B=number_slider_2)
multiplication_4 = Multiplication(A=multiplication_3, B=number_slider_3)
multiplication_5 = Multiplication(A=multiplication_4, B=number_slider_5)
explode = Explode(Curve=redpline.Polyline, Recursive=True)  # -> Segments, Vertices
item = ListItem(List=flatten, Index=0, Wrap=True)
ln = Line(StartPoint=pt, EndPoint=pt_2)
X = UnitX(Factor=Slider(1, range=0..100))
multiplication_6 = Multiplication(A=multiplication_4, B=corner_fill_factor)
multiplication_7 = Multiplication(A=multiplication_3, B=corner_fill_factor)
multiplication_8 = Multiplication(A=multiplication_5, B=corner_fill_factor)
flatten_2 = FlattenTree(Tree=explode.Segments, Path="{0}")
null = NullItem(Item=item)  # -> NullFlags, InvalidFlags, Description
Z = UnitZ(Factor=1)
neg_3 = Negative(Value=multiplication_7)
neg_4 = Negative(Value=multiplication_6)
neg_5 = Negative(Value=multiplication_8)
extr = Extrude(Base=ln, Direction=X)
pframe = PerpFrame(Curve=flatten_2, Parameter="0")
filter = StreamFilter(Gate=null.NullFlags, Stream0=col, Stream1=default_color)
align = AlignPlane(Plane=pframe, Direction=Z)  # -> Plane, Angle
len = Length(Curve=flatten_2)
X_2 = UnitX(Factor=neg_5)
X_3 = UnitX(Factor=neg_4)
X_4 = UnitX(Factor=neg_3)
deplane = DeconstructPlane(Plane=align.Plane)  # -> Origin, XAxis, YAxis, ZAxis
curve_lengths = Panel(len)
multiplication_9 = Multiplication(A=multiplication_7, B="2")
multiplication_10 = Multiplication(A=multiplication_6, B="2")
multiplication_11 = Multiplication(A=multiplication_8, B="2")
pl = ConstructPlane(Origin=deplane.Origin, XAxis=deplane.ZAxis, YAxis=deplane.YAxis)
move = Move(Geometry=xy, Motion=X_4)  # -> Geometry, Transform
move_2 = Move(Geometry=move.Geometry, Motion=X_3)  # -> Geometry, Transform
move_3 = Move(Geometry=move_2.Geometry, Motion=X_2)  # -> Geometry, Transform
mesh = MeshBrep(
    Brep=extr,
    Settings={GridMaxCount=0, GridMinCount=16, JaggedSeams=False, MaxEdgeLength=0, MinEdgeLength=0.0001, MinTolerance=0, Refine=True, RefineAngle=0, RelativeTolerance=0.65, SimplePlanes=True, Tolerance=0})
addition = Addition(A=curve_lengths, B=multiplication_9)
addition_2 = Addition(A=addition, B=multiplication_10)
addition_3 = Addition(A=addition_2, B=multiplication_11)
curve_planes = Plane(pl)
scale_nu = ScaleNU(Geometry=mesh, Plane=xy, ScaleX=1, ScaleY=number_slider_2, ScaleZ=1)  # -> Geometry, Transform
scale_nu_2 = ScaleNU(Geometry=scale_nu.Geometry, Plane=xy, ScaleX=1, ScaleY=number_slider_3, ScaleZ=1)  # -> Geometry, Transform
scale_nu_3 = ScaleNU(Geometry=scale_nu_2.Geometry, Plane=xy, ScaleX=1, ScaleY=number_slider_5, ScaleZ=1)  # -> Geometry, Transform
flatten_3 = FlattenTree(Tree=scale_nu.Geometry, Path="{0}")
flatten_4 = FlattenTree(Tree=scale_nu_2.Geometry, Path="{0}")
flatten_5 = FlattenTree(Tree=mesh, Path="{0}")
flatten_6 = FlattenTree(Tree=move.Geometry, Path="{0}")
flatten_7 = FlattenTree(Tree=move_2.Geometry, Path="{0}")
flatten_8 = FlattenTree(Tree=scale_nu_3.Geometry, Path="{0}")
flatten_9 = FlattenTree(Tree=xy, Path="{0}")
flatten_10 = FlattenTree(Tree=move_3.Geometry, Path="{0}")
flatten_11 = FlattenTree(Tree=addition, Path="{0}")
flatten_12 = FlattenTree(Tree=addition_2, Path="{0}")
flatten_13 = FlattenTree(Tree=curve_lengths, Path="{0}")
flatten_14 = FlattenTree(Tree=addition_3, Path="{0}")
graft = GraftTree(Tree=flatten_13, IncludeEmptyLists=True, IncludeNullItems=True)
graft_2 = GraftTree(Tree=flatten_14, IncludeEmptyLists=True, IncludeNullItems=True)
graft_3 = GraftTree(Tree=flatten_11, IncludeEmptyLists=True, IncludeNullItems=True)
graft_4 = GraftTree(Tree=flatten_12, IncludeEmptyLists=True, IncludeNullItems=True)
merge = Merge(Data1=flatten_5, Data2=flatten_3, Data3=flatten_4, Data4=flatten_8)
merge_2 = Merge(Data1=flatten_10, Data2=flatten_7, Data3=flatten_6, Data4=flatten_9)
graft_5 = GraftTree(Tree=merge, IncludeEmptyLists=True, IncludeNullItems=True)
graft_6 = GraftTree(Tree=merge_2, IncludeEmptyLists=True, IncludeNullItems=True)
merge_3 = Merge(Data1=graft_2, Data2=graft_4, Data3=graft_3, Data4=graft)
flip = FlipMatrix(Data=merge_3)
curve_lengths_2 = Panel(flip)
pipe_preview_meshes = Mesh(graft_5)
xy_2 = XYPlane(Origin=Point(0, 0, 0))
curve_planes_2 = Plane(curve_planes)
scale_nu_4 = ScaleNU(Geometry=pipe_preview_meshes, Plane=xy_2, ScaleX=curve_lengths_2, ScaleY=1, ScaleZ=1)  # -> Geometry, Transform
xy_3 = XYPlane(Origin=Point(0, 0, 0))
orient = Orient(Geometry=scale_nu_4.Geometry, Source=graft_6, Target=curve_planes_2)  # -> Geometry, Transform
scaled_and_oriented_preview_meshes = Mesh(orient.Geometry)
flip_2 = FlipMatrix(Data=scaled_and_oriented_preview_meshes)
panel = Panel("0")
item_2 = ListItem(List=flip_2, Index="3", Wrap=True)
item_3 = ListItem(List=flip_2, Index=0, Wrap=True)
item_4 = ListItem(List=flip_2, Index="2", Wrap=True)
item_5 = ListItem(List=flip_2, Index="1", Wrap=True)
col_2 = Colour(filter)
Z_2 = UnitZ(Factor="0.3")
Z_3 = UnitZ(Factor="0.1")
Z_4 = UnitZ(Factor="0.2")
move_4 = Move(Geometry=item_3, Motion=Z_2)  # -> Geometry, Transform
move_5 = Move(Geometry=item_4, Motion=Z_3)  # -> Geometry, Transform
move_6 = Move(Geometry=item_5, Motion=Z_4)  # -> Geometry, Transform
swatch = ColourSwatch(SwatchColor=RGB(255, 255, 255))
material = CreateMaterial(Diffuse=col_2, Specular=swatch, Emission=col_2, Transparency=Slider(0.968, range=0..1), Shine=0)
material_2 = CreateMaterial(Diffuse=col_2, Specular=swatch, Emission=col_2, Transparency=Slider(0.905, range=0..1), Shine=0)
material_3 = CreateMaterial(Diffuse=col_2, Specular=swatch, Emission=col_2, Transparency=Slider(0.861, range=0..1), Shine=0)
material_4 = CreateMaterial(Diffuse=col_2, Specular=swatch, Emission=col_2, Transparency=Slider(0, range=0..1), Shine=0)
preview = CustomPreview(Geometry=move_5.Geometry, Shader=material_3)
preview_2 = CustomPreview(Geometry=item_2, Shader=material_4)
preview_3 = CustomPreview(Geometry=move_4.Geometry, Shader=material)
preview_4 = CustomPreview(Geometry=move_6.Geometry, Shader=material_2)

# ==== cluster Cluster
background_details = Panel("<svg xmlns=\"http://www.w3.org/2000/svg\" version=\"1.1\" width=\"W\" height=\"H\" style=\"background-color:rgb(C)\">")
background_width = ClusterInput()
rep = ReplaceText(Text=background_details, Find="W", BackgroundWidth=background_width, RecursiveReplace=False)
background_height = ClusterInput()
rep_2 = ReplaceText(Text=rep, Find="H", BackgroundHeight=background_height, RecursiveReplace=False)
background_color = ClusterInput()
rep_3 = ReplaceText(Text=rep_2, Find="C", BackgroundColor=background_color, RecursiveReplace=False)
data = ClusterInput()
data_2 = Data(data)
merge = Merge(Data1=rep_3, Data2=data_2, Data3="</svg>")
svg_composer = ClusterOutput(merge)

# ==== cluster Cluster_2
polyline = ClusterInput()
disc = Discontinuity(Polyline=polyline, Level=1)  # -> Points, Parameters
pdecon = Deconstruct(Point=disc.Points)  # -> XComponent, YComponent, ZComponent
background_height = ClusterInput()
polyline_string = Panel("<polyline points=\"C\" stroke=\"rgb(S)\" stroke-width=\"W\" stroke-dasharray=\"A\" fill=\"none\" />")
subtraction = Subtraction(BackgroundHeight=background_height, B=pdecon.YComponent)
concat = Concatenate(FragmentA=pdecon.XComponent, FragmentB=",", FragmentC=subtraction, FragmentD=" ")
join = TextJoin(Text=concat)
stroke_color = ClusterInput()
rep = ReplaceText(Text=polyline_string, Find="C", Replace=join, RecursiveReplace=False)
stroke_width = ClusterInput()
rep_2 = ReplaceText(Text=rep, Find="S", StrokeColor=stroke_color, RecursiveReplace=False)
rep_3 = ReplaceText(Text=rep_2, Find="W", StrokeWidth=stroke_width, RecursiveReplace=False)
stroke_dasharray = ClusterInput()
rep_4 = ReplaceText(Text=rep_3, Find="A", StrokeDasharray=stroke_dasharray, RecursiveReplace=False)
polyline_svg = ClusterOutput(rep_4)

# ==== cluster ConnectOverlappingToolpaths
polyline_toolpaths = ClusterInput()
polyline_toolpaths_2 = Curve(polyline_toolpaths)
clean = CleanTree(RemoveNulls=True, RemoveInvalid=True, RemoveEmpty=False, Tree=polyline_toolpaths_2)
crv = Curve(clean)
cp = ControlPoints(Curve=crv)  # -> Points, Weights, Knots
cp_2 = ControlPoints(Curve=crv)  # -> Points, Weights, Knots
end = EndPoints(Curve=crv)  # -> Start, End
lng = ListLength(List=cp.Points)
pshift = ShiftPaths(Data=cp_2.Points, Offset=-1)
shift = ShiftList(List=end.Start, Shift=1, Wrap=False)
shift_2 = ShiftList(List=end.End, Shift=-1, Wrap=False)
pshift_2 = ShiftPaths(Data=lng, Offset=-1)
pline = PolyLine(Vertices=pshift, Closed=False)
pdecon = Deconstruct(Point=shift)  # -> XComponent, YComponent, ZComponent
pdecon_2 = Deconstruct(Point=shift_2)  # -> XComponent, YComponent, ZComponent
ma = MassAddition(Input=pshift_2)  # -> Result, PartialResults
cp_3 = ControlPoints(Curve=pline)  # -> Points, Weights, Knots
pshift_3 = ShiftPaths(Data=cp_2.Points, Offset=-1)
flatten = FlattenTree(Tree=ma.PartialResults, Path="{0}")
multiplication = Multiplication(A=pdecon.YComponent, B="100")
multiplication_2 = Multiplication(A=pdecon.XComponent, B="100")
multiplication_3 = Multiplication(A=pdecon_2.XComponent, B="100")
multiplication_4 = Multiplication(A=pdecon_2.YComponent, B="100")
lng_2 = ListLength(List=pshift_3)
lng_3 = ListLength(List=cp_3.Points)
int = Integer(multiplication)
int_2 = Integer(multiplication_2)
int_3 = Integer(multiplication_3)
int_4 = Integer(multiplication_4)
smaller = SmallerThan(FirstNumber=lng_3, SecondNumber=lng_2)  # -> SmallerThan, OrEqualTo
division = Division(A=int, B="100")
division_2 = Division(A=int_2, B="100")
division_3 = Division(A=int_3, B="100")
division_4 = Division(A=int_4, B="100")
unreialiable_result_boolean = Panel(smaller.SmallerThan)
equals = Equality(FirstNumber=division_2, SecondNumber=division_3)  # -> Equality, Inequality
equals_2 = Equality(FirstNumber=division, SecondNumber=division_4)  # -> Equality, Inequality
and = GateAnd(A=equals.Equality, B=equals_2.Equality)

# ---- group: Line connection viz for troubleshooting
dispatch = Dispatch(List=shift_2, DispatchPattern=and)  # -> ListA, ListB
dispatch_2 = Dispatch(List=shift, DispatchPattern=and)  # -> ListA, ListB
ln = Line(StartPoint=dispatch_2.ListA, EndPoint=dispatch.ListA)  # disabled

# ----
rev = ReverseList(List=flatten)
rev_2 = ReverseList(List=flatten)
cull_i = CullIndex(List=rev, Indices="0", Wrap=True)
item = ListItem(List=rev, Index="0", Wrap=True)
cull_i_2 = CullIndex(List=rev_2, Indices="0", Wrap=True)
pshift_4 = ShiftPaths(Data=and, Offset=-1)
pshift_5 = ShiftPaths(Data=cull_i, Offset=-1)
pshift_6 = ShiftPaths(Data=cull_i_2, Offset=-1)
lng_4 = ListLength(List=pshift_4)
rev_3 = ReverseList(List=pshift_5)
rev_4 = ReverseList(List=pshift_6)
ins = InsertItems(List=pshift_4, Item=Toggle(False), Indices="0", Wrap=True)
ins_2 = InsertItems(List=pshift_4, Item=Toggle(False), Indices=lng_4, Wrap=True)
subtraction = Subtraction(A=rev_3, B="1")
cp_4 = ControlPoints(Curve=pline)  # -> Points, Weights, Knots
flatten_2 = FlattenTree(Tree=pshift, Path="{0}")
pshift_7 = ShiftPaths(Data=ins, Offset=-1)
merge = Merge(Data1=subtraction, Data2=item)
merge_2 = Merge(Data1="0", Data2=rev_4)
pshift_8 = ShiftPaths(Data=ins_2, Offset=-1)
dispatch_3 = Dispatch(List=merge_2, DispatchPattern=pshift_7)  # -> ListA, ListB
dispatch_4 = Dispatch(List=merge, DispatchPattern=pshift_8)  # -> ListA, ListB
dom = ConstructDomain(DomainStart=dispatch_3.ListB, DomainEnd=dispatch_4.ListB)
subset = SubList(List=flatten_2, Domain=dom, Wrap=False)  # -> List, Index
pline_2 = PolyLine(Vertices=subset.List, Closed=False)
unreialiable_result_boolean_2 = Panel(unreialiable_result_boolean)
flatten_3 = FlattenTree(Tree=pline_2, Path="{0}")
pshift_9 = ShiftPaths(Data=pline_2, Offset=-2)
filter = StreamFilter(Gate=unreialiable_result_boolean_2, Stream0=pshift_9)
item_2 = ListItem(List=flatten_3, Index=0, Wrap=True)
polyline_toolpaths_3 = Curve(polyline_toolpaths_2)
null = NullItem(Item=item_2)  # -> NullFlags, InvalidFlags, Description
filter_2 = StreamFilter(Gate=null.NullFlags, Stream0=flatten_3, Stream1=polyline_toolpaths_3)
z_connected_polyline_toolpaths = Curve(filter_2)
z_connected_polyline_toolpaths_2 = ClusterOutput(z_connected_polyline_toolpaths)

# ==== cluster TabToolpaths
polyline_toolpaths = ClusterInput()
tab_breps = ClusterInput()
tab_breps_2 = Brep(tab_breps)
polyline_toolpaths_2 = Curve(polyline_toolpaths)
flatten = FlattenTree(Tree=tab_breps_2, Path="{0}")
bbox = BoundingBox(Content=polyline_toolpaths_2, Plane=PlaneXY(0, 0, 0), UnionBox=True)  # -> Box, Box_2
bbox_2 = BoundingBox(Content=flatten, Plane=PlaneXY(0, 0, 0))  # -> Box, Box_2
debrep = DeconstructBrep(Brep=bbox.Box)  # -> Faces, Edges, Vertices

# ---- group: Check for input tab breps
item = ListItem(List=flatten, Index=0, Wrap=True)
null = NullItem(Item=item)  # -> NullFlags, InvalidFlags, Description
no_tab_brep_input_boolean = Panel(null.NullFlags)

# ----
debrep_2 = DeconstructBrep(Brep=bbox_2.Box)  # -> Faces, Edges, Vertices
item_2 = ListItem(List=debrep.Vertices, Index="0", Wrap=True)
item_3 = ListItem(List=debrep_2.Vertices, Index="4", Wrap=True)
item_4 = ListItem(List=debrep_2.Vertices, Index="0", Wrap=True)
pdecon = Deconstruct(Point=flatten(item_2))  # -> XComponent, YComponent, ZComponent
pdecon_2 = Deconstruct(Point=flatten(item_3))  # -> XComponent, YComponent, ZComponent
pdecon_3 = Deconstruct(Point=flatten(item_4))  # -> XComponent, YComponent, ZComponent
subtraction = Subtraction(A=pdecon.ZComponent, B="0.1")
panel = Panel(subtraction)

larger = LargerThan(FirstNumber=pdecon_2.ZComponent, SecondNumber="0")  # -> LargerThan, OrEqualTo
subtraction_2 = Subtraction(A=pdecon_2.ZComponent, B="0")
dispatch = Dispatch(List=subtraction_2, DispatchPattern=larger.LargerThan)  # -> ListA, ListB
lng = ListLength(List=dispatch.ListB)
dup = DuplicateData(Data="0", Number=lng, Order=True)
weave = Weave(Pattern=larger.LargerThan, Stream0=dup, Stream1=dispatch.ListA, NullGaps=False)
neg = Negative(Value=weave)
Z = UnitZ(Factor=neg)
move = Move(Geometry=flatten(item_3), Motion=Z)  # -> Geometry, Transform
move_2 = Move(Geometry=flatten(item_4), Motion=Z)  # -> Geometry, Transform
move_3 = Move(Geometry=tab_breps_2, Motion=Z)  # -> Geometry, Transform

pdecon_4 = Deconstruct(Point=flatten(move_2.Geometry))  # -> XComponent, YComponent, ZComponent
smaller = SmallerThan(FirstNumber=pdecon_4.ZComponent, SecondNumber=panel)  # -> SmallerThan, OrEqualTo
dist = Distance(PointA=flatten(item_3), PointB=flatten(item_4))
subtraction_3 = Subtraction(A=pdecon_4.ZComponent, B=panel)
dispatch_2 = Dispatch(List=move_3.Geometry, DispatchPattern=smaller.SmallerThan)  # -> ListA, ListB
dispatch_3 = Dispatch(List=move.Geometry, DispatchPattern=smaller.SmallerThan)  # -> ListA, ListB
dispatch_4 = Dispatch(List=dist, DispatchPattern=smaller.SmallerThan)  # -> ListA, ListB
dispatch_5 = Dispatch(List=subtraction_3, DispatchPattern=smaller.SmallerThan)  # -> ListA, ListB
xy = XYPlane(Origin=dispatch_3.ListB)
addition = Addition(A=dispatch_5.ListB, B=dispatch_4.ListB)
division = Division(A=addition, B=dispatch_4.ListB)
scale_nu = ScaleNU(Geometry=dispatch_2.ListB, Plane=xy, ScaleX=1, ScaleY=1, ScaleZ=division)  # -> Geometry, Transform
weave_2 = Weave(Pattern=smaller.SmallerThan, Stream0=scale_nu.Geometry, Stream1=dispatch_2.ListA, NullGaps=False)

polyline_toolpaths_3 = Curve(polyline_toolpaths_2)
scaled_positioned_tab_breps = Brep(weave_2)
no_tab_brep_input_boolean_2 = Panel(no_tab_brep_input_boolean)
polyline_toolpaths_4 = Curve(polyline_toolpaths_2)

mesh = MeshBrep(
    Brep=scaled_positioned_tab_breps,
    Settings={GridMaxCount=0, GridMinCount=16, JaggedSeams=False, MaxEdgeLength=0, MinEdgeLength=0.0001, MinTolerance=0, Refine=True, RefineAngle=0, RelativeTolerance=0.65, SimplePlanes=True, Tolerance=0})
mjoin = MeshJoin(Meshes=mesh)
tab_volume_mesh = Mesh(mjoin)
colom = CollisionOneMany(Collider=tab_volume_mesh, Obstacles=graft(polyline_toolpaths_3))  # -> Collision, Index
pshift = ShiftPaths(Data=colom.Collision, Offset=-1)

tab_or_no_tab_booleans = Integer(pshift)

dispatch_6 = Dispatch(List=polyline_toolpaths_3, DispatchPattern=tab_or_no_tab_booleans)  # -> ListA, ListB
toolpaths_without_tabs = Curve(dispatch_6.ListB)
toolpaths_for_tabbing = Curve(dispatch_6.ListA)

bbox_3 = BoundingBox(Content=mesh, Plane=PlaneXY(0, 0, 0))  # -> Box, Box_2
volume = Volume(Geometry=bbox_3.Box)  # -> Volume, Centroid
xy_2 = XYPlane(Origin=volume.Centroid)
scale_nu_2 = ScaleNU(Geometry=bbox_3.Box, Plane=xy_2, ScaleX="1.01", ScaleY="1.01", ScaleZ=1)  # -> Geometry, Transform
mjoin_2 = MeshJoin(Meshes=scale_nu_2.Geometry)
tab_control_point_intersect_mesh = Mesh(mjoin_2)

mcx = MeshCurve(Mesh=tab_volume_mesh, Curve=toolpaths_for_tabbing)  # -> Points, Faces
crv_cp = CurveClosestPoint(Point=mcx.Points, Curve=graft(toolpaths_for_tabbing))  # -> Point, Parameter, Distance
tab_volume_mesh_2 = Mesh(tab_volume_mesh)
shatter = Shatter(Curve=graft(toolpaths_for_tabbing), Parameters=crv_cp.Parameter)
curvepoint = PointOnCurve(shatter, parameter=0.5)
minc = MeshInclusion(Mesh=tab_volume_mesh_2, Point=curvepoint, Strict=False)
dispatch_7 = Dispatch(List=shatter, DispatchPattern=minc)  # -> ListA, ListB
toolpaths_inside_tabs = Curve(dispatch_7.ListA)
toolpath_outside_tabs = Curve(dispatch_7.ListB)

cp = ControlPoints(Curve=toolpaths_inside_tabs)  # -> Points, Weights, Knots
Z_2 = UnitZ(Factor=1)
meshray = MeshRay(Mesh=tab_control_point_intersect_mesh, Point=cp.Points, Direction=Z_2)  # -> Point, Hit
pline = PolyLine(Vertices=meshray.Point, Closed=False)
pshift_2 = ShiftPaths(Data=pline, Offset=-1)

weave_3 = Weave(Pattern=minc, Stream0=toolpath_outside_tabs, Stream1=pshift_2, NullGaps=False)
cp_2 = ControlPoints(Curve=weave_3)  # -> Points, Weights, Knots

# ---- group: Test closing
cls = Closed(Curve=toolpaths_for_tabbing)  # -> Closed, Periodic
graft = GraftTree(Tree=cls.Closed, IncludeEmptyLists=True, IncludeNullItems=True)

# ----
pshift_3 = ShiftPaths(Data=cp_2.Points, Offset=-1)
pline_2 = PolyLine(Vertices=pshift_3, Closed=graft)
pshift_4 = ShiftPaths(Data=pline_2, Offset="-2")
toolpaths_without_tabs_2 = Curve(toolpaths_without_tabs)
tab_or_no_tab_booleans_2 = Integer(tab_or_no_tab_booleans)
toolpaths_with_tabs = Curve(pshift_4)
weave_4 = Weave(Pattern=tab_or_no_tab_booleans_2, Stream0=toolpaths_without_tabs_2, Stream1=toolpaths_with_tabs, NullGaps=False)

polyline_toolpaths_5 = Curve(polyline_toolpaths_2)
end = EndPoints(Curve=weave_4)  # -> Start, End

end_2 = EndPoints(Curve=polyline_toolpaths_5)  # -> Start, End
crv_cp_2 = CurveClosestPoint(Point=end_2.End, Curve=weave_4)  # -> Point, Parameter, Distance
pt = Point(end_2.End)

dist_2 = Distance(PointA=end.End, PointB=pt)
smaller_2 = SmallerThan(FirstNumber=dist_2, SecondNumber="0.01")  # -> SmallerThan, OrEqualTo
dispatch_8 = Dispatch(List=crv_cp_2.Parameter, DispatchPattern=smaller_2.SmallerThan)  # -> ListA, ListB
dispatch_9 = Dispatch(List=weave_4, DispatchPattern=smaller_2.SmallerThan)  # -> ListA, ListB
seam = Seam(Curve=dispatch_9.ListB, Seam=dispatch_8.ListB)
weave_5 = Weave(Pattern=smaller_2.SmallerThan, Stream0=seam, Stream1=dispatch_9.ListA, NullGaps=False)

filter = StreamFilter(Gate=no_tab_brep_input_boolean_2, Stream0=weave_5, Stream1=polyline_toolpaths_4)
tabbed_polyline_toolpaths = Curve(filter)
tabbed_polyline_toolpaths_2 = ClusterOutput(tabbed_polyline_toolpaths)

# ==== cluster RampToolpathPlunges
toolpaths_to_ramp = ClusterInput()
ramp_angle = ClusterInput()
toolpaths_to_ramp_2 = Curve(toolpaths_to_ramp)
ramp_angle_2 = Number(ramp_angle)
end = EndPoints(Curve=toolpaths_to_ramp_2)  # -> Start, End
pdecon = Deconstruct(Point=end.Start)  # -> XComponent, YComponent, ZComponent
abs = Absolute(Value=pdecon.ZComponent)
dom = ConstructDomain(DomainStart="1", DomainEnd="89")
constrain = Constrain(Number=ramp_angle_2, Domain=dom)
rad = Radians(Degrees=constrain)
rtrig = RightTrigonometry(Beta=rad, QLength=abs)  # -> Alpha, Beta, PLength, QLength, RLength
len = Length(Curve=toolpaths_to_ramp_2)
smaller = SmallerThan(FirstNumber=len, SecondNumber=rtrig.PLength)  # -> SmallerThan, OrEqualTo
dispatch = Dispatch(List=len, DispatchPattern=smaller.OrEqualTo)  # -> ListA, ListB
dispatch_2 = Dispatch(List=rtrig.PLength, DispatchPattern=smaller.OrEqualTo)  # -> ListA, ListB
division = Division(A=dispatch_2.ListA, B=dispatch.ListA)
weave = Weave(Pattern=smaller.OrEqualTo, Stream0=dispatch_2.ListB, Stream1=dispatch.ListA, NullGaps=False)

cls = Closed(Curve=toolpaths_to_ramp_2)  # -> Closed, Periodic
dispatch_3 = Dispatch(List=toolpaths_to_ramp_2, DispatchPattern=cls.Closed)  # -> ListA, ListB
flip = FlipCurve(Curve=dispatch_3.ListA)  # -> Curve, Flag
weave_2 = Weave(Pattern=cls.Closed, Stream0=dispatch_3.ListB, Stream1=flip.Curve, NullGaps=False)

round = Round(Number=division)  # -> Nearest, Floor, Ceiling
division_2 = Division(A=weave, B="0.1")
dispatch_4 = Dispatch(List=abs, DispatchPattern=smaller.OrEqualTo)  # -> ListA, ListB
int = Integer(division_2)
division_3 = Division(A=dispatch_4.ListA, B=round.Ceiling)
int_2 = Integer(division_2)
division_4 = Division(A=weave, B=int)
weave_3 = Weave(Pattern=smaller.OrEqualTo, Stream0=dispatch_4.ListB, Stream1=division_3, NullGaps=False)
addition = Addition(A=int, B="1")
division_5 = Division(A=weave_3, B=int_2)
series = Series(Start=0, Step=division_4, Count=addition)
series_2 = Series(Start=0, Step=division_5, Count=addition)
eval = EvaluateLength(Curve=graft(weave_2), Length=series, Normalized=False)  # -> Point, Tangent, Parameter
Z = UnitZ(Factor=series_2)
move = Move(Geometry=eval.Point, Motion=Z)  # -> Geometry, Transform
pline = PolyLine(Vertices=move.Geometry, Closed=False)
pshift = ShiftPaths(Data=pline, Offset=-1)
redpline = Reduce(Polyline=pshift, Tolerance="0.02")  # -> Polyline, Reduction
flip_2 = FlipCurve(Curve=redpline.Polyline)  # -> Curve, Flag

dispatch_5 = Dispatch(List=flip_2.Curve, DispatchPattern=smaller.OrEqualTo)  # -> ListA, ListB
end_2 = EndPoints(Curve=dispatch_5.ListA)  # -> Start, End
pdecon_2 = Deconstruct(Point=end_2.End)  # -> XComponent, YComponent, ZComponent
pdecon_3 = Deconstruct(Point=end_2.Start)  # -> XComponent, YComponent, ZComponent
pt = ConstructPoint(XCoordinate=0, YCoordinate=0, ZCoordinate=pdecon_2.ZComponent)
pt_2 = ConstructPoint(XCoordinate=0, YCoordinate=0, ZCoordinate=pdecon_3.ZComponent)
dist = Distance(PointA=pt_2, PointB=pt)
series_3 = Series(Start=0, Step=dist, Count=round.Ceiling)
Z_2 = UnitZ(Factor=series_3)
move_2 = Move(Geometry=graft(dispatch_5.ListA), Motion=Z_2)  # -> Geometry, Transform

clean = CleanTree(RemoveNulls=True, RemoveInvalid=True, RemoveEmpty=False, Tree=move_2.Geometry)
join = JoinCurves(Curves=move_2.Geometry, Preserve=False)
flip_3 = FlipMatrix(Data=clean)
lng = ListLength(List=join)
dispatch_6 = Dispatch(List=flip_3, DispatchPattern=cls.Closed)  # -> ListA, ListB
larger = LargerThan(FirstNumber=lng, SecondNumber="1")  # -> LargerThan, OrEqualTo
flip_4 = FlipMatrix(Data=dispatch_6.ListB)
dispatch_7 = Dispatch(List=join, DispatchPattern=larger.LargerThan)  # -> ListA, ListB
simplify = SimplifyTree(Tree=dispatch_7.ListA, Front=False)
dispatch_8 = Dispatch(List=flip_4, DispatchPattern=[True, False])  # -> ListA, ListB
flatten = FlattenTree(Tree=dispatch_7.ListB, Path="{0}")
dispatch_9 = Dispatch(List=simplify, DispatchPattern=[True, False])  # -> ListA, ListB
cp = ControlPoints(Curve=dispatch_8.ListB)  # -> Points, Weights, Knots
pdecon_4 = Deconstruct(Point=cp.Points)  # -> XComponent, YComponent, ZComponent
cp_2 = ControlPoints(Curve=dispatch_9.ListB)  # -> Points, Weights, Knots
rev = ReverseList(List=pdecon_4.ZComponent)
pdecon_5 = Deconstruct(Point=cp_2.Points)  # -> XComponent, YComponent, ZComponent
pt_3 = ConstructPoint(XCoordinate=pdecon_4.XComponent, YCoordinate=pdecon_4.YComponent, ZCoordinate=rev)
rev_2 = ReverseList(List=pdecon_5.ZComponent)
pline_2 = PolyLine(Vertices=pt_3, Closed=False)
pt_4 = ConstructPoint(XCoordinate=pdecon_5.XComponent, YCoordinate=pdecon_5.YComponent, ZCoordinate=rev_2)
pshift_2 = ShiftPaths(Data=pline_2, Offset=-1)
pline_3 = PolyLine(Vertices=pt_4, Closed=False)
flip_5 = FlipCurve(Curve=pshift_2)  # -> Curve, Flag
pshift_3 = ShiftPaths(Data=pline_3, Offset=-1)
weave_4 = Weave(Pattern=[0, 1], Stream0=dispatch_8.ListA, Stream1=flip_5.Curve, NullGaps=False)
flip_6 = FlipCurve(Curve=pshift_3)  # -> Curve, Flag
flip_7 = FlipMatrix(Data=weave_4)
weave_5 = Weave(Pattern=[0, 1], Stream0=dispatch_9.ListA, Stream1=flip_6.Curve, NullGaps=False)
weave_6 = Weave(Pattern=cls.Closed, Stream0=flip_7, Stream1=dispatch_6.ListA, NullGaps=False)
join_2 = JoinCurves(Curves=weave_5, Preserve=False)
flip_8 = FlipMatrix(Data=weave_6)
simplify_2 = SimplifyTree(Tree=join_2, Front=False)
join_3 = JoinCurves(Curves=flip_8, Preserve=False)
number_slider = Slider(4, range=0..10)
weave_7 = Weave(Pattern=flatten(larger.LargerThan), Stream0=flatten(flatten), Stream1=flatten(simplify_2), NullGaps=False)
pshift_4 = ShiftPaths(Data=join_3, Offset=-1)
pshift_5 = ShiftPaths(Data=pshift_4, Offset=-1)
weave_8 = Weave(Pattern=smaller.OrEqualTo, Stream0=dispatch_5.ListB, Stream1=weave_7, NullGaps=False)
item = ListItem(List=toolpaths_to_ramp_2, Index=number_slider, Wrap=True)
item_2 = ListItem(List=weave_8, Index=number_slider, Wrap=True)
weave_9 = Weave(Pattern=[0, 1], Stream0=weave_8, Stream1=toolpaths_to_ramp_2, NullGaps=False)
ramped_toolpaths = Curve(weave_9)
ramped_toolpaths_2 = ClusterOutput(ramped_toolpaths)
